# Grasshopper definition Simple Room.gh (Grasshopper 1.0.7)
# Copyright: 2021
# plug-ins: MantaRay, LadybugGrasshopper, LINK_Dashboards, Human, ImageClipboard

# ----
# Connect to SSH
# we added "cd <LinuxHome>" to
# the prefixes. This allows all of the
# components to startup in our
# LinuxHome folder
panel = Panel(". /etc/profile;. ~/.profile;mkdir -p <LinuxHome>;cd <LinuxHome>")
falsestart = LBFalseStartToggle(True)
connect = ConnectSSHFTP(
    User="lio",
    Ip="mm-c0d0e-028",
    ProjectName="SimpleRoom",
    Password="_prompt",
    _port="2222",
    Connect=falsestart,
    Prefixes=panel)  # -> Status, Prefixes, Run
panel_2 = Panel(connect.Status)
panel_3 = Panel(connect.Prefixes)
run = Boolean(connect.Run)

# ----
# Read Rhino file
run_2 = Boolean(run)
parserhinofile = ParseRhinoFile(LayerPrefix="Daylight_Inputs::_", Grids="Grids", Run=run_2)  # -> GlassGeometries, GlassModifiers, port, OpaqueGeometries, OpaqueModifiers, port_2, CustomGeometries, ModifierNames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
panel_4 = Panel(parserhinofile.SkippedLayers)
opaque_modifiers = Text(parserhinofile.OpaqueModifiers)
glass_modifiers = Text(parserhinofile.GlassModifiers)
opaque_mesh = Mesh(parserhinofile.OpaqueGeometries)
all_modifiers = Text([parserhinofile.GlassModifiers, parserhinofile.OpaqueModifiers])
glass_mesh = Mesh(parserhinofile.GlassGeometries)
grids = Geometry(parserhinofile.GridGeometries)
run_3 = Boolean(parserhinofile.Ran)

# ----
# 10klx overcast sky (RwR p357)
panel_5 = Panel("""mkdir -p skies/
echo "##Will control the gradient of the sky
" > <target>
gensky -ang 45 0 -c -B 55.866 >> <target>
echo "<glowandsource>" >> <target>
echo <target>""")
and_append_the_ground = Panel("""##The 1 will be multiplie with brightfunc
skyfunc glow sky_glow
0
0
4 1 1 1 0

##Set to 1 as it will be multiplied with the gensky result
sky_glow source sky
0
0
4 0 0 1 180

##Set to 1 as it will be multiplied with the gensky result
skyfunc glow ground_glow
0
0
4 1 1 1 0

##The ground pane
ground_glow source ground
0
0
4 0 0 -1 180""")
bool = Boolean(run_3)
overrides = ApplyOverrides(Input=panel_5, Target=graft("10kluxOvercast.sky"), Glowandsource=graft(and_append_the_ground))  # -> Output, DynamicOutput
executessh = ExecuteSSH(
    _SSHCommands_=overrides.DynamicOutput,
    Run=bool,
    addPrefix=True,
    description="""mkdir -p skies/
echo "##Will control the gradient of the sky
" > 10kluxOvercast.sky
gensky -ang 45 0 -c -B 55.866 >> 10kluxOvercast.sky
echo "

##The 1 will be multiplie with brightfunc
skyfunc glow sky_glow
0
0
4 1 1 1 0

##Set to 1 as it will be multiplied with the gensky result
sky_glow source sky
0
0
4 0 0 1 180

##Set to 1 as it will be multiplied with the gensky result
skyfunc glow ground_glow
0
0
4 1 1 1 0

##The ground pane
ground_glow source ground
0
0
4 0 0 -1 180" >> 10kluxOvercast.sky
echo 10kluxOvercast.sky""",
    fireLogs=False,
    lastRunTime=40.6306,
    suppressWarnings=False,
    results="10kluxOvercast.sky",
    commands="""mkdir -p skies/
echo "##Will control the gradient of the sky
" > 10kluxOvercast.sky
gensky -ang 45 0 -c -B 55.866 >> 10kluxOvercast.sky
echo "

##The 1 will be multiplie with brightfunc
skyfunc glow sky_glow
0
0
4 1 1 1 0

##Set to 1 as it will be multiplied with the gensky result
sky_glow source sky
0
0
4 0 0 1 180

##Set to 1 as it will be multiplied with the gensky result
skyfunc glow ground_glow
0
0
4 1 1 1 0

##The ground pane
ground_glow source ground
0
0
4 0 0 -1 180" >> 10kluxOvercast.sky
echo 10kluxOvercast.sky""")  # -> Stdout, Stderr_, Ran
panel_6 = Panel(executessh.Stderr_)
sky_ovc = Text(executessh.Stdout)

# ----
# Create grids in pts file
panel_7 = Panel("0.3")
grids_geometry = Geometry(grids)
run_4 = Boolean(run_3)
grid = GridCreate(
    Geometry=graft(grids_geometry),
    GridSize_m="0.3",
    VerticalOffset_m=0.75,
    EdgeOffset_m=panel_7,
    IsoCurves=True,
    GoLarge=False)  # -> Grids, Mesh, Points, Normals
points2pts = PointsToPts(
    Points=grid.Points,
    Vectors=grid.Normals,
    Run=run_4,
    stdouts="""0.3 -2.7 0.75 0 0 1
0.3 -2.4 0.75 0 0 1
0.3 -2.1 0.75 0 0 1
0.3 -1.8 0.75 0 0 1
0.3 -1.5 0.75 0 0 1
0.3 -1.2 0.75 0 0 1
0.3 -0.9 0.75 0 0 1
0.3 -0.6 0.75 0 0 1
0.3 -0.3 0.75 0 0 1
0.6 -2.7 0.75 0 0 1
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""")  # -> PtsString, Run
grid_2 = Data(grid.Grids)

# ----
# Create Rad files
run_5 = Boolean(run_3)
de_modifier = DeconstructModifier(Modifier=glass_modifiers)  # -> GeoName, ModifierName
de_modifier_2 = DeconstructModifier(Modifier=opaque_modifiers)  # -> GeoName, ModifierName
mesh2obj = MeshToObj(
    Mesh=graft(glass_mesh),
    Name=graft(de_modifier.GeoName),
    ModifierName=graft(de_modifier.ModifierName),
    MapFileName="glass",
    TargetFolder="objFiles",
    Run=run_5,
    MapFile="glass")  # -> ObjFiles, MapFile, Run
mesh2obj_2 = MeshToObj(
    Mesh=graft(opaque_mesh),
    Name=graft(de_modifier_2.GeoName),
    ModifierName=graft(de_modifier_2.ModifierName),
    MapFileName="mapping",
    TargetFolder="objFiles",
    Run=run_5,
    MapFile="mapping")  # -> ObjFiles, MapFile, Run
obj2rad = ObjToRad(
    ObjFiles=mesh2obj.ObjFiles,
    MapFile=mesh2obj.MapFile,
    TargetFolder="radFiles",
    Run=mesh2obj.Run,
    stdouts="radFiles/Glass_70_geo.rad")  # -> Status, RadFiles, Run
obj2rad_2 = ObjToRad(
    ObjFiles=mesh2obj_2.ObjFiles,
    MapFile=mesh2obj_2.MapFile,
    TargetFolder="radFiles",
    Run=mesh2obj_2.Run,
    stdouts="radFiles/Walls_50_00_geo.rad>JOIN<radFiles/Ground_20_00_geo.rad>JOIN<radFiles/Ceilings_70_00_geo.rad>JOIN<radFiles/Floors_20_00_geo.rad>JOIN<radFiles/Frames_70_00_geo.rad>JOIN<radFiles/Context_20_00_geo.rad")  # -> Status, RadFiles, Run

# ----
# Create mat files
panel_8 = Panel("""echo "<radFiles>" > radFiles/materials.mat
echo radFiles/materials.mat""")
all_modifiers_2 = Text(all_modifiers)
run_6 = Boolean(run_3)
join = TextJoin(Text=all_modifiers_2)
overrides_2 = ApplyOverrides(Input=panel_8, RadFiles=graft(join))  # -> Output, DynamicOutput
executessh_2 = ExecuteSSH(
    _SSHCommands_=overrides_2.DynamicOutput,
    Run=run_6,
    addPrefix=True,
    description="""echo "void glass Glass_70
0
0
3 0.762841984823016 0.762841984823016 0.762841984823016

void plastic Context_20_00
0
0
5 0.2 0.2 0.2 0 0

void plastic Frames_70_00
0
0
5 0.7 0.7 0.7 0 0

void plastic Floors_20_00
0
0
5 0.2 0.2 0.2 0 0

void plastic Ceilings_70_00
0
0
5 0.7 0.7 0.7 0 0

void plastic Ground_20_00
0
0
5 0.2 0.2 0.2 0 0

void plastic Walls_50_00
0
0
5 0.5 0.5 0.5 0 0" > radFiles/materials.mat
echo radFiles/materials.mat""",
    fireLogs=False,
    lastRunTime=82.3676,
    suppressWarnings=False,
    results="radFiles/materials.mat",
    commands="""echo "void glass Glass_70
0
0
3 0.762841984823016 0.762841984823016 0.762841984823016

void plastic Context_20_00
0
0
5 0.2 0.2 0.2 0 0

void plastic Frames_70_00
0
0
5 0.7 0.7 0.7 0 0

void plastic Floors_20_00
0
0
5 0.2 0.2 0.2 0 0

void plastic Ceilings_70_00
0
0
5 0.7 0.7 0.7 0 0

void plastic Ground_20_00
0
0
5 0.2 0.2 0.2 0 0

void plastic Walls_50_00
0
0
5 0.5 0.5 0.5 0 0" > radFiles/materials.mat
echo radFiles/materials.mat""")  # -> Stdout, Stderr_, Ran

# ----
# check content of sky
panel_9 = Panel("cat <target>")
overrides_3 = ApplyOverrides(Input=panel_9, Target=graft(executessh.Stdout))  # -> Output, DynamicOutput
executessh_3 = ExecuteSSH(
    _SSHCommands_=overrides_3.Output,
    Run=False,
    addPrefix=True,
    fireLogs=False,
    lastRunTime=113,
    suppressWarnings=False,
    results="""##Will control the gradient of the sky

# gensky -ang 45 0 -c -B 55.866
# Ground ambient level: 17.8

void brightfunc skyfunc
2 skybr skybright.cal
0
3 2 2.29e+01 3.56e+00


##The 1 will be multiplie with brightfunc
skyfunc glow sky_glow
0
0
4 1 1 1 0

##Set to 1 as it will be multiplied with the gensky result
sky_glow source sky
0
0
4 0 0 1 180

##Set to 1 as it will be multiplied with the gensky result
skyfunc glow ground_glow
0
0
4 1 1 1 0

##The ground pane
ground_glow source ground
0
0
4 0 0 -1 180""",
    commands="cat 10kluxOvercast.sky")  # -> Stdout, Stderr_, Ran
panel_10 = Panel(executessh_3.Stdout)

# ----
# Save pts file (on linux)
run_7 = Boolean(points2pts.Run)
ptsstring = Text(points2pts.PtsString)
panel_11 = Panel("""mkdir -p ptsFiles/
echo "<pts>" > ptsFiles/<target>
echo ptsFiles/<target>""")
overrides_4 = ApplyOverrides(Input=panel_11, Target=graft("ptsFiles.pts"), Pts=graft(ptsstring))  # -> Output, DynamicOutput
executessh_4 = ExecuteSSH(
    _SSHCommands_=overrides_4.Output,
    Run=run_7,
    addPrefix=True,
    fireLogs=False,
    lastRunTime=23.9901,
    suppressWarnings=False,
    results="ptsFiles/ptsFiles.pts",
    commands="""mkdir -p ptsFiles/
echo "0.3 -2.7 0.75 0 0 1
0.3 -2.4 0.75 0 0 1
0.3 -2.1 0.75 0 0 1
0.3 -1.8 0.75 0 0 1
0.3 -1.5 0.75 0 0 1
0.3 -1.2 0.75 0 0 1
0.3 -0.9 0.75 0 0 1
0.3 -0.6 0.75 0 0 1
0.3 -0.3 0.75 0 0 1
0.6 -2.7 0.75 0 0 1
0.6 -2.4 0.75 0 0 1
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" > ptsFiles/ptsFiles.pts
echo ptsFiles/ptsFiles.pts""")  # -> Stdout, Stderr_, Ran
ptsfile = Text(executessh_4.Stdout)

entwine = Entwine(Branch00=executessh_2.Stdout, Branch01=obj2rad.RadFiles, Branch02=obj2rad_2.RadFiles, FlattenInputs=True)  # -> flatten(Result)
all_rad_files = Text(entwine)

# ----
# Octree - oconv
panel_12 = Panel("""mkdir -p octrees/
oconv -r 2048 -w -f <rads> > octrees/<target>
echo octrees/<target>""")
sky_ovc_2 = Text(sky_ovc)
scene_rads = Text(all_rad_files)
python = GhPythonScript(x=flatten(scene_rads))  # -> noNulls; inputs x: list
# ---------- python: Python ----------
__author__ = "mm1013"
__version__ = "2022.06.15"

import rhinoscriptsyntax as rs

noNulls = None not in x and len(x) > 0
# ---------- end python ----------
entwine_2 = Entwine(Branch01=sky_ovc_2, Branch02=scene_rads, FlattenInputs=True)  # -> flatten(Radfiles)
and = GateAnd(A=python, B=executessh_2.Ran)
join_2 = TextJoin(Text=entwine_2, Join=" ")
overrides_5 = ApplyOverrides(Input=panel_12, Rads=graft(join_2), Target=graft("Scene_Overcast10klux.oct"))  # -> Output, DynamicOutput
executessh_5 = ExecuteSSH(
    _SSHCommands=overrides_5.DynamicOutput,
    Run=and,
    addPrefix=True,
    description="""mkdir -p octrees/
oconv -r 2048 -w -f 10kluxOvercast.sky radFiles/materials.mat radFiles/Glass_70_geo.rad radFiles/Walls_50_00_geo.rad radFiles/Ground_20_00_geo.rad radFiles/Ceilings_70_00_geo.rad radFiles/Floors_20_00_geo.rad radFiles/Frames_70_00_geo.rad radFiles/Context_20_00_geo.rad > octrees/Scene_Overcast10klux.oct
echo octrees/Scene_Overcast10klux.oct""",
    fireLogs=True,
    lastRunTime=33.3294,
    name="oconv Scene_Overcast10klux.oct",
    staticDescription="""mkdir -p ~/MantaRay/Andrei/octrees/
oconv -r 2048 -w -f ~/MantaRay/Andrei/skies/overcast_sky.rad ~/MantaRay/Andrei/radFiles/Glass_70.mat /home/lio/MantaRay/Andrei/radFiles/Glass_70_geo.rad ~/MantaRay/Andrei/radFiles/opaque_materials.mat /home/lio/MantaRay/Andrei/radFiles/FloorMat_0.7_geo.rad /home/lio/MantaRay/Andrei/radFiles/Cladding_0.5_geo.rad /home/lio/MantaRay/Andrei/radFiles/ConcreteWhite_0.8_geo.rad /home/lio/MantaRay/Andrei/radFiles/ConcreteStructure_0.3_geo.rad /home/lio/MantaRay/Andrei/radFiles/ConcreteGrey_0.5_geo.rad /home/lio/MantaRay/Andrei/radFiles/IntWalls_0.9_geo.rad /home/lio/MantaRay/Andrei/radFiles/Pipes_0.03_geo.rad /home/lio/MantaRay/Andrei/radFiles/ConcreteDarker_0.1_geo.rad /home/lio/MantaRay/Andrei/radFiles/Frames_0.6_geo.rad /home/lio/MantaRay/Andrei/radFiles/Black_0.01_geo.rad /home/lio/MantaRay/Andrei/radFiles/CurvedCeiling_0.8_geo.rad /home/lio/MantaRay/Andrei/radFiles/IntWalls_0.8_geo.rad /home/lio/MantaRay/Andrei/radFiles/FloorBox_0.75_geo.rad ~/MantaRay/Andrei/radFiles/other_materials.mat > ~/MantaRay/Andrei/octrees/Scene_Overcast10klux.oct
echo ~/MantaRay/Andrei/octrees/Scene_Overcast10klux.oct""",
    suppressWarnings=False,
    results="octrees/Scene_Overcast10klux.oct",
    commands="""mkdir -p octrees/
oconv -r 2048 -w -f 10kluxOvercast.sky radFiles/materials.mat radFiles/Glass_70_geo.rad radFiles/Walls_50_00_geo.rad radFiles/Ground_20_00_geo.rad radFiles/Ceilings_70_00_geo.rad radFiles/Floors_20_00_geo.rad radFiles/Frames_70_00_geo.rad radFiles/Context_20_00_geo.rad > octrees/Scene_Overcast10klux.oct
echo octrees/Scene_Overcast10klux.oct""")  # -> Stdout, Stderr_, Ran
panel_13 = Panel(executessh_5.Stderr_)
panel_14 = Panel(overrides_5.Output)
octree_overcast = Text(executessh_5.Stdout)

# ----
# View rad files (inspect first 10 lines)
panel_15 = Panel("head <radFile>")
all_rad_files_2 = Text(all_rad_files)
falsestart_2 = LBFalseStartToggle(False)
overrides_6 = ApplyOverrides(Input=panel_15, RadFile=graft(all_rad_files_2))  # -> Output, DynamicOutput
executessh_6 = ExecuteSSH(
    _SSHCommands_=overrides_6.DynamicOutput,
    Run=falsestart_2,
    addPrefix=True,
    description="""head radFiles/materials.mat


- - -

head radFiles/Glass_70_geo.rad


- - -

head radFiles/Walls_50_00_geo.rad


- - -

head radFiles/Ground_20_00_geo.rad


- - -

head radFiles/Ceilings_70_00_geo.rad


- - -

head radFiles/Floors_20_00_geo.rad


- - -

head radFiles/Frames_70_00_geo.rad


- - -

head radFiles/Context_20_00_geo.rad""",
    fireLogs=False,
    lastRunTime=93,
    suppressWarnings=False,
    results=["""void glass Glass_70
0
0
3 0.762841984823016 0.762841984823016 0.762841984823016

void plastic Ceilings_70_00
0
0
5 0.7 0.7 0.7 0 0""", """# obj2rad -m /home/lio/MantaRay/SimpleRoom/radFiles/glass.map -f /home/lio/MantaRay/SimpleRoom/radFiles/Glass_70_geo.obj
# Written with MantaRay plugin/GH_MeshToRad

Glass_70 polygon Glass_70_geo_1.1
0
0
12
              1.198             -3.115              2.131
              3.164             -3.115              2.131
              3.164             -3.115               1.11""", """# obj2rad -m /home/lio/MantaRay/SimpleRoom/radFiles/mapping.map -f /home/lio/MantaRay/SimpleRoom/radFiles/Floors_20_00_geo.obj
# Written with MantaRay plugin/GH_MeshToRad

Floors_20_00 polygon Floors_20_00_geo_1.1
0
0
12
                4.5                  0                  0
                4.5                 -3                  0
                  0                 -3                  0""", """# obj2rad -m /home/lio/MantaRay/SimpleRoom/radFiles/mapping.map -f /home/lio/MantaRay/SimpleRoom/radFiles/Walls_50_00_geo.obj
# Written with MantaRay plugin/GH_MeshToRad

Walls_50_00 polygon Walls_50_00_geo_1.1
0
0
12
                  0                 -3                2.7
                  0                 -3                  0
              1.198                 -3               1.11""", """# obj2rad -m /home/lio/MantaRay/SimpleRoom/radFiles/mapping.map -f /home/lio/MantaRay/SimpleRoom/radFiles/Ground_20_00_geo.obj
# Written with MantaRay plugin/GH_MeshToRad

Ground_20_00 polygon Ground_20_00_geo_1.1
0
0
12
              -8.24             -8.918                  0
             11.055             -8.918                  0
             11.055               6.63                  0""", """# obj2rad -m /home/lio/MantaRay/SimpleRoom/radFiles/mapping.map -f /home/lio/MantaRay/SimpleRoom/radFiles/Frames_70_00_geo.obj
# Written with MantaRay plugin/GH_MeshToRad

Frames_70_00 polygon Frames_70_00_geo_1.1
0
0
12
              1.198                 -3               1.11
              3.164                 -3               1.11
              3.164             -3.103               1.11""", """# obj2rad -m /home/lio/MantaRay/SimpleRoom/radFiles/mapping.map -f /home/lio/MantaRay/SimpleRoom/radFiles/Context_20_00_geo.obj
# Written with MantaRay plugin/GH_MeshToRad

Context_20_00 polygon Context_20_00_geo_1.1
0
0
12
             -1.183             -7.158                  0
              0.747             -7.158                  0
              0.747             -7.158              1.983""", """# obj2rad -m /home/lio/MantaRay/SimpleRoom/radFiles/mapping.map -f /home/lio/MantaRay/SimpleRoom/radFiles/Ceilings_70_00_geo.obj
# Written with MantaRay plugin/GH_MeshToRad

Ceilings_70_00 polygon Ceilings_70_00_geo_1.1
0
0
12
                4.5                  0                2.7
                  0                  0                2.7
                  0                 -3                2.7"""],
    commands=["head radFiles/materials.mat", "head radFiles/Walls_50_00_geo.rad"])  # -> Stdout, Stderr_, Ran
panel_16 = Panel(executessh_6.Stdout)

# ----
# View rad files in 3d
all_rad_files_3 = Text(all_rad_files)
falsestart_3 = LBFalseStartToggle(True)
download = Download(
    SftpPaths=all_rad_files_3,
    Run=falsestart_3,
    stdouts="C:\Users\mm1013\MantaRay\SimpleRoom\materials.mat>JOIN<C:\Users\mm1013\MantaRay\SimpleRoom\Glass_70_geo.rad>JOIN<C:\Users\mm1013\MantaRay\SimpleRoom\Walls_50_00_geo.rad>JOIN<C:\Users\mm1013\MantaRay\SimpleRoom\Ground_20_00_geo.rad>JOIN<C:\Users\mm1013\MantaRay\SimpleRoom\Ceilings_70_00_geo.rad>JOIN<C:\Users\mm1013\MantaRay\SimpleRoom\Floors_20_00_geo.rad>JOIN<C:\Users\mm1013\MantaRay\SimpleRoom\Frames_70_00_geo.rad>JOIN<C:\Users\mm1013\MantaRay\SimpleRoom\Context_20_00_geo.rad")  # -> FilePaths, Status, Ran
cull = CullPattern(List=download.FilePaths, CullPattern=falsestart_3)
radviewer = RadViewer(
    RadFiles=flatten(cull),
    IsTwoSided=False,
    Polychromatic=True,
    ShowEdges=True,
    Transparent=True,
    ColorNames=["Glass_70", "Floors_20_00", "Walls_50_00", "Ground_20_00", "Frames_70_00", "Context_20_00", "Ceilings_70_00"],
    Colors=[RGB(138, 134, 190), RGB(132, 165, 122), RGB(132, 235, 142), RGB(185, 176, 113), RGB(140, 155, 219), RGB(120, 153, 213), RGB(180, 246, 253)])  # -> Geo, ModifierNames, Modifiers, FailedWireFrame

image = ClipboardImage(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)

# ----
# Daylight Factor simulation grid based
falsestart_4 = LBFalseStartToggle(False)
panel_17 = Panel("""mkdir -p results/
mkdir -p ambFiles/
mkdir -p timing/
date > timing/start.md
rtrace -af ambFiles/<af> -n 50 -w -h -I+ <ambientSettings> <octree> < <pts> > results/daylightFactor.ill
echo results/daylightFactor.ill
date > timing/end.md""")
octree_overcast_2 = Text(octree_overcast)
grid_3 = Data(grid_2)
pt = Point(grid.Points)
ptsfile_2 = Text(ptsfile)
python_2 = GhPythonScript(update=flatten(falsestart_4))  # -> time; inputs update: tree
# ---------- python_2: Python ----------
#if not update:
#    return self.time
"""Provides a scripting component.
    Inputs:
        x: The x script variable
        y: The y script variable
    Output:
        a: The a output variable"""
        
__author__ = "mm1013"
__version__ = "2022.08.30"
        
import rhinoscriptsyntax as rs
        
from datetime import datetime
dt = datetime.now()
        
time = "%02d_%02d_%02d_%02d%02d_%02d" % (dt.year, dt.month, dt.day, dt.hour, dt.minute, dt.second)
# ---------- end python_2 ----------
overrides_7 = ApplyOverrides(
    Input=panel_17,
    AmbientSettings=graft("-aa 0.1 -ab 5 -ad 2048 -lw 0.002"),
    Octree=graft(octree_overcast_2),
    Pts=graft(ptsfile_2),
    Af=graft(python_2))  # -> Output, DynamicOutput
executessh_7 = ExecuteSSH(
    _SSHCommands_=overrides_7.DynamicOutput,
    Run=falsestart_4,
    addPrefix=True,
    description="""mkdir -p results/
mkdir -p ambFiles/
mkdir -p timing/
date > timing/start.md
rtrace -af ambFiles/2023_05_30_2017_35 -n 50 -w -h -I+ -aa 0.1 -ab 5 -ad 2048 -lw 0.002 octrees/Scene_Overcast10klux.oct < ptsFiles/ptsFiles.pts > results/daylightFactor.ill
echo results/daylightFactor.ill
date > timing/end.md""",
    fireLogs=True,
    lastRunTime=24667,
    name="rtrace daylightfactor",
    suppressWarnings=False,
    results="results/daylightFactor.ill",
    commands="""mkdir -p results/
mkdir -p ambFiles/
mkdir -p timing/
date > timing/start.md
rtrace -af ambFiles/2023_04_16_2237_16 -n 50 -w -h -I+ -aa 0.1 -ab 5 -ad 2048 -lw 0.002 octrees/Scene_Overcast10klux.oct < ptsFiles/ptsFiles.pts > results/daylightFactor.ill
echo results/daylightFactor.ill
date > timing/end.md""")  # -> Stdout, Stderr_, Ran
overrides_8 = ApplyOverrides(Input="cat <ill> | rcalc -e '$1=179*($1*.265+$2*.670+$3*.065)'", Ill=graft(executessh_7.Stdout))  # -> Output, DynamicOutput
executessh_8 = ExecuteSSH(
    _SSHCommands_=overrides_8.DynamicOutput,
    Run=executessh_7.Ran,
    addPrefix=True,
    description="cat results/daylightFactor.ill | rcalc -e '$1=179*($1*.265+$2*.670+$3*.065)'",
    fireLogs=False,
    lastRunTime=31,
    suppressWarnings=False,
    results="""41.9133333
81.3919623
107.298596
116.502776
117.98103
105.280121
95.515116
87.6447545
83.2280727
67.6839812
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""",
    commands="cat results/daylightFactor.ill | rcalc -e '$1=179*($1*.265+$2*.670+$3*.065)'")  # -> Stdout, Stderr_, Ran
gradient = Gradient(
    LowerLimit=0,
    UpperLimit=1,
    Parameter=1,
    stops=[0: RGB(0, 0, 255), 0.1: RGB(53, 0, 202), 0.2: RGB(107, 0, 148), 0.3: RGB(160, 0, 95), 0.4: RGB(214, 0, 41), 0.5: RGB(255, 12, 0), 0.6: RGB(255, 66, 0), 0.7: RGB(255, 119, 0), 0.8: RGB(255, 173, 0), 0.9: RGB(255, 226, 0), 1: RGB(255, 255, 0)])
gradient_2 = Gradient(
    LowerLimit=0,
    UpperLimit=1,
    Parameter=1,
    stops=[0: RGB(237, 237, 206), 0.542: RGB(212, 209, 182), 0.61: RGB(207, 206, 188), 0.632: RGB(179, 187, 199), 1: RGB(132, 146, 173)])
split = TextSplit(Text=executessh_8.Stdout)
num = Number(expr("x/100", split))
unflatten = UnflattenTree(Tree=num, Guide=pt)
gridsettings = GridSettings(From="0", To="5", ASteps="11", BStepSize=-1)
expression = Expression(x=unflatten, Expression="Format(\"{0:0.0}\", x)")
gridviewer = GridViewer(
    Grids=flatten(grid_3),
    Results=unflatten,
    _Gradient=reverse(gradient_2),
    _MinColor=RGB(169, 169, 169),
    _MaxColor=RGB(211, 211, 211),
    _SectionType=gridsettings)  # -> ColoredMesh, LayeredMesh, Curves, Planes, TempMeshes, flatten(Colors), flatten(Values)
tag = TextTag(Location=grid.Points, Text=expression, Colour=ColourSwatch(SwatchColor=RGB(43, 43, 43)))
mesh = Mesh(gridviewer.LayeredMesh)
col = Colour(gridviewer.Colors)
data = Data(gridviewer.Values)
preview = CustomPreview(Geometry=gridviewer.Curves, Material=ColourSwatch(SwatchColor=RGB(117, 117, 117)))

image_2 = ClipboardImage(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)

# ----
# Setup dashboards
mesh_2 = Mesh(mesh)
col_2 = Colour(col)
data_2 = Data(data)
path_mapper = PathMapper(mesh_2, source="{A;B}", target="{A;B+1}")
split_2 = SplitTree(Data=path_mapper, Masks=flatten("{*;0}"))  # -> Positive, Negative
mesh_3 = Mesh(split_2.Negative)
mcol = MeshColours(Mesh=mesh_3, Colours=ColourSwatch(SwatchColor=RGB(255, 255, 255)))
area = Area(Geometry=flatten(mesh_3))  # -> Area, Centroid
area_2 = Area(Geometry=split_2.Positive)  # -> Area, Centroid
docunits = ConvertToDocumentUnits(ValueString="0.1m")
docunits_2 = ConvertToDocumentUnits(ValueString="0.5m")
python_3 = GhPythonScript(x=area_2.Area, y=area.Area)  # -> out, a; inputs y: list
# ---------- python_3: Python ----------
__author__ = "mm1013"
__version__ = "2023.04.16"

import rhinoscriptsyntax as rs

n = 0
a = []

for i in range(len(y) - 1):
    a.append(y[i] - y[i+1] )
a.append(y[-1])
# ---------- end python_3 ----------
python_4 = GhPythonScript(x=data_2)  # -> a; inputs x: list
# ---------- python_4: Python ----------
__author__ = "mm1013"
__version__ = "2023.04.16"

import rhinoscriptsyntax as rs

a = []

for i in range(len(x) - 1):
    a.append("%s to %s" % (x[i], x[i+1]))
# ---------- end python_4 ----------
Z = UnitZ(Factor=docunits)
Z_2 = UnitZ(Factor=docunits_2)
move = Move(Geometry=mcol, Motion=Z)  # -> Geometry, Transform
expression_2 = Expression(x=python_3.a, y=area_2.Area, Expression="x / y * 100.0")
move_2 = Move(Geometry=mcol, Motion=Z_2)  # -> Geometry, Transform
expression_3 = Expression(x=python_4, y=expression_2, Expression="Format(\"{0}: {1:0.0}%\", x, y)")  # -> graft(R)
expression_4 = Expression(x=data_2, Expression="format(\">= {0}\", x)")  # -> graft(R)
expression_5 = Expression(x=area.Area, y=area_2.Area, Expression="x / y * 100.0")  # -> graft(R)
linkdashboard_item = LINKDashboardItem(
    Name=graft(expression_4),
    _Description=expression_3,
    Value=expression_5,
    _MinValue=0,
    _MaxValue=100,
    _Color=graft(col_2),
    _ShowSub=True,
    _units="%",
    _decimals=1,
    _showValues=invert(False),
    _MeshTransparency=-1,
    _ShowChildGeometries=0,
    _AssociatedGeo=graft(move_2.Geometry))  # -> flatten(DashboardItem)
linkdashboard_item_2 = LINKDashboardItem(
    Name=graft(python_4),
    Value=graft(expression_2),
    _MinValue=0,
    _MaxValue=100,
    _Color=graft(col_2),
    _ShowSub=True,
    _units="%",
    _decimals=1,
    _showValues=invert(False),
    _MeshTransparency=-1,
    _ShowChildGeometries=0,
    _AssociatedGeo=graft(move.Geometry))  # -> flatten(DashboardItem)
linkdashboard_item_3 = LINKDashboardItem(
    Name="Daylight Factor",
    Value="100",
    _MinValue=0,
    _MaxValue=100,
    _Color=RGBA(0, 0, 0, 0),
    _SubItems=reverse(linkdashboard_item),
    _ShowSub=True,
    _decimals=1,
    _showValues=False,
    _MeshTransparency=-1,
    _ShowChildGeometries=0)
linkdashboard_splitteditem = LINKDashboardSplittedItem(_InheritItem=linkdashboard_item_3, _SubItems=linkdashboard_item_2)
linkdashboard_show = LINKDashboardShow(Items=flatten(linkdashboard_splitteditem), _Enable=True, OverrideAnchor=False, OverrideAnchorX=0, OverrideAnchorY=0)
