# Grasshopper definition TestPaths.gh (Grasshopper 1.0.7)
# Copyright: 2021
# plug-ins: MantaRay

panel = Panel(". /etc/profile;gensky")

# ----
# Connect
panel_2 = Panel("mm1013")
connect_ssh = ConnectSSH(User=panel_2, Ip="10.71.5.181", Password="_prompt", _port=22, Connect=Toggle(True))  # -> Status, Run, Run_2
panel_3 = Panel(connect_ssh.Status)

logviewer = LogViewer(Number=10)  # -> CurrentTasks, Logs
executessh_wip = ExecuteSSHWIP(
    SSHCommands="sleep 50;echo hi",
    Run=Toggle(False),
    addPrefix=False,
    commands="sleep 50;echo hi",
    description="sleep 50;echo hi",
    fireLogs=True,
    lastRunTime=27126,
    name="WAITING FOR HI",
    stderr="Terminated",
    suppressWarnings=False)  # -> Stdout, Stderr_, Ran
panel_4 = Panel(executessh_wip.Stdout)
panel_5 = Panel(logviewer.CurrentTasks)
panel_6 = Panel(logviewer.Logs)
