# Grasshopper definition Test_3Ph.gh (Grasshopper 1.0.7)
# Copyright: 2021
# Copyright: 2022-06-43
# Copyright: 2022-11-38
# Copyright: 2016 HLA
# plug-ins: MantaRay, LadybugGrasshopper, Human, HDTTreeUtils

# ----
# Overview of all running tasks in linux
panel = Panel("ps aux | grep '<AllRadProgs>'")
logviewer = LogViewer(Number=10)  # -> CurrentTasks, Logs
default = DefaultMSS(data=flatten(panel), default_value_flattened=flatten(logviewer.CurrentTasks))
executessh_wip = ExecuteSSHWIP(
    _SSHCommands_=default,
    Run=Toggle(True),
    addPrefix=True,
    commands="ps aux | grep '<AllRadProgs>'",
    description="ps aux | grep '<AllRadProgs>'",
    fireLogs=False,
    lastRunTime=21.8125,
    results="""mss      18864  0.0  0.0   8620  3176 ?        Ss   15:22   0:00 bash -c export PATH=$PATH:/usr/local/radiance/bin;export RAYPATH=.:/usr/local/radiance/lib;export DISPLAY=$(ip route list default | awk '{print $3}'):0;export LIBGL_ALWAYS_INDIRECT=1;ps aux | grep '<AllRadProgs>'
mss      18869  0.0  0.0   8168   648 ?        S    15:22   0:00 grep <AllRadProgs>""",
    suppressWarnings=False)  # -> Stdout, Stderr_, Ran
python = GhPythonScript(x=executessh_wip.Stdout)  # -> a
# ---------- python: Python ----------
__author__ = "mm1013"
__version__ = "2022.08.30"

import rhinoscriptsyntax as rs

a = [l for l in x.split("\n") if "grep" not in l]
# ---------- end python ----------
panel_2 = Panel(python)
panel_3 = Panel(logviewer.CurrentTasks)

panel_4 = Panel("""Mesh
Polysurface
Surface
Extrusion""")

# ----
# Connect
toggle = BooleanToggle(True)
connect = ConnectSSHFTP(User="mss", Ip="localhost", Password="_prompt", _port=22, Connect=toggle)  # -> Status, Prefixes, Run
panel_5 = Panel(connect.Prefixes)
panel_6 = Panel(connect.Status)

od_outdated = ColourSwatch(SwatchColor=RGBA(97, 97, 97, 150))
u_updated = ColourSwatch(SwatchColor=RGBA(208, 115, 230, 112))
toggle_2 = BooleanToggle(True)
g_general = ColourSwatch(SwatchColor=RGBA(245, 243, 237, 156))
o_outputs = ColourSwatch(SwatchColor=RGBA(160, 218, 242, 203))
s_settings = ColourSwatch(SwatchColor=RGBA(224, 145, 81, 154))
cc_core2 = ColourSwatch(SwatchColor=RGBA(230, 216, 186, 208))
y_yellow = ColourSwatch(SwatchColor=RGBA(247, 244, 64, 188))
i_inputs = ColourSwatch(SwatchColor=RGBA(125, 217, 98, 150))
c_core = ColourSwatch(SwatchColor=RGBA(235, 227, 206, 203))
r_red = ColourSwatch(SwatchColor=RGBA(242, 63, 63, 203))

# ----
# Setup globals
panel_7 = Panel("""proj
projname
projfolder""")
panel_8 = Panel("""~/simulation/boston
boston
/simulation/boston""")
global_overrides = GlobalOverrides(Keys=panel_7, Values=panel_8)
panel_9 = Panel(global_overrides)

colorgroups = CSharpScript(
    Colors=[i_inputs, s_settings, g_general, c_core, o_outputs, r_red, y_yellow, u_updated, od_outdated, cc_core2],
    Enable=toggle_2,
    Rename=Toggle(False),
    RunOnce=Button(),
    Debug=Toggle(False))  # -> out; inputs Colors: list of Color, Enable: Boolean, Rename: Boolean, RunOnce: Boolean, Debug: Boolean
# ---------- colorgroups: C# usings ----------
using System.Linq;
using System.Text;
using System.Reflection;
# ---------- colorgroups: C# ----------
    msg.Clear();


    this.Component.Message = "id: " + id.ToString();

    _debug = Debug; //Set to true to have all events printed in rhino log
    _rename = Rename;

    if (Enable)
    {
      msg.AppendFormat("Set up events on ID {0}\n", id);
      SetupDict(); // Create a dictionary of the input swatches
      SetEventHandlers(); // This would do the job.


    }
    else
    {
      RemoveEventHandlers();
    }
    if (RunOnce)
    {
      foreach(Grasshopper.Kernel.Special.GH_Group grp in Grasshopper.Instances.ActiveCanvas.Document.Objects.OfType<Grasshopper.Kernel.Special.GH_Group>())
      {
        ColorGroup(grp, null); // You decide if it should run once on all existing groups

      }
    }

    Print(msg.ToString());


    // Component setup
    Component.Description = "Set up event handlers to color groups based on prefixes such as 'in_' and 'out_'.\n"
      + "Please insert only swatcheds directly into the Colors input\n\n"
      + "MIT License. Copyright Mathias Sønderskov Schaltz 2022";
    Component.Params.Input[0].Description = "Please insert only swatcheds directly into the Colors input.\nRemember to rename them";
    Component.Params.Input[1].Description = "Toggle to run...";
    Component.Params.Input[2].Description = "Set to true if you want to automatically rename the groups and remove prefix. Default is false.";
    Component.Params.Input[3].Description = "Set to true to run it once and color all existing groups.";
    Component.Params.Input[Component.Params.Input.Count - 1].Description = "Set debug to true to get all the events printed in the rhino log";
# ---------- colorgroups: C# additional code ----------
  public static Random rnd = new Random();
  public int id = rnd.Next(0, 1000);
  StringBuilder msg = new StringBuilder();
  Dictionary<string, System.Drawing.Color> colorDict = new Dictionary<string, System.Drawing.Color>();

  bool _debug = false;
  bool _rename = false;

  public bool IdExists(int id)
  {
    IList<IGH_DocumentObject> objs = Grasshopper.Instances.ActiveCanvas.Document.Objects;
    return objs
      .OfType<IGH_Component>()
      .Where(ob => ob.NickName == this.Component.NickName)
      .Where(ob => ob.GetType().ToString() == "ScriptComponents.Component_CSNET_Script")
      .Where(ob => ob.Message == "id: " + id.ToString()).Any();

  }


  public void SetupDict()
  {
    colorDict.Clear();
    // Get all inputs to "Colors"
    IList<IGH_Param> colorSources = this.Component.Params.Input[0].Sources;
    if (colorSources.Count == 0)
    {
      throw new Exception("You forgot to setup the colors. Please input swatch components and rename them");
    }
    foreach(IGH_Param source in colorSources)
    {
      //if (source.Type.ToString() == "Grasshopper.Kernel.Types.GH_Colour")
      if (source is Grasshopper.Kernel.Special.GH_ColourSwatch)
      {
        string nickName = source.NickName.Split('_')[0].Trim() + "_";
        if(!colorDict.ContainsKey(nickName))
        {
          Grasshopper.Kernel.Special.GH_ColourSwatch swatch = (Grasshopper.Kernel.Special.GH_ColourSwatch) source;
          colorDict.Add(nickName, swatch.SwatchColour);
        }
        else
        {
          throw new Exception("Multiple swatches using the same name detected. Please rename");
        }
      }
      else
      {
        throw new Exception("Whacko! Why did you input a non-swatch into the Colors? " + source.Type.ToString());
      }

    }

    msg.AppendFormat("Set up the dictionaries with {0} colors\n", colorDict.Count);
    foreach(var pairs in colorDict)
    {
      msg.AppendFormat("{0} -> {1}\n", ("\"" + pairs.Key + "\"").PadRight(5 + colorDict.Keys.Select(k => k.Length).Max()), pairs.Value);
    }
  }

  public void SetEventHandlers()
  {

    // Always remove events first to avoid duplicates
    GrasshopperDocument.ObjectsAdded -= OnObjectsAdded;
    GrasshopperDocument.ObjectsDeleted -= OnObjectsRemoved;
    GrasshopperDocument.ObjectsDeleted -= OnDeleteThisComponent;

    // Attach events
    GrasshopperDocument.ObjectsAdded += OnObjectsAdded;
    GrasshopperDocument.ObjectsDeleted += OnObjectsRemoved;
    GrasshopperDocument.ObjectsDeleted += OnDeleteThisComponent;


    foreach(Grasshopper.Kernel.Special.GH_Group grp in GrasshopperDocument.Objects.OfType<Grasshopper.Kernel.Special.GH_Group>())
    {
      grp.ObjectChanged -= ColorGroup;
      grp.ObjectChanged += ColorGroup;

      //ColorGroup(grp, null); // Make sure to run it once
    }
    msg.AppendFormat("Added the eventhandlers on {0} existing groups and on future created groups\n", GrasshopperDocument.Objects.OfType<Grasshopper.Kernel.Special.GH_Group>().Count());
  }

  public void OnObjectsAdded(object sender, GH_DocObjectEventArgs e)
  {
    bool any = false;
    foreach (Grasshopper.Kernel.Special.GH_Group grp in e.Objects.OfType<Grasshopper.Kernel.Special.GH_Group>())
    {
      grp.ObjectChanged -= ColorGroup;
      grp.ObjectChanged += ColorGroup;
      any = true;
    }

    DebugWrite(any ? "Group Objects Added: Attaching Events to ObjectChanged" : "Objects Added - but no groups");
  }

  //Same but reversed
  public void OnObjectsRemoved(object sender, GH_DocObjectEventArgs e)
  {
    bool any = false;
    foreach (Grasshopper.Kernel.Special.GH_Group grp in e.Objects.OfType<Grasshopper.Kernel.Special.GH_Group>())
    {
      grp.ObjectChanged -= ColorGroup;
      any = true;
    }

    DebugWrite(any ? "Group Objects Removed, removing event" : "Objects Removed - although not a group");

  }



  public void RemoveEventHandlers()
  {
    GrasshopperDocument.ObjectsAdded -= OnObjectsAdded;
    GrasshopperDocument.ObjectsDeleted -= OnObjectsRemoved;


    foreach(Grasshopper.Kernel.Special.GH_Group grp in GrasshopperDocument.Objects.OfType<Grasshopper.Kernel.Special.GH_Group>())
    {
      grp.ObjectChanged -= ColorGroup;

    }
    msg.AppendFormat("Removed event handlers on document and on {0} groups\n", GrasshopperDocument.Objects.OfType<Grasshopper.Kernel.Special.GH_Group>().Count());

  }

  public void ColorGroup(object sender, EventArgs e)
  {
    if (!IdExists(id))
    {
      DebugWrite("Component not relevant. Disabling old id + " + id.ToString());
      RemoveEventHandlers();
      return;
    }

    Grasshopper.Kernel.Special.GH_Group grp = sender as Grasshopper.Kernel.Special.GH_Group;
    if (grp == null) return; //not type GH_Group
    //if (!grp.NickName.EndsWith("_")) return;

    string[] nameParts = grp.NickName.Split('_');
    if (nameParts.Length <= 1)
      return;
    string prefix = grp.NickName.Split('_')[0].Trim() + '_';

    string prefixes = String.Join(", ", colorDict.Keys.Select(k => "\"" + k + "\""));

    msg.Append("prefix " + prefix + "\n");
    if (colorDict.ContainsKey(prefix))
    {
      //if (grp.NickName.EndsWith("_"))
      grp.Colour = colorDict[prefix];
      if (_rename)
      {
        grp.NickName = grp.NickName.Replace(prefix, "");
      }

      DebugWrite("Colored " + grp.NickName);

    }
    else
    {
      DebugWrite("Group changed but not relevant: prefix " + prefix + " is not among " + prefixes);
    }

  }
  public void DebugWrite(string msg)
  {
    if (_debug)
    {
      Rhino.RhinoApp.WriteLine(String.Format("[ColGrps {0}]: {1}", id, msg));
    }
  }

  public void OnDeleteThisComponent(object sender, GH_DocObjectEventArgs e)
  {

    if (e.Objects.OfType<Grasshopper.Kernel.GH_Component>().Where(o => o.NickName == this.Component.NickName).Any())
    {
      DebugWrite("Removed template component. Removing all the eventhandlers");
      RemoveEventHandlers();
    }

  }
# ---------- end colorgroups ----------

fixparams = CSharpScript(FixOnce=Button(), Enable=toggle_2, Debug=Toggle(False))  # -> out; inputs FixOnce: Boolean, Enable: Boolean, Debug: Boolean
# ---------- fixparams: C# usings ----------
using System.Text;
using System.Linq;
using Grasshopper.Kernel.Special;
# ---------- fixparams: C# ----------
    _debug = Debug;
    _enable = Enable;
    msg.Clear();
    this.Component.Message = "id: " + id.ToString();




    if (Enable)
    {
      SetEventHandlers();
    }
    else
    {
      RemoveEventHandlers();
    }


    if (FixOnce)
    {
      FixAll();
    }

    Print(msg.ToString());

    // Component setup
    Component.Description = "Set up event handlers to change params to show nickname and not icon"
      + "\n\n"
      + "MIT License. Copyright Mathias Sønderskov Schaltz 2022";
    Component.Params.Input[0].Description = "Run me once on the document";
    Component.Params.Input[1].Description = "Toggle to enable event listener";
    Component.Params.Input[Component.Params.Input.Count - 1].Description = "Set debug to true to get all the events printed in the rhino log";
# ---------- fixparams: C# additional code ----------
  public static Random rnd = new Random();
  public int id = rnd.Next(0, 1000);
  StringBuilder msg = new StringBuilder();
  bool _debug = false;
  bool _enable = false;

  public Dictionary<IGH_ActiveObject, HashSet<GH_Group>> groupsPerObject = new Dictionary<IGH_ActiveObject, HashSet<GH_Group>>();


  public void OnObjectsAdded(object sender, GH_DocObjectEventArgs e)
  {
    if (!IdExists(id))
    {
      DebugWrite("[FixParam] Component not relevant. Disabling old id " + id.ToString());
      RemoveEventHandlers();
      return;
    }


    if(_enable)
    {
      foreach(IGH_Param par in e.Objects.OfType<IGH_Param>())
      {
        FixInputs(par);
      }
    }


  }

  public void FixAll()
  {
    //DebugWrite("Fixing all?");
    foreach(IGH_Param par in GrasshopperDocument.Objects.OfType<IGH_Param>())
    {

      FixInputs(par);
    }
  }




  public void FixInputs(IGH_ActiveObject obj)
  {



    IGH_Param par = obj as IGH_Param;
    if (par != null)
    {

      par.IconDisplayMode = GH_IconDisplayMode.name;


    }

  }


  public void SetEventHandlers()
  {

    GrasshopperDocument.ObjectsAdded -= OnObjectsAdded;
    GrasshopperDocument.ObjectsAdded += OnObjectsAdded;
    GrasshopperDocument.ObjectsDeleted -= OnDeleteThisComponent;
    GrasshopperDocument.ObjectsDeleted += OnDeleteThisComponent;
    msg.AppendFormat("Added the eventhandlers to OnObjectsAdded\n", GrasshopperDocument.Objects.OfType<Grasshopper.Kernel.Special.GH_Group>().Count());
  }

  public void RemoveEventHandlers()
  {
    GrasshopperDocument.ObjectsAdded -= OnObjectsAdded;
    GrasshopperDocument.ObjectsDeleted -= OnDeleteThisComponent;

    msg.AppendFormat("Removed wire event handlers on document\n", GrasshopperDocument.Objects.OfType<Grasshopper.Kernel.Special.GH_Group>().Count());

  }

  public void OnDeleteThisComponent(object sender, GH_DocObjectEventArgs e)
  {

    if (e.Objects.OfType<Grasshopper.Kernel.GH_Component>().Where(o => o.NickName == this.Component.NickName).Any())
    {
      DebugWrite("Removed template component. Removing all the eventhandlers");
      RemoveEventHandlers();
    }

  }

  public bool IdExists(int id)
  {
    IList<IGH_DocumentObject> objs = Grasshopper.Instances.ActiveCanvas.Document.Objects;
    return objs
      .OfType<IGH_Component>()
      .Where(ob => ob.NickName == this.Component.NickName)
      .Where(ob => ob.GetType().ToString() == "ScriptComponents.Component_CSNET_Script")
      .Where(ob => ob.Message == "id: " + id.ToString()).Any();

  }

  public void DebugWrite(string msg)
  {
    if (_debug)
    {
      Rhino.RhinoApp.WriteLine(String.Format("[FixParams {0}]: {1}", id, msg));
    }
  }
# ---------- end fixparams ----------

fixwires = CSharpScript(FixOnce=Button(), Enable=toggle_2, Debug=Toggle(False))  # -> out; inputs FixOnce: Boolean, Enable: Boolean, Debug: Boolean
# ---------- fixwires: C# ----------
    _debug = Debug;
    _enable = Enable;
    msg.Clear();
    this.Component.Message = "id: " + id.ToString();


    SetDictionary();

    if (Enable)
    {
      SetEventHandlers();
    }
    else
    {
      RemoveEventHandlers();
    }


    if (FixOnce)
    {
      FixAll();
    }

    Print(msg.ToString());
    
    // Component setup
    Component.Description = "Set up event handlers to change all wire types across groups to faint"
      + "\n\n"
      + "MIT License. Copyright Mathias Sønderskov Schaltz 2022";
    Component.Params.Input[0].Description = "Run me once on the document";
    Component.Params.Input[1].Description = "Toggle to enable event listener";
    Component.Params.Input[Component.Params.Input.Count - 1].Description = "Set debug to true to get all the events printed in the rhino log";
# ---------- fixwires: C# additional code ----------
  public static Random rnd = new Random();
  public int id = rnd.Next(0, 1000);
  StringBuilder msg = new StringBuilder();
  bool _debug = false;
  bool _enable = false;

  public Dictionary<IGH_ActiveObject, HashSet<GH_Group>> groupsPerObject = new Dictionary<IGH_ActiveObject, HashSet<GH_Group>>();


  public void OnSolutionExpired(object sender, GH_DocUndoEventArgs e)
  {
    if(_enable)
      FixAll();
  }

  public void FixAll()
  {
    //DebugWrite("Fixing all?");
    foreach(IGH_ActiveObject key in groupsPerObject.Keys.Where(k => groupsPerObject[k].Count() > 0))
    {

      FixInputs(key);
    }
  }



  public bool HasGroup(IGH_ActiveObject obj)
  {
    return groupsPerObject[obj].Count > 0;
  }


  public void FixInputs(IGH_ActiveObject obj)
  {

    if (!IdExists(id))
    {
      DebugWrite("Component not relevant. Disabling old id " + id.ToString());
      RemoveEventHandlers();
      return;
    }

    //List<List<IGH_ActiveObject>> parents = new List<List<IGH_ActiveObject>>();
    IGH_Param par = obj as IGH_Param;
    if (par != null && par.Sources != null)
    {


      IEnumerable<IGH_ActiveObject> p = par.Sources.Select(s => s.Attributes.GetTopLevel.DocObject as IGH_ActiveObject);
      //parents.Add(p);
      if(HasGroup(obj) && p.All(o => !HasGroupsInCommon(o, obj)) && par.WireDisplay != GH_ParamWireDisplay.faint)
      {
        DebugWrite("Fixing " + par.Attributes.GetTopLevel.DocObject.NickName);
        par.WireDisplay = GH_ParamWireDisplay.faint;
      }

    }

    IGH_Component comp = obj as IGH_Component;
    if (comp != null)
    {
      foreach(IGH_Param inp in comp.Params.Input)
      {

        IEnumerable<IGH_ActiveObject> p = inp.Sources.Select(i => i.Attributes.GetTopLevel.DocObject as IGH_ActiveObject);

        if(HasGroup(obj) && p.All(o => !HasGroupsInCommon(o, obj)) && inp.WireDisplay != GH_ParamWireDisplay.faint)
        {
          DebugWrite("Fixing " + inp.Attributes.GetTopLevel.DocObject.NickName);
          inp.WireDisplay = GH_ParamWireDisplay.faint;
        }
      }

    }



  }





  public void SetDictionary()
  {
    IList<IGH_DocumentObject> objects = Grasshopper.Instances.ActiveCanvas.Document.Objects.ToList();
    //Print(String.Join(", ", objects.Select(o => o.NickName)));

    groupsPerObject = objects
      .Where(o => o.GetType() != typeof(GH_Group))
      .OfType<IGH_ActiveObject>()
      .ToDictionary(o => o, o => new HashSet<GH_Group>());

    foreach(GH_Group grp in objects.OfType<GH_Group>())
    {

      foreach(IGH_ActiveObject obj in grp.ObjectsRecursive().OfType<IGH_ActiveObject>())
      {
        groupsPerObject[obj].Add(grp);

      }
    }



  }

  public bool HasGroupsInCommon(IGH_ActiveObject obj1, IGH_ActiveObject obj2)
  {
    HashSet<GH_Group> set1 = groupsPerObject[obj1];
    HashSet<GH_Group> set2 = groupsPerObject[obj2];

    set1.IntersectWith(set2);

    return set1.Any();
  }

  public void SetEventHandlers()
  {

    GrasshopperDocument.UndoStateChanged -= OnSolutionExpired;
    GrasshopperDocument.UndoStateChanged += OnSolutionExpired;
    GrasshopperDocument.ObjectsDeleted -= OnDeleteThisComponent;
    GrasshopperDocument.ObjectsDeleted += OnDeleteThisComponent;
    msg.AppendFormat("Added the eventhandlers to UndoStateChanged\n", GrasshopperDocument.Objects.OfType<Grasshopper.Kernel.Special.GH_Group>().Count());
  }

  public void RemoveEventHandlers()
  {
    GrasshopperDocument.UndoStateChanged -= OnSolutionExpired;
    GrasshopperDocument.ObjectsDeleted -= OnDeleteThisComponent;

    msg.AppendFormat("Removed wire event handlers on document\n", GrasshopperDocument.Objects.OfType<Grasshopper.Kernel.Special.GH_Group>().Count());

  }

  public void OnDeleteThisComponent(object sender, GH_DocObjectEventArgs e)
  {

    if (e.Objects.OfType<Grasshopper.Kernel.GH_Component>().Where(o => o.NickName == this.Component.NickName).Any())
    {
      DebugWrite("Removed template component. Removing all the eventhandlers");
      RemoveEventHandlers();
    }

  }

  public bool IdExists(int id)
  {
    IList<IGH_DocumentObject> objs = Grasshopper.Instances.ActiveCanvas.Document.Objects;
    return objs
      .OfType<IGH_Component>()
      .Where(ob => ob.NickName == this.Component.NickName)
      .Where(ob => ob.GetType().ToString() == "ScriptComponents.Component_CSNET_Script")
      .Where(ob => ob.Message == "id: " + id.ToString()).Any();

  }

  public void DebugWrite(string msg)
  {
    if (_debug)
    {
      Rhino.RhinoApp.WriteLine(String.Format("[FixWire {0}]: {1}", id, msg));
    }
  }
# ---------- end fixwires ----------

dpipeline = DynamicGeometryPipeline(
    LayerFilter="Daylight_Inputs::*",
    TypeFilter="Curve",
    NameFilter="*",
    GroupByLayer=False,
    GroupByType=False,
    IncludeHidden=True,
    IncludeLocked=True,
    enableFullPath=True,
    listenToAttributes=True)

# ----
# importing from rhino layers
dpipeline_2 = DynamicGeometryPipeline(
    LayerFilter="Daylight_Inputs::*",
    TypeFilter=panel_4,
    NameFilter="*",
    GroupByLayer=False,
    GroupByType=False,
    IncludeHidden=True,
    IncludeLocked=True,
    enableFullPath=True,
    listenToAttributes=True)
dam = DataDam(DataA=dpipeline_2, DataB=dpipeline, BufferDelay=10000000, BufferMode=0)  # -> DataA, DataB
objatts = ObjectAttributes(ObjectOrAttributes=dam.DataA)  # -> Name, LayerName, LayerFullPath, Color, MaterialName, LinetypeName, GroupIndices, PlotWeight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
objatts_2 = ObjectAttributes(ObjectOrAttributes=dam.DataB)  # -> Name, LayerName, LayerFullPath, Color, MaterialName, LinetypeName, GroupIndices, PlotWeight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
cset = CreateSet(List=objatts.LayerName)  # -> Set, Map
cset_2 = CreateSet(List=objatts_2.LayerName)  # -> Set, Map
assign_paths = AssignPaths(InputData=flatten(dam.DataA), PathsToAssign=flatten(cset.Map))
assign_paths_2 = AssignPaths(InputData=flatten(dam.DataB), PathsToAssign=flatten(cset_2.Map))
python_2 = GhPythonScript(layer_name=graft(cset.Set))  # -> is_opaque, is_transparent, is_grid, is_HB_Room, is_HB_Window
# ---------- python_2: Python ----------
__author__ = "mm1013"
__version__ = "2022.01.16"

import rhinoscriptsyntax as rs

is_grid = layer_name == "Grids" or layer_name == "_Curves"

if layer_name.startswith("HB_"):
    is_opaque = is_transparent = is_grid = False
    
    is_HB_Window = layer_name.endswith("%")
    is_HB_Room = layer_name == "HB_Rooms"
    
    
else:
    if is_grid:
        is_opaque = False
        is_transparent = False
    else:
        is_transparent = layer_name.endswith("%")
        if is_transparent:
            transmittance = layer_name.split("_")[-1].replace("%","")
        is_opaque = not is_transparent
# ---------- end python_2 ----------
python_3 = GhPythonScript(layer_name=graft(cset_2.Set))  # -> is_opaque, is_transparent, is_grid, is_HB_Room, is_HB_Window; same code as python_2
layer_name = Text(cset_2.Set)
layer_name_2 = Text(cset.Set)
geo = Geometry(assign_paths_2)
geo_2 = Geometry(assign_paths)

# ----
# Template methods
# By Mathias Sønderskov Schaltz 2022
# Check for updates here https://github.com/Sonderwoods/GrasshopperScribbles
panel_10 = Panel(fixwires)
panel_11 = Panel(fixparams)
panel_12 = Panel(colorgroups)

logviewer_2 = LogViewer(Number=10)  # -> CurrentTasks, Logs

# ----
# Grid
cull = CullPattern(List=graft(layer_name), CullPattern=graft(python_3.is_grid))  # -> simplify(List)
cull_2 = CullPattern(List=graft(layer_name_2), CullPattern=graft(python_2.is_grid))  # -> simplify(List)
cull_3 = CullPattern(List=geo, CullPattern=python_3.is_grid)  # -> simplify(List)
cull_4 = CullPattern(List=geo_2, CullPattern=python_2.is_grid)
clean = CleanTree(RemoveNulls=True, RemoveInvalid=True, RemoveEmpty=True, Tree=cull_2, SynchronousTree1=simplify(cull_4))  # -> Tree, flatten(SynchronousTree1)
clean_2 = CleanTree(RemoveNulls=True, RemoveInvalid=True, RemoveEmpty=True, Tree=cull, SynchronousTree1=simplify(cull_3))  # -> Tree, SynchronousTree1
boundary = BoundarySurfaces(Edges=clean_2.SynchronousTree1)  # -> flatten(Surfaces)
geo_3 = Geometry(graft([clean.SynchronousTree1, boundary]))

# ----
# Glass geometries
cull_5 = CullPattern(List=geo_2, CullPattern=python_2.is_transparent)
cull_6 = CullPattern(List=graft(layer_name_2), CullPattern=graft(python_2.is_transparent))  # -> simplify(List)
python_4 = GhPythonScript(layer_name=cull_6)  # -> out, transmittance, name
# ---------- python_4: Python ----------
__author__ = "mm1013"
__version__ = "2022.01.16"

import rhinoscriptsyntax as rs

try:
    transmittance = layer_name.split("_")[-1].replace("%","")
    name = layer_name.replace("%","")
except:
    transmittance = None
    name = None
# ---------- end python_4 ----------
clean_3 = CleanTree(
    RemoveNulls=True,
    RemoveInvalid=True,
    RemoveEmpty=True,
    Tree=simplify(cull_5),
    SynchronousTree1=simplify(python_4.name),
    SynchronousTree2=simplify(python_4.transmittance))  # -> Tree, SynchronousTree1, SynchronousTree2
meshit2 = MeshIt2(mesh_brep=graft(clean_3.Tree))
name = Text(clean_3.SynchronousTree1)
unflatten = UnflattenTree(Tree=meshit2, Guide=clean_3.Tree)
geo_4 = Geometry(unflatten)
panel_13 = Panel(name)
meshit2_2 = MeshIt2(mesh_brep=geo_4)
transmittance = Number(expr("x/100", clean_3.SynchronousTree2))
concat = Concatenate(FragmentA=panel_13, FragmentB="_mat")
mesh = Mesh(meshit2_2)

# ----
# opaque geometries
cull_7 = CullPattern(List=graft(layer_name_2), CullPattern=graft(python_2.is_opaque))  # -> simplify(List)
cull_8 = CullPattern(List=geo_2, CullPattern=graft(python_2.is_opaque))  # -> simplify(List)
python_5 = GhPythonScript(layer_name=cull_7)  # -> out, reflectance
# ---------- python_5: Python ----------
__author__ = "mm1013"
__version__ = "2022.01.16"

import rhinoscriptsyntax as rs
try:
    reflectance = layer_name.split("_")[-1]
    
except:
    reflectance = None
# ---------- end python_5 ----------
clean_4 = CleanTree(
    RemoveNulls=True,
    RemoveInvalid=True,
    RemoveEmpty=True,
    Tree=cull_7,
    SynchronousTree1=cull_8,
    SynchronousTree2=python_5.reflectance)  # -> Tree, SynchronousTree1, SynchronousTree2
geo_5 = Geometry(clean_4.SynchronousTree1)
refl = Number(clean_4.SynchronousTree2)
name_2 = Text(clean_4.Tree)
meshit2_3 = MeshIt2(mesh_brep=geo_5)
concat_2 = Concatenate(FragmentA=name_2, FragmentB="_mat")

# ----
# Log of latest(10) SSH Commands
panel_14 = Panel(logviewer_2.Logs)
# Vertex order (and normal)
# 
# source : https://www.radiance-online.org/learning/tutorials/Tutorial-ThreePhaseMethod.pdf
# FILE NAMES: *.vmx - view matrix (data)
# *.hdr - view matrix (renderings)
# *.dmx - daylight matrix
# *.skv - sky vector
# *.smx – sky matrix
# *.xml - transmission matrix (the file is xml format)
# 
# *.rad - radiance scene data
# *.oct - octree file
# *.vf - view file
# *.dat - data
# 
# source : https://www.radiance-online.org/learning/tutorials/Tutorial-ThreePhaseMethod.pdf
image = ImageSampler(
    FilePath="C:\Users\mm1013\Desktop\window normals.png",
    Filter="Colour",
    Interpolate=True,
    Umax=1,
    Umin=0,
    Vmax=1,
    Vmin=0,
    Wrap=1)  # disabled
largest_brep = LargestBREP(window_breps=[<geometry referenced from the Rhino model> x224])

vertical_offset = Panel("0.75m")
grid_size = Panel("0.5m")
docunits = ConvertToDocumentUnits(ValueString=vertical_offset)
docunits_2 = ConvertToDocumentUnits(ValueString=grid_size)

# ----
# Grid
# Setting up grid points
geo_6 = Geometry(graft(geo_3))
rectangle = Rectangle(Plane=PlaneXY(0, 0, 0), XSize=Domain(-1, 1), YSize=Domain(-2, 2), Radius=0)  # -> Rectangle, Length
flip = Flip(Surface=geo_6, Guide=rectangle.Rectangle)  # -> Surface, Result
# Check if ximage and other x-commands work.
# Must have Xlaunch running on windows with disabled access control
# Otherwise it will crash!
# from https://discourse.radiance-online.org/t/new-tool-for-generating-colored-sky/5891
grid_size_2 = Number(docunits_2)
offset = Number(docunits)
custom_mesh_settings = SettingsCustom(
    StitchSeams=True,
    SimplePlanes=False,
    Refine=True,
    MinCount=16,
    MaxCount=400,
    AspectRatio=20,
    MaxDistance=0,
    MaxAngle=20,
    MinEdge=grid_size_2,
    MaxEdge=grid_size_2)
normals = Normals(geo=flip.Surface, amplitude=offset)  # -> center_2, norm_2, P
mesh_2 = MeshBrep(Brep=flip.Surface, Settings=custom_mesh_settings)
move = Move(Geometry=mesh_2, Motion=normals.norm_2)  # -> Geometry, Transform
facen = FaceNormals(Mesh=move.Geometry)  # -> Centers, Normals

prepare_3_phase_geo_and_wea = LBFalseStartToggle(False)

overrides = ApplyOverrides(Input="<projfolder>/radFiles")  # -> Output, Pairs
overrides_2 = ApplyOverrides(Input="<projfolder>")  # -> Output, Pairs

path = FilePath("C:\Users\mm1013\Documents\Rhino setup\DNK_DRY_OFFICIAL_2001-2010_epw-fil.epw")

prepare_everything_for_2ph_dds = LBFalseStartToggle(False)
panel_15 = Panel(path)
prep_octrees = LBFalseStartToggle(False)
prep_2ph = Boolean(prepare_everything_for_2ph_dds)
prep_3ph = Boolean(prepare_3_phase_geo_and_wea)

# ----
# Create working folder
panel_16 = Panel("mkdir -p <proj>;echo <proj>")
overrides_3 = ApplyOverrides(Input_=panel_16)  # -> Output, Pairs
executessh = ExecuteSSH(
    _SSHCommands_=overrides_3.Output,
    Run=prep_octrees,
    addPrefix=True,
    description="mkdir -p ~/simulation/boston;echo ~/simulation/boston",
    fireLogs=True,
    lastRunTime=11,
    name="Create workingdir",
    results="/home/mss/simulation/boston",
    suppressWarnings=False)  # -> Stdout, Stderr_, Ran

# ----
# grid points
pt = Point(facen.Centers)
vec = Vector(facen.Normals)
overrides_4 = ApplyOverrides(Input="<projfolder>")  # -> Output, Pairs
points2pts = PointsToPts(Points=flatten(pt), Vectors=flatten(vec), Name="points", SubfolderOverride=overrides_4.Output, Run=executessh.Ran)  # -> PtsFile, Run
ptsfile = Text(points2pts.PtsFile)

# ----
# Opaque geometry
panel_17 = Panel("mapping_opaque")
modnames = Text(concat_2)
names = Text(name_2)
mesh_3 = Mesh(meshit2_3)
mesh2obj = MeshToObj(
    Mesh=mesh_3,
    Name=graft(names),
    MapFileName=panel_17,
    ModifierName=graft(modnames),
    SubfolderOverride=overrides_2.Output,
    Run=executessh.Ran)  # -> ObjFiles, MapFile, Run
obj2rad = ObjToRad(
    ObjFiles=mesh2obj.ObjFiles,
    MapFile=mesh2obj.MapFile,
    SubfolderOverride=overrides.Output,
    Run=mesh2obj.Run,
    stdouts="~/simulation/boston/radFiles/_FacadeDark_30.rad>JOIN<~/simulation/boston/radFiles/_SkylightWall_70.rad>JOIN<~/simulation/boston/radFiles/_SlabCeiling_80.rad>JOIN<~/simulation/boston/radFiles/_SlabFloor_30.rad>JOIN<~/simulation/boston/radFiles/_SlabWall_50.rad>JOIN<~/simulation/boston/radFiles/_SlabJ_50.rad>JOIN<~/simulation/boston/radFiles/_WallExterior_50.rad>JOIN<~/simulation/boston/radFiles/_Roofs_50.rad>JOIN<~/simulation/boston/radFiles/_Doors_50.rad>JOIN<~/simulation/boston/radFiles/_WallInterior_70.rad>JOIN<~/simulation/boston/radFiles/_FramesCW_50.rad>JOIN<~/simulation/boston/radFiles/_Frames_50.rad>JOIN<~/simulation/boston/radFiles/_FacadeBright_70.rad>JOIN<~/simulation/boston/radFiles/_ContextBright_70.rad")  # -> Status, RadFiles, Run
opaque_rad = Text(obj2rad.RadFiles)
panel_18 = Panel(opaque_rad)

# ----
# rad files
# Window geometry
panel_19 = Panel("mapping_windows")
mesh2obj_2 = MeshToObj(
    Mesh=mesh,
    Name=graft(panel_13),
    MapFileName=panel_19,
    ModifierName=graft(concat),
    SubfolderOverride=overrides_2.Output,
    Run=executessh.Ran)  # -> ObjFiles, MapFile, Run
obj2rad_2 = ObjToRad(
    ObjFiles=mesh2obj_2.ObjFiles,
    MapFile=mesh2obj_2.MapFile,
    SubfolderOverride=overrides.Output,
    Run=mesh2obj_2.Run,
    stdouts="~/simulation/boston/radFiles/_GlassTak_70.rad>JOIN<~/simulation/boston/radFiles/_GlassInt_74.rad>JOIN<~/simulation/boston/radFiles/_GlassFacade_74.rad>JOIN<~/simulation/boston/radFiles/_GlassBSDF_70.rad")  # -> Status, RadFiles, Run
window_rad = Text(obj2rad_2.RadFiles)

prep_3ph_2 = Boolean(prep_3ph)
and = GateAnd(A=executessh.Ran, B=prep_3ph_2)

# ----
# opaque materials
panel_20 = Panel("echo \"<mats>\" > <proj>/radFiles/<target>;echo \"<proj>/radFiles/<target>\"")
opaquegreymat = OpaqueGreyMat(Name=concat_2, Reflectance_0_1=refl, Specularity=0, Roughness=0)  # -> flatten(RadMaterials), RadMaterialList
join = TextJoin(Text=opaquegreymat.RadMaterials)
overrides_5 = ApplyOverrides(Input_=panel_20, Mats=graft(join), Target=graft("opaque_materials.mat"))  # -> Output, Pairs
executessh_wip_2 = ExecuteSSHWIP(
    _SSHCommands_=overrides_5.Output,
    Run=obj2rad.Run,
    addPrefix=True,
    description="""echo "void plastic _ContextBright_70_mat
0
0
5 0.700 0.700 0.700 0.000 0.000
void plastic _FacadeBright_70_mat
0
0
5 0.700 0.700 0.700 0.000 0.000
void plastic _Frames_50_mat
0
0
5 0.500 0.500 0.500 0.000 0.000
void plastic _FramesCW_50_mat
0
0
5 0.500 0.500 0.500 0.000 0.000
void plastic _WallInterior_70_mat
0
0
5 0.700 0.700 0.700 0.000 0.000
void plastic _Doors_50_mat
0
0
5 0.500 0.500 0.500 0.000 0.000
void plastic _Roofs_50_mat
0
0
5 0.500 0.500 0.500 0.000 0.000
void plastic _WallExterior_50_mat
0
0
5 0.500 0.500 0.500 0.000 0.000
void plastic _SlabJ_50_mat
0
0
5 0.500 0.500 0.500 0.000 0.000
void plastic _SlabWall_50_mat
0
0
5 0.500 0.500 0.500 0.000 0.000
void plastic _SlabFloor_30_mat
0
0
5 0.300 0.300 0.300 0.000 0.000
void plastic _SlabCeiling_80_mat
0
0
5 0.800 0.800 0.800 0.000 0.000
void plastic _SkylightWall_70_mat
0
0
5 0.700 0.700 0.700 0.000 0.000
void plastic _FacadeDark_30_mat
0
0
5 0.300 0.300 0.300 0.000 0.000" > ~/simulation/boston/radFiles/opaque_materials.mat;echo "~/simulation/boston/radFiles/opaque_materials.mat"
""",
    fireLogs=True,
    lastRunTime=21,
    name="opaqueMats",
    results="~/simulation/boston/radFiles/opaque_materials.mat",
    suppressWarnings=False)  # -> Stdout, Stderr_, Ran
opaque_mat = Text(executessh_wip_2.Stdout)

# ----
# Setup glass materials
python_6 = GhPythonScript(matname=concat)  # -> filename
# ---------- python_6: Python ----------
__author__ = "mm1013"
__version__ = "2022.07.06"

import rhinoscriptsyntax as rs

filename = matname.replace(" ","_").replace(".","_")
# ---------- end python_6 ----------
glassmat = GlassMat(Name=concat, Transmittance_0_1=transmittance)  # -> RadMaterials, RadMaterialList
# materials
panel_21 = Panel("echo \"<mats>\" > <proj>/radFiles/<target>;echo \"<proj>/radFiles/<target>\"")
overrides_6 = ApplyOverrides(Input_="<mat>.mat", Mat=graft(python_6))  # -> Output, Pairs
overrides_7 = ApplyOverrides(Input_=panel_21, Mats=graft(glassmat.RadMaterials), Target=graft(overrides_6.Output))  # -> Output, Pairs
executessh_wip_3 = ExecuteSSHWIP(
    _SSHCommands_=overrides_7.Output,
    Run=obj2rad.Run,
    addPrefix=True,
    description="""echo "void glass _GlassBSDF_70_mat
0
0
3 0.763 0.763 0.763" > ~/simulation/boston/radFiles/_GlassBSDF_70_mat.mat;echo "~/simulation/boston/radFiles/_GlassBSDF_70_mat.mat"
echo "void glass _GlassFacade_74_mat
0
0
3 0.806 0.806 0.806" > ~/simulation/boston/radFiles/_GlassFacade_74_mat.mat;echo "~/simulation/boston/radFiles/_GlassFacade_74_mat.mat"
echo "void glass _GlassInt_74_mat
0
0
3 0.806 0.806 0.806" > ~/simulation/boston/radFiles/_GlassInt_74_mat.mat;echo "~/simulation/boston/radFiles/_GlassInt_74_mat.mat"
echo "void glass _GlassTak_70_mat
0
0
3 0.763 0.763 0.763" > ~/simulation/boston/radFiles/_GlassTak_70_mat.mat;echo "~/simulation/boston/radFiles/_GlassTak_70_mat.mat"
""",
    fireLogs=True,
    lastRunTime=23,
    name="glassMats",
    results="""~/simulation/boston/radFiles/_GlassBSDF_70_mat.mat
~/simulation/boston/radFiles/_GlassFacade_74_mat.mat
~/simulation/boston/radFiles/_GlassInt_74_mat.mat
~/simulation/boston/radFiles/_GlassTak_70_mat.mat""",
    suppressWarnings=False)  # -> Stdout, Stderr_, Ran
split = TextSplit(Text=executessh_wip_3.Stdout)
unflatten_2 = UnflattenTree(Tree=split, Guide=overrides_7.Output)

# ----
# octrees for opaques (3ph)
and_2 = GateAnd(A=obj2rad.Run, B=executessh_wip_2.Ran)
opaque_mat_2 = Text(opaque_mat)
panel_22 = Panel("""mkdir -p <proj>/octrees
oconv -w -f <rads> > <proj>/octrees/<target>.oct;echo <proj>/octrees/<target>.oct""")
opaque_rad_2 = Text(opaque_rad)
entwine = Entwine(Branch00=opaque_mat_2, Branch01=opaque_rad_2, FlattenInputs=True)  # -> flatten(Result)
join_2 = TextJoin(Text=flatten(entwine), Join=" ")
overrides_8 = ApplyOverrides(Input_=panel_22, Rads=graft(join_2), Target=graft("opaque_scene"))  # -> Output, Pairs
executessh_wip_4 = ExecuteSSHWIP(
    _SSHCommands_=overrides_8.Output,
    Run=and_2,
    addPrefix=True,
    description="""mkdir -p ~/simulation/boston/octrees
oconv -w -f ~/simulation/boston/radFiles/opaque_materials.mat ~/simulation/boston/radFiles/_FacadeDark_30.rad ~/simulation/boston/radFiles/_SkylightWall_70.rad ~/simulation/boston/radFiles/_SlabCeiling_80.rad ~/simulation/boston/radFiles/_SlabFloor_30.rad ~/simulation/boston/radFiles/_SlabWall_50.rad ~/simulation/boston/radFiles/_SlabJ_50.rad ~/simulation/boston/radFiles/_WallExterior_50.rad ~/simulation/boston/radFiles/_Roofs_50.rad ~/simulation/boston/radFiles/_Doors_50.rad ~/simulation/boston/radFiles/_WallInterior_70.rad ~/simulation/boston/radFiles/_FramesCW_50.rad ~/simulation/boston/radFiles/_Frames_50.rad ~/simulation/boston/radFiles/_FacadeBright_70.rad ~/simulation/boston/radFiles/_ContextBright_70.rad > ~/simulation/boston/octrees/opaque_scene.oct;echo ~/simulation/boston/octrees/opaque_scene.oct""",
    fireLogs=False,
    lastRunTime=28890,
    results="/home/mss/simulation/boston/octrees/opaque_scene.oct",
    suppressWarnings=False)  # -> Stdout, Stderr_, Ran
panel_23 = Panel(overrides_8.Output)
panel_24 = Panel(executessh_wip_4.Stdout)
octree = Text(executessh_wip_4.Stdout)

# ----
# preview rad files
window_mat = Text(unflatten_2)
opaque_mat_3 = Text(opaque_mat)
opaque_rad_3 = Text(opaque_rad)
window_rad_2 = Text(window_rad)
entwine_2 = Entwine(Branch00=window_mat, Branch01=window_rad_2, Branch02=opaque_mat_3, Branch03=opaque_rad_3, FlattenInputs=True)  # -> flatten(Result)
convertpaths = ConvertPaths(I=entwine_2)  # -> Linux, Windows
radviewer = RadViewer(
    RadFiles=flatten(convertpaths.Windows),
    IsTwoSided=True,
    Polychromatic=False,
    ShowEdges=True,
    Transparent=False,
    ColorNames=["_GlassTak_70_mat", "_GlassInt_74_mat", "_GlassFacade_74_mat", "_GlassBSDF_70_mat", "_FacadeDark_30_mat", "_SkylightWall_70_mat", "_SlabCeiling_80_mat", "_SlabFloor_30_mat", "_SlabWall_50_mat", "_SlabJ_50_mat", "_WallExterior_50_mat", "_Roofs_50_mat", "_Doors_50_mat", "_WallInterior_70_mat", "_FramesCW_50_mat", "_Frames_50_mat", "_FacadeBright_70_mat", "_ContextBright_70_mat"],
    Colors=[RGB(182, 140, 156), RGB(134, 238, 186), RGB(235, 107, 171), RGB(133, 157, 166), RGB(253, 162, 251), RGB(226, 117, 132), RGB(224, 168, 197), RGB(200, 158, 181), RGB(120, 142, 251), RGB(239, 135, 119), RGB(153, 247, 158), RGB(139, 140, 235), RGB(248, 190, 157), RGB(120, 161, 252), RGB(221, 185, 198), RGB(144, 107, 245), RGB(185, 200, 170), RGB(130, 216, 254)])  # -> Geo, ModifierNames, Modifiers, FailedWireFrame; disabled

# ----
# preview pts files
# opt1 - cat directly from linux
panel_25 = Panel("cat <pts>")
points = Text(ptsfile)
overrides_9 = ApplyOverrides(Input_=panel_25, Pts=graft(points))  # -> Output, Pairs
execute_ssh_async = ExecuteSSHAsync(
    _SSHCommands_=overrides_9.Output,
    Run=Toggle(True),
    addPrefix=True,
    addSuffix=True,
    description="cat /home/mss/simulation/boston/points.pts",
    fireLogs=False,
    stdouts="""40.233 181.449 111.520 0.000 0.000 1.000
40.764 181.229 111.520 0.000 0.000 1.000
41.296 181.009 111.520 0.000 0.000 1.000
41.827 180.789 111.520 0.000 0.000 1.000
42.358 180.569 111.520 0.000 0.000 1.000
42.889 180.349 111.520 0.000 0.000 1.000
40.026 180.950 111.520 0.000 0.000 1.000
40.558 180.730 111.520 0.000 0.000 1.000
41.089 180.510 111.520 0.000 0.000 1.000
41.620 180.290 111.520 0.000 0.000 1.000
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""",
    suppressWarnings=False)  # -> Stdout, Stderr_, port, port_2, Ran
ptsview = PtsViewer(PtsString=execute_ssh_async.Stdout)  # disabled

# ----
# opt2 - read local windows pts file
points_2 = Text(ptsfile)
convertpaths_2 = ConvertPaths(I=points_2)  # -> Linux, Windows
ptsview_2 = PtsViewer(PtsString=convertpaths_2.Windows)

panel_26 = Panel(convertpaths.Windows)

# ----
# VIEW (image based)
button = Button()
view_names = Panel("P1")
view = CreateView(Viewport=view_names, Update=button)  # -> ViewfileContent, ImageRatio
panel_27 = Panel("""mkdir -p <proj>/views/
echo "<vf>" > <proj>/views/<target>.vf
echo <proj>/views/<target>.vf""")
vf = Text(view.ViewfileContent)
overrides_10 = ApplyOverrides(Input=panel_27, Vf=graft(vf), Target=graft(view_names))  # -> Output, Pairs
file_exists = Panel("[ -f <out> ] && echo \"1\" || echo \"0\"")
execute_ssh_async_2 = ExecuteSSHAsync(
    _SSHCommands_=overrides_10.Output,
    Run=button,
    addPrefix=True,
    addSuffix=True,
    description="""mkdir -p ~/simulation/test_project2/views/
echo "rvu -vtv -vp -22628.9361776861 -19649.1284922488 4599.01771764096 -vd 0.135656474653245 -0.99040997675779 -0.0261801226751789 -vu 0.00355272087214904 -0.025937945132412 0.999657241846781 -vh 88.272 -vv 50.000" > ~/simulation/test_project2/views/P1.vf
echo ~/simulation/test_project2/views/P1.vf""",
    fireLogs=False,
    stdouts="/home/mss/simulation/test_project2/views/P1.vf",
    suppressWarnings=False)  # -> Stdout, Stderr_, Log, port, Ran
item = ListItem(List=flatten(execute_ssh_async_2.Stdout), Index=0, Wrap=True)
panel_28 = Panel(execute_ssh_async_2.Stdout)
overrides_11 = ApplyOverrides(Input=file_exists, Out=graft(item))  # -> Output, Pairs
execute_ssh_async_3 = ExecuteSSHAsync(
    _SSHCommands_=overrides_11.Output,
    addPrefix=True,
    addSuffix=True,
    description="[ -f /home/mss/simulation/test_project2/views/P1.vf ] && echo \"1\" || echo \"0\"",
    fireLogs=False,
    stdouts="1",
    suppressWarnings=False)  # -> Stdout, Stderr_, Log, port, Ran
viewfiles = Text(execute_ssh_async_2.Stdout)

# ----
# genblinds
panel_29 = Panel("genblinds blindmat blind 0.08 1 2 28 20 +r 0.12 | xform -rz -90 -rx -90 -t 0 0 -0.15 > <proj>/radFiles/<target>.rad;echo <proj>/radFiles/<target>.rad")
falsestart = LBFalseStartToggle(False)
overrides_12 = ApplyOverrides(Input_=panel_29, Target=graft("blinds_001"))  # -> Output, Pairs
bool = Boolean(falsestart)
executessh_2 = ExecuteSSH(
    _SSHCommands_=overrides_12.Output,
    Run=bool,
    addPrefix=True,
    description="genblinds blindmat blind 0.08 1 2 28 20 +r 0.12 | xform -rz -90 -rx -90 -t 0 0 -0.15 > ~/simulation/boston/radFiles/blinds_001.rad;echo ~/simulation/boston/radFiles/blinds_001.rad",
    fireLogs=False,
    lastRunTime=6,
    results="/home/mss/simulation/boston/radFiles/blinds_001.rad",
    suppressWarnings=False)  # -> Stdout, Stderr_, Ran

# ----
# Check the modifiers you want to make BSDF materials with.
# If LT values are the same you can just choose to use one of them
window_rad_3 = Text(window_rad)
list = ItemSelector(
    window_rad_3,
    {"~/simulation/boston/radFiles/_GlassTak_70.rad", "~/simulation/boston/radFiles/_GlassInt_74.rad", "~/simulation/boston/radFiles/_GlassFacade_74.rad", "~/simulation/boston/radFiles/_GlassBSDF_70.rad"}, selected="~/simulation/boston/radFiles/_GlassBSDF_70.rad")

# ----
# 3 phase simulation
# Check the glass you want for multiphase
# (window groups)
window_rad_4 = Text(window_rad)
list_2 = ItemSelector(
    window_rad_4,
    {"~/simulation/boston/radFiles/_GlassTak_70.rad", "~/simulation/boston/radFiles/_GlassInt_74.rad", "~/simulation/boston/radFiles/_GlassFacade_74.rad", "~/simulation/boston/radFiles/_GlassBSDF_70.rad"}, selected="~/simulation/boston/radFiles/_GlassBSDF_70.rad")
window_rads = Text(list_2)

ptsfile_2 = Text(ptsfile)
octree_no_glass = Text(octree)

convertpaths_3 = ConvertPaths(I=executessh_2.Stdout)  # -> Linux, Windows
panel_30 = Panel(executessh_2.Stdout)
radviewer_2 = RadViewer(
    RadFiles=flatten(convertpaths_3.Windows),
    IsTwoSided=False,
    Polychromatic=True,
    ShowEdges=True,
    Transparent=True,
    ColorNames="blindmat",
    Colors=RGB(201, 214, 143))  # -> Geo, ModifierNames, Modifiers, FailedWireFrame

# ----
# setting dimensions
panel_31 = Panel("""getbbox <rad>
getbbox -h <rad>""")
overrides_13 = ApplyOverrides(Input_=panel_31, Rad=graft(executessh_2.Stdout))  # -> Output, Pairs
executessh_3 = ExecuteSSH(
    _SSHCommands_=overrides_13.Output,
    Run=executessh_2.Ran,
    addPrefix=True,
    description="""getbbox /home/mss/simulation/boston/radFiles/blinds_001.rad
getbbox -h /home/mss/simulation/boston/radFiles/blinds_001.rad""",
    fireLogs=False,
    lastRunTime=12,
    results="""     xmin      xmax      ymin      ymax      zmin      zmax
        0         1 0.0357143   1.99165     -0.15 -0.0748246
_JOIN_
        0         1 0.0357143   1.99165     -0.15 -0.0748246""",
    suppressWarnings=False)  # -> Stdout, Stderr_, Ran

# ----
# Make sure zmax is below 0!
# Also pay attention to X/Y dims.
# Here ymax = 2 and xmax = 1
panel_32 = Panel(executessh_3.Stdout)

cluster = Cluster_2(l=executessh_3.Stdout)  # -> xstart_2, xend_2, ystart_2, yend_2, zmin
overrides_14 = ApplyOverrides(
    Input_="-dim <xstart> <xend> <ystart> <yend> <zmin> 0",
    Xstart=graft(cluster.xstart_2),
    Xend=graft(cluster.xend_2),
    Ystart=graft(cluster.ystart_2),
    Yend=graft(cluster.yend_2),
    Zmin=graft(cluster.zmin))  # -> Output, Pairs

and_3 = GateAnd()

# ----
# Skydome
panel_33 = Panel("""mkdir -p <proj>/radFiles;
echo "<skyrad>" > <proj>/radFiles/skyglow_3ph.rad
echo "<proj>/radFiles/skyglow_3ph.rad"
""")
panel_34 = Panel("""#@rfluxmtx h=r1 u=+Y
void glow sky_glow
0
0
4 1 1 1 0
sky_glow source sky
0
0
4 0 0 1 180
#@rfluxmtx h=u u=+Y
void glow ground_glow
0
0
4 1 1 1 0
ground_glow source ground
0
0
4 0 0 -1 180""")
overrides_15 = ApplyOverrides(Input_=panel_33, Skyrad=graft(panel_34))  # -> Output, Pairs
falsestart_2 = LBFalseStartToggle(False)
executessh_4 = ExecuteSSH(
    _SSHCommands_=overrides_15.Output,
    Run=falsestart_2,
    addPrefix=True,
    description="""mkdir -p ~/simulation/boston/radFiles;
echo "#@rfluxmtx h=r1 u=+Y
void glow sky_glow
0
0
4 1 1 1 0
sky_glow source sky
0
0
4 0 0 1 180
#@rfluxmtx h=u u=+Y
void glow ground_glow
0
0
4 1 1 1 0
ground_glow source ground
0
0
4 0 0 -1 180" > ~/simulation/boston/radFiles/skyglow_3ph.rad
echo "~/simulation/boston/radFiles/skyglow_3ph.rad"
""",
    fireLogs=False,
    lastRunTime=5,
    results="~/simulation/boston/radFiles/skyglow_3ph.rad",
    suppressWarnings=False)  # -> Stdout, Stderr_, Ran
panel_35 = Panel(executessh_4.Stdout)
skyglow = Text(executessh_4.Stdout)

# ----
# Skyvector, point in time (m:1)
panel_36 = Panel("DNK_DRY_OFFICIAL_2001-2010_epw-fil.epw")
python_7 = GhPythonScript(filename=panel_36)  # -> local_path
# ---------- python_7: Python ----------
__author__ = "mm1013"
__version__ = "2022.08.16"

import rhinoscriptsyntax as rs
if filename is not None:
    local_path = "\\".join(ghdoc.Path.split("\\")[:-1]) + "\\" + filename
else:
    local_path = "\\".join(ghdoc.Path.split("\\")[:-1]) + "\\"
# ---------- end python_7 ----------
importepw = LBImportEPW(epw_file=python_7)  # -> location, dry_bulb_temperature, dew_point_temperature, relative_humidity, wind_speed, wind_direction, direct_normal_rad, diffuse_horizontal_rad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; plug-in component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
panel_37 = Panel("""mkdir -p <proj>/skyvectors
gensky <m> <d> <h>:00<ts> +s -a <lat> -o -<lon> | genskyvec -m 1 > <proj>/skyvectors/<prefix>_CIEs_<m2><d2><h2>.vec
echo "<proj>/skyvectors/<prefix>_CIEs_<m2><d2><h2>.vec"
""")
decnstrloc = LBDeconstructLocation(location=importepw.location)  # -> name, latitude, longitude, time_zone, elevation; plug-in component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
panel_38 = Panel(decnstrloc.latitude)
panel_39 = Panel(decnstrloc.longitude)
m = GhPythonScript(i="6")  # -> i1, i2; inputs i: Int32
# ---------- m: Python ----------
__author__ = "mm1013"
__version__ = "2022.08.21"

import rhinoscriptsyntax as rs

i1 = i
i2 = "%02d" % i
# ---------- end m ----------
d = GhPythonScript(i="21")  # -> i1, i2; inputs i: Int32; same code as m
h = GhPythonScript(i="15")  # -> i1, i2; inputs i: Int32; same code as m
overrides_16 = ApplyOverrides(
    Input_=panel_37,
    Lat=graft(panel_38),
    Lon=graft(panel_39),
    Prefix=graft("DNK"),
    M=graft(m.i1),
    M2=graft(m.i2),
    D=graft(d.i1),
    D2=graft(d.i2),
    H=graft(h.i1),
    H2=graft(h.i2),
    Ts=graft("CEST"))  # -> Output, Pairs
falsestart_3 = LBFalseStartToggle(False)
executessh_5 = ExecuteSSH(
    _SSHCommands_=overrides_16.Output,
    Run=falsestart_3,
    addPrefix=True,
    description="""mkdir -p ~/simulation/test_project2/skyvectors
gensky 6 21 15:00CEST +s -a 55.8764 -o -12.4121 | genskyvec -m 1 > ~/simulation/test_project2/skyvectors/DNK_CIEs_062115.vec
echo "~/simulation/test_project2/skyvectors/DNK_CIEs_062115.vec"
""",
    fireLogs=True,
    lastRunTime=5,
    name="Create skyvector",
    results="~/simulation/test_project2/skyvectors/DNK_CIEs_062115.vec",
    suppressWarnings=False)  # -> Stdout, Stderr_, Ran
panel_40 = Panel(executessh_5.Stdout)
python_8 = GhPythonScript(x=executessh_5.Stdout)  # -> flatten(a)
# ---------- python_8: Python ----------
__author__ = "mm1013"
__version__ = "2022.08.21"

import rhinoscriptsyntax as rs

a = x.split("/")[-1].split(".")[0]
# ---------- end python_8 ----------

overrides_17 = ApplyOverrides(Input_="<projfolder>")  # -> Output, Pairs
upload = Upload(
    LocalFilePaths="C:\Users\mm1013\Downloads\8mm MS-F 6014 Rot 90.xml",
    SubfolderOverride=overrides_17.Output,
    Run=Toggle(True),
    stdouts="~/simulation/boston/8mm MS-F 6014 Rot 90.xml")  # -> Status, FilePaths, Ran
panel_41 = Panel("""micro
venetian""")
panel_42 = Panel(upload.FilePaths)

panel_43 = Panel("""0
0
0
0
0
0
0
0
1
1
1
1
1
1
1
1
1
1
0
0
0
0
0
0""")
int = Integer(panel_43)
dup = DuplicateData(Data=int, Number="365", Order=True)

# ----
# WEA file
# create WEA file
panel_44 = Panel("<LinuxHome>/weatherData")
overrides_18 = ApplyOverrides(Input_=panel_44)  # -> Output, Pairs

python_9 = GhPythonScript(x=overrides_18.Output)  # -> a
# ---------- python_9: Python ----------
__author__ = "mm1013"
__version__ = "2022.07.02"

import rhinoscriptsyntax as rs

a = x[1:]
# ---------- end python_9 ----------

upload_2 = Upload(
    LocalFilePaths=path,
    SubfolderOverride=python_9,
    Run=and,
    stdouts="~/simulation/weatherData/DNK_DRY_OFFICIAL_2001-2010_epw-fil.epw")  # -> Status, FilePaths, Run
overrides_19 = ApplyOverrides(Input_="epw2wea <epw> <epw-.>.wea 1>&2;echo <epw-.>.wea", Epw=graft(upload_2.FilePaths))  # -> Output, Pairs
executessh_wip_5 = ExecuteSSHWIP(
    _SSHCommands=overrides_19.Output,
    Run=upload_2.Run,
    addPrefix=True,
    description="epw2wea ~/simulation/weatherData/DNK_DRY_OFFICIAL_2001-2010_epw-fil.epw ~/simulation/weatherData/DNK_DRY_OFFICIAL_2001-2010_epw-fil.wea 1>&2;echo ~/simulation/weatherData/DNK_DRY_OFFICIAL_2001-2010_epw-fil.wea",
    fireLogs=True,
    lastRunTime=6,
    name="weaFile",
    results="/home/mss/simulation/weatherData/DNK_DRY_OFFICIAL_2001-2010_epw-fil.wea",
    stderr="""place SJAELSMARK_DNK
latitude 55.8764
longitude -12.41
time_zone -15.00
site_elevation 40
weather_data_file_units 1""",
    suppressWarnings=True)  # -> Stdout, Stderr, Ran
panel_45 = Panel(executessh_wip_5.Stdout)
wea_file = Text(executessh_wip_5.Stdout)

panel_46 = Panel(executessh_wip_5.Stderr)

# ----
# Get diffuseHorizontal from EPW
# 5 phase bash script from andy mcneil
panel_47 = Panel("rcalc -t, -e '$1=$16' <epw>")
overrides_20 = ApplyOverrides(Input_=panel_47, Epw=graft(upload_2.FilePaths))  # -> Output, Pairs
executessh_wip_6 = ExecuteSSHWIP(
    _SSHCommands_=overrides_20.Output,
    Run=upload_2.Run,
    addPrefix=True,
    description="rcalc -t, -e '$1=$16' ~/simulation/weatherData/DNK_DRY_OFFICIAL_2001-2010_epw-fil.epw",
    fireLogs=False,
    lastRunTime=14,
    results="""0
0
0
12
0
0
0
0
0
0
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""",
    suppressWarnings=False)  # -> Stdout, Stderr_, Ran
python_10 = GhPythonScript(inp=executessh_wip_6.Stdout)  # -> illum
# ---------- python_10: Python ----------
__author__ = "mm1013"
__version__ = "2022.07.04"

import rhinoscriptsyntax as rs

illum = [float(i) for i in inp.split("\n")][8:] #skipping headers
# ---------- end python_10 ----------

file_exists_2 = Panel("[ -f <out> ] && echo \"1\" || echo \"0\"")
panel_48 = Panel("out")  # disabled
applyglobals = ApplyGlobals(Input=file_exists_2, AdditionalKeys=panel_48, AdditionalValues=executessh_wip_5.Stdout)  # -> Output, Pairs; disabled
execute_ssh_async_4 = ExecuteSSHAsync(
    SSHCommands=applyglobals.Output,
    Run=upload_2.Run,
    addPrefix=True,
    addSuffix=True,
    fireLogs=False,
    stdouts="1",
    suppressWarnings=False)  # -> Stdout, Stderr, Log, port, Ran; disabled

# ----
# broken
panel_49 = Panel("50")
python_11 = GhPythonScript(inp=python_10, threshold=panel_49)  # -> on_off_sorted, port, illum, hoys_sorted, illum_sorted, hoys; inputs inp: list; disabled
# ---------- python_11: Python ----------
__author__ = "mm1013"
__version__ = "2022.07.04"

import rhinoscriptsyntax as rs
illum = inp
hoys = range(len(illum))
hoys_sorted = [hoy for _, hoy in sorted(zip(illum, hoys))]
illum_sorted = [il for il, _ in sorted(zip(illum, hoys))]

thres = int(len(illum) * float(threshold) / 100.0)

off = [0] * thres
on = [1] * (len(illum) - thres)
off.extend(on)

on_off_sorted = [o for _, o in sorted(zip(hoys_sorted, off))]



hoys_ = sorted(hoys_sorted[thres:])
# ---------- end python_11 ----------

# ----
# EN17037 Schedule
cluster_2 = Cluster(horizontaldiffrad=python_10)

_3dchart = Ladybug_3DChart(inputData=flatten(cluster_2), xScale="0.25", zScale="0")  # -> readMe, graphMesh, graphCurves, legend, legendBasePts, title, titleBasePts, dataPts, conditionalHOY; disabled; plug-in component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
ladybug = Ladybug_Ladybug()  # -> Vviiiiiiiiiizzz; disabled; plug-in component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

# ----
# Skies and Skymatrices (3ph + 2ph DDS)
# Annual sky-matrix 145 patches
panel_50 = Panel("gendaymtx -m 1 \"<wea>\" > <wea-.>_m1.smx;echo \"<wea-.>_m1.smx\"")
wea_file_2 = Text(wea_file)
overrides_21 = ApplyOverrides(Input=panel_50, Wea=graft(wea_file_2))  # -> Output, Pairs
executessh_wip_7 = ExecuteSSHWIP(
    _SSHCommands_=overrides_21.Output,
    Run=executessh_wip_5.Ran,
    addPrefix=True,
    description="gendaymtx -m 1 \"/home/mss/simulation/weatherData/DNK_DRY_OFFICIAL_2001-2010_epw-fil.wea\" > /home/mss/simulation/weatherData/DNK_DRY_OFFICIAL_2001-2010_epw-fil_m1.smx;echo \"/home/mss/simulation/weatherData/DNK_DRY_OFFICIAL_2001-2010_epw-fil_m1.smx\"",
    fireLogs=False,
    lastRunTime=1425,
    results="/home/mss/simulation/weatherData/DNK_DRY_OFFICIAL_2001-2010_epw-fil_m1.smx",
    suppressWarnings=False)  # -> Stdout, Stderr_, Ran
panel_51 = Panel(executessh_wip_7.Stdout)
skymtx = Text(executessh_wip_7.Stdout)

skymtx_2 = Text(executessh_wip_7.Stdout)

# ----
# Construct BSDF file
window_mat_2 = Text(unflatten_2)
window_rads_2 = Text(window_rads)
convertpaths_4 = ConvertPaths(I=flatten([list, window_mat_2]))  # -> Linux, Windows
python_12 = GhPythonScript(x=window_rads_2)  # -> a
# ---------- python_12: Python ----------
__author__ = "mm1013"
__version__ = "2022.08.20"

import rhinoscriptsyntax as rs
a = ".".join(x.split("/")[-1].split(".")[:-1])
# ---------- end python_12 ----------
radviewer_3 = RadViewer(
    RadFiles=flatten(convertpaths_4.Windows),
    IsTwoSided=False,
    Polychromatic=True,
    ShowEdges=True,
    Transparent=True,
    ColorNames=["blindmat", "GlassSouth_70_mat", "GlassWest_70_mat", "_GlassBSDF_70_mat"],
    Colors=[RGB(201, 214, 143), RGB(117, 124, 152), RGB(211, 158, 127), RGB(170, 207, 137)])  # -> Geo, ModifierNames, Modifiers, FailedWireFrame
glassname = Text(python_12)
panel_52 = Panel(radviewer_3.Modifiers)

# ----
# make sure your normals of th
# receiver rad is pointing inwards!
# ie it should be red on the outside when
# two sided is enabled.
convertpaths_5 = ConvertPaths(I=window_rads_2)  # -> Linux, Windows
radviewer_4 = RadViewer(
    RadFiles=flatten(convertpaths_5.Windows),
    IsTwoSided=True,
    Polychromatic=True,
    ShowEdges=True,
    Transparent=True,
    ColorNames=["_GlassBSDF_70_mat", "_GlassFacade_74_mat"],
    Colors=[RGB(227, 191, 239), RGB(172, 242, 105)])  # -> Geo, ModifierNames, Modifiers, FailedWireFrame

name_3 = Text(radviewer_3.ModifierNames)

name_4 = Text(name_3)
panel_53 = Panel(name_4)
vertical_glazing_rfluxmtx = Panel("#@rfluxmtx h=kf u=Z")
overrides_22 = ApplyOverrides(Input_="void glow <windowMod> 0 0 4 1 1 1 0", WindowMod=graft(name_4))  # -> Output, Pairs
concat_3 = Concatenate(FragmentA=overrides_22.Output, FragmentB=vertical_glazing_rfluxmtx)

# ----
# adding rflux comments to windowRads
panel_54 = Panel("""echo "<rfluxmtx>" > <windowRad-.>_rflux.rad
cat <windowRad> >> <windowRad-.>_rflux.rad
echo <windowRad-.>_rflux.rad""")
window_rads_3 = Text(window_rads_2)
overrides_23 = ApplyOverrides(Input_=panel_54, Rfluxmtx=graft(concat_3), WindowRad=graft(window_rads_3))  # -> flatten(Output), Pairs
falsestart_4 = LBFalseStartToggle(False)
executessh_6 = ExecuteSSH(
    _SSHCommands_=overrides_23.Output,
    Run=falsestart_4,
    addPrefix=True,
    description="""echo "void glow _GlassBSDF_70_mat 0 0 4 1 1 1 0
#@rfluxmtx h=kf u=Z" > ~/simulation/boston/radFiles/_GlassBSDF_70_rflux.rad
cat ~/simulation/boston/radFiles/_GlassBSDF_70.rad >> ~/simulation/boston/radFiles/_GlassBSDF_70_rflux.rad
echo ~/simulation/boston/radFiles/_GlassBSDF_70_rflux.rad""",
    fireLogs=False,
    lastRunTime=5,
    results="/home/mss/simulation/boston/radFiles/_GlassBSDF_70_rflux.rad",
    suppressWarnings=False)  # -> Stdout, Stderr_, Ran
fenestrations_rad_rflux = Text(executessh_6.Stdout)

fenestrations_rad_rflux_2 = Text(fenestrations_rad_rflux)
overrides_24 = ApplyOverrides(Input_="head <file> -n 20", File=graft(fenestrations_rad_rflux_2))  # -> flatten(Output), Pairs
executessh_7 = ExecuteSSH(
    _SSHCommands_=overrides_24.Output,
    Run=executessh_6.Ran,
    addPrefix=True,
    commands="head /home/mss/simulation/boston/radFiles/_GlassBSDF_70_rflux.rad -n 20",
    description="head /home/mss/simulation/boston/radFiles/_GlassBSDF_70_rflux.rad -n 20",
    fireLogs=False,
    lastRunTime=18.5625,
    results="""void glow _GlassBSDF_70_mat 0 0 4 1 1 1 0
#@rfluxmtx h=kf u=Z
# obj2rad -m /home/mss/simulation/boston/radFiles/mapping_windows.map -f /home/mss/simulation/boston/radFiles/_GlassBSDF_70.obj
# Written with MantaRay plugin/GH_MeshToRad

_GlassBSDF_70_mat polygon _GlassBSDF_70_1.1
0
0
12
            40.391             181.83            113.752
            40.391             181.83            113.018
            41.624            181.319            113.018
            41.624            181.319            113.752

_GlassBSDF_70_mat polygon _GlassBSDF_70_1.2
0
0
12
            42.356            181.016            112.942
            42.356            181.016            110.808""",
    suppressWarnings=False)  # -> Stdout, Stderr_, Ran
panel_55 = Panel(executessh_7.Stdout)

# ----
# modifiers
blinds_material = Panel("void plastic blindmat 0 0 5 .8 .8 .8 0 .01")
glass_modifier = Text(radviewer_3.Modifiers)
panel_56 = Panel("echo \"<modifiers>\" > <proj>/radFiles/BSDF_Mods_<name>.rad;echo <proj>/radFiles/BSDF_Mods_<name>.rad")
concat_4 = Concatenate(FragmentA=glass_modifier, FragmentC=blinds_material)
name_5 = Text(name_3)
overrides_25 = ApplyOverrides(Input_=panel_56, Modifiers=graft(concat_4), Name=graft(name_5))  # -> Output, Pairs
executessh_8 = ExecuteSSH(
    _SSHCommands_=overrides_25.Output,
    Run=executessh_3.Ran,
    addPrefix=True,
    description="""echo "void glass _GlassBSDF_70_mat
0
0
3
0.763 0.763 0.763
void plastic blindmat 0 0 5 .8 .8 .8 0 .01" > ~/simulation/boston/radFiles/BSDF_Mods__GlassBSDF_70_mat.rad;echo ~/simulation/boston/radFiles/BSDF_Mods__GlassBSDF_70_mat.rad""",
    fireLogs=False,
    lastRunTime=6,
    results="/home/mss/simulation/boston/radFiles/BSDF_Mods__GlassBSDF_70_mat.rad",
    suppressWarnings=False)  # -> Stdout, Stderr_, Ran

# ----
# Viewmatrix (grid based)
fenestrations_rad_rflux_3 = Text(fenestrations_rad_rflux)
ptsfile_3 = Text(ptsfile_2)
panel_57 = Panel("""mkdir -p <proj>/mtxs/3phGrid
rfluxmtx -v -w -I+ <param> -n <cpus> -y <ptcount> - <receiver> -i <octree> < <ptsfile> > <proj>/mtxs/3phGrid/room_<window>.vmx
echo <proj>/mtxs/3phGrid/room_<window>.vmx""")
glassname_2 = Text(glassname)
octree_no_glass_2 = Text(octree_no_glass)
overrides_26 = ApplyOverrides(Input_="wc -l < <ptsFile>", PtsFile=graft(ptsfile_3))  # -> Output, Pairs
falsestart_5 = LBFalseStartToggle(False)
executessh_wip_8 = ExecuteSSHWIP(
    _SSHCommands_=overrides_26.Output,
    Run=falsestart_5,
    addPrefix=True,
    description="wc -l < /home/mss/simulation/boston/points.pts",
    fireLogs=False,
    lastRunTime=5,
    results="48",
    suppressWarnings=False)  # -> Stdout, Stderr_, Ran
overrides_27 = ApplyOverrides(
    Input_=panel_57,
    Window=graft(glassname_2),
    Receiver=graft(fenestrations_rad_rflux_3),
    Octree=graft(octree_no_glass_2),
    Ptsfile=graft(ptsfile_3),
    Ptcount=graft(executessh_wip_8.Stdout),
    Param=graft("-ab 2 -ad 1024 -lw 1e-3"))  # -> Output, Pairs
executessh_wip_9 = ExecuteSSHWIP(
    _SSHCommands_=overrides_27.Output,
    Run=executessh_wip_8.Ran,
    addPrefix=True,
    description="""mkdir -p ~/simulation/boston/mtxs/3phGrid
rfluxmtx -v -w -I+ -ab 2 -ad 1024 -lw 1e-3 -n 11 -y 48 - /home/mss/simulation/boston/radFiles/_GlassBSDF_70_rflux.rad -i /home/mss/simulation/boston/octrees/opaque_scene.oct < /home/mss/simulation/boston/points.pts > ~/simulation/boston/mtxs/3phGrid/room__GlassBSDF_70.vmx
echo ~/simulation/boston/mtxs/3phGrid/room__GlassBSDF_70.vmx""",
    fireLogs=True,
    lastRunTime=7585,
    name="ViewMatrix grid",
    results="/home/mss/simulation/boston/mtxs/3phGrid/room__GlassBSDF_70.vmx",
    suppressWarnings=False)  # -> Stdout, Stderr_, Ran
vmx_grid = Text(executessh_wip_9.Stdout)

# ----
# VIEWMATRIX (image based)
panel_58 = Panel("""mkdir -p <proj>/mtxs/3ph_view_<viewname>;
cd <proj>;
vwrays -vf <vf> -x <x> -y <y> -pj 0.7 -c 9 -ff | rfluxmtx -v -ffc `vwrays -vf <vf> -x <x> -y <y> -d` -o <proj>/mtxs/3ph_view_<viewname>/<windowgroup>_%03d.hdr <param> -c 9 -n <cpus> - <windowRad> -i <opaqueOctree>;
echo "<proj>/mtxs/3ph_view_<viewname>/<windowgroup>_%03d.hdr"
""")
fenestrations_rad_rflux_4 = Text(fenestrations_rad_rflux)
glassname_3 = Text(glassname)
viewnames = Data(view_names)
viewfiles_2 = Text(viewfiles)
octree_no_glass_3 = Text(octree_no_glass)
crossref = CrossReference(ListA=glassname_3, ListB=viewnames, CrossMode=1)  # -> ListA, ListB
crossref_2 = CrossReference(ListA=viewnames, ListB=fenestrations_rad_rflux_4, CrossMode=1)  # -> ListA, ListB
crossref_3 = CrossReference(ListA=viewfiles_2, ListB=fenestrations_rad_rflux_4, CrossMode=1)  # -> ListA, ListB
overrides_28 = ApplyOverrides(
    Input_=panel_58,
    Windowgroup=graft(crossref.ListA),
    Viewname=graft(crossref.ListB),
    WindowRad=graft(crossref_2.ListB),
    Vf=graft(crossref_3.ListA),
    OpaqueOctree=graft(octree_no_glass_3),
    X=graft("600"),
    Y=graft("400"),
    Param=graft("-ab 1 -ad 512 -lw 2e-4"))  # -> flatten(Output), Pairs
falsestart_6 = LBFalseStartToggle(False)
executessh_9 = ExecuteSSH(
    _SSHCommands_=overrides_28.Output,
    Run=falsestart_6,
    addPrefix=True,
    description="""mkdir -p ~/simulation/test_project2/mtxs/3ph_view_P1;
cd ~/simulation/test_project2;
vwrays -vf /home/mss/simulation/test_project2/views/P1.vf -x 600 -y 400 -pj 0.7 -c 9 -ff | rfluxmtx -v -ffc `vwrays -vf /home/mss/simulation/test_project2/views/P1.vf -x 600 -y 400 -d` -o ~/simulation/test_project2/mtxs/3ph_view_P1/GlassSouth_70_%03d.hdr -ab 1 -ad 512 -lw 2e-4 -c 9 -n 11 - /home/mss/simulation/test_project2/radFiles/GlassSouth_70_rflux.rad -i /home/mss/simulation/test_project2/octrees/opaque_scene.oct;
echo "~/simulation/test_project2/mtxs/3ph_view_P1/GlassSouth_70_%03d.hdr"
mkdir -p ~/simulation/test_project2/mtxs/3ph_view_P1;
cd ~/simulation/test_project2;
vwrays -vf /home/mss/simulation/test_project2/views/P1.vf -x 600 -y 400 -pj 0.7 -c 9 -ff | rfluxmtx -v -ffc `vwrays -vf /home/mss/simulation/test_project2/views/P1.vf -x 600 -y 400 -d` -o ~/simulation/test_project2/mtxs/3ph_view_P1/GlassWest_70_%03d.hdr -ab 1 -ad 512 -lw 2e-4 -c 9 -n 11 - /home/mss/simulation/test_project2/radFiles/GlassWest_70_rflux.rad -i /home/mss/simulation/test_project2/octrees/opaque_scene.oct;
echo "~/simulation/test_project2/mtxs/3ph_view_P1/GlassWest_70_%03d.hdr"
""",
    fireLogs=True,
    lastRunTime=515215,
    name="Viewmatrix (image)",
    results="""~/simulation/test_project2/mtxs/3ph_view_P1/GlassSouth_70_%03d.hdr
_JOIN_
~/simulation/test_project2/mtxs/3ph_view_P1/GlassWest_70_%03d.hdr""",
    stderr="""rfluxmtx: running: rcontrib -fo+ -o /home/mss/simulation/test_project2/mtxs/3ph_view_P1/GlassSouth_70_%03d.hdr -ab 1 -ad 512 -lw 2e-4 -n 11 -x 600 -y 288 -ld- -ffc -c 9 -f klems_full.cal -p RHS=+1 -bn Nkbins -b 'kbin(0.601817,-0.798634,0,0,0,1)' -m GlassSouth_70_mat '!oconv -f -i /home/mss/simulation/test_project2/octrees/opaque_scene.oct /home/mss/simulation/test_project2/radFiles/GlassSouth_70_rflux.rad'
rcontrib: warning - non-planar vertex for polygon "Ceiling_0.7_1.40"
rcontrib: warning - non-planar vertex for polygon "Ceiling_0.7_1.62"
rcontrib: warning - non-planar vertex for polygon "Floor_0.2_1.170"
rcontrib: warning - non-planar vertex for polygon "Floor_0.2_1.174"
rcontrib: warning - non-planar vertex for polygon "Floor_0.2_1.176"
rcontrib: warning - non-planar vertex for polygon "Floor_0.2_1.192"
rcontrib: warning - non-planar vertex for polygon "Floor_0.2_1.193"
rcontrib: warning - non-planar vertex for polygon "Floor_0.2_1.195"
rcontrib: warning - non-planar vertex for polygon "Wall_0.5_1.3720"
rcontrib: warning - non-planar vertex for polygon "Frames_0.7_1.580"
rcontrib: warning - non-planar vertex for polygon "Frames_0.7_1.6150"
rcontrib: warning - non-planar vertex for polygon "Frames_0.7_1.6158"
rcontrib: warning - non-planar vertex for polygon "Frames_0.7_1.6221"
rcontrib: warning - non-planar vertex for polygon "Frames_0.7_1.6228"
rcontrib: warning - non-planar vertex for polygon "Frames_0.7_1.6276"
rfluxmtx: running: rcontrib -fo+ -o /home/mss/simulation/test_project2/mtxs/3ph_view_P1/GlassWest_70_%03d.hdr -ab 1 -ad 512 -lw 2e-4 -n 11 -x 600 -y 288 -ld- -ffc -c 9 -f klems_full.cal -p RHS=+1 -bn Nkbins -b 'kbin(0.798635,0.601815,-1.90446e-08,0,0,1)' -m GlassWest_70_mat '!oconv -f -i /home/mss/simulation/test_project2/octrees/opaque_scene.oct /home/mss/simulation/test_project2/radFiles/GlassWest_70_rflux.rad'
rcontrib: warning - non-planar vertex for polygon "Ceiling_0.7_1.40"
rcontrib: warning - non-planar vertex for polygon "Ceiling_0.7_1.62"
rcontrib: warning - non-planar vertex for polygon "Floor_0.2_1.170"
rcontrib: warning - non-planar vertex for polygon "Floor_0.2_1.174"
rcontrib: warning - non-planar vertex for polygon "Floor_0.2_1.176"
rcontrib: warning - non-planar vertex for polygon "Floor_0.2_1.192"
rcontrib: warning - non-planar vertex for polygon "Floor_0.2_1.193"
rcontrib: warning - non-planar vertex for polygon "Floor_0.2_1.195"
rcontrib: warning - non-planar vertex for polygon "Wall_0.5_1.3720"
rcontrib: warning - non-planar vertex for polygon "Frames_0.7_1.580"
rcontrib: warning - non-planar vertex for polygon "Frames_0.7_1.6150"
rcontrib: warning - non-planar vertex for polygon "Frames_0.7_1.6158"
rcontrib: warning - non-planar vertex for polygon "Frames_0.7_1.6221"
rcontrib: warning - non-planar vertex for polygon "Frames_0.7_1.6228"
rcontrib: warning - non-planar vertex for polygon "Frames_0.7_1.6276"
""",
    suppressWarnings=False)  # -> Stdout, Stderr_, Ran
panel_59 = Panel(overrides_28.Output)
hi_res_override = Panel(executessh_9.Stdout)
viewmatrix_img = Text(executessh_9.Stdout)

# ----
# Daylight matrix (exterior)
fenestrations_rad_rflux_5 = Text(fenestrations_rad_rflux)
glassname_4 = Text(glassname)
octree_no_glass_4 = Text(octree_no_glass)
skyglow_2 = Text(skyglow)
panel_60 = Panel("""mkdir -p <proj>/mtxs/3ph_dmx;
rfluxmtx -w -v -ff <param> -c 1000 -n <cpus> <receiver> <skyglow> -i <octree> > <proj>/mtxs/3ph_dmx/<receiverName>.dmx;echo "<proj>/mtxs/3ph_dmx/<receiverName>.dmx"
""")
overrides_29 = ApplyOverrides(
    Input_=panel_60,
    Param=graft("-ab 2 -ad 512 -lw 0.002"),
    Receiver=graft(fenestrations_rad_rflux_5),
    ReceiverName=graft(glassname_4),
    Octree=graft(octree_no_glass_4),
    Skyglow=graft(skyglow_2))  # -> flatten(Output), Pairs
falsestart_7 = LBFalseStartToggle(False)
executessh_10 = ExecuteSSH(
    _SSHCommands=overrides_29.Output,
    Run=falsestart_7,
    addPrefix=True,
    description="""mkdir -p ~/simulation/boston/mtxs/3ph_dmx;
rfluxmtx -w -v -ff -ab 2 -ad 512 -lw 0.002 -c 1000 -n 11 /home/mss/simulation/boston/radFiles/_GlassBSDF_70_rflux.rad ~/simulation/boston/radFiles/skyglow_3ph.rad -i /home/mss/simulation/boston/octrees/opaque_scene.oct > ~/simulation/boston/mtxs/3ph_dmx/_GlassBSDF_70.dmx;echo "~/simulation/boston/mtxs/3ph_dmx/_GlassBSDF_70.dmx"
""",
    fireLogs=True,
    lastRunTime=28743,
    name="DaylightMatrix",
    results="~/simulation/boston/mtxs/3ph_dmx/_GlassBSDF_70.dmx",
    stderr="""rfluxmtx: opening pipe to: rcontrib -fo+ -w -ab 2 -ad 512 -lw 0.002 -n 11 -fdf -c 1000 -f reinhartb.cal -p MF=1,rNx=0,rNy=0,rNz=-1,Ux=0,Uy=1,Uz=0,RHS=+1 -bn Nrbins -b rbin -m sky_glow -bn 1 -b 'if(-Dx*0-Dy*0-Dz*1,0,-1)' -m ground_glow -y 145 '!oconv -f -i /home/mss/simulation/boston/octrees/opaque_scene.oct /home/mss/simulation/boston/radFiles/skyglow_3ph.rad'
rfluxmtx: sampling 145 directions (7 elements)""",
    suppressWarnings=True)  # -> Stdout, Stderr, Ran
panel_61 = Panel(executessh_10.Stdout)
dmx = Text(executessh_10.Stdout)

panel_62 = Panel(name_3)

# ----
# glass pane geometry
panel_63 = Panel("""<mat> polygon window
0
0
12 0 0 0
0 <y> 0
<x> <y> 0
<x> 0 0""")
python_13 = GhPythonScript(l=executessh_3.Stdout)  # -> out, xmax, ymax; inputs l: list; same code as python
panel_64 = Panel("echo \"<window>\" > <proj>/radFiles/BSDF_Geo_<name>.rad;echo <proj>/radFiles/BSDF_Geo_<name>.rad")
panel_65 = Panel(python_13.out)
overrides_30 = ApplyOverrides(Input_=panel_63, Mat=graft(panel_62), X=graft(python_13.xmax), Y=graft(python_13.ymax))  # -> Output, Pairs
name_6 = Text(name_3)
overrides_31 = ApplyOverrides(Input_=panel_64, Window=graft(overrides_30.Output), Name=graft(name_6))  # -> Output, Pairs
executessh_11 = ExecuteSSH(
    _SSHCommands_=overrides_31.Output,
    Run=executessh_3.Ran,
    addPrefix=True,
    description="""echo "_GlassBSDF_70_mat polygon window
0
0
12 0 0 0
0 1.99165 0
1 1.99165 0
1 0 0" > ~/simulation/boston/radFiles/BSDF_Geo__GlassBSDF_70_mat.rad;echo ~/simulation/boston/radFiles/BSDF_Geo__GlassBSDF_70_mat.rad""",
    fireLogs=False,
    lastRunTime=13,
    results="/home/mss/simulation/boston/radFiles/BSDF_Geo__GlassBSDF_70_mat.rad",
    suppressWarnings=False)  # -> Stdout, Stderr_, Ran

# ----
# GenBSDF
panel_66 = Panel("mkdir -p <proj>/BSDF;genBSDF -n <cpus> <dim> <radFiles> > <proj>/BSDF/<target>.xml;echo \"<proj>/BSDF/<target>.xml\"")
blindsgeo = Text(executessh_2.Stdout)
modifiers = Text(executessh_8.Stdout)
glassgeo = Text(executessh_11.Stdout)
merge = Merge(Data1=flatten(modifiers), Data2=flatten(blindsgeo), Data3=flatten(glassgeo))
join_3 = TextJoin(Text=merge, Join=" ")
blindsname = Text("blinds_001")
name_7 = Text(name_3)
concat_5 = Concatenate(FragmentA=blindsname, FragmentC="_", FragmentB=name_7)
panel_67 = Panel(concat_5)
overrides_32 = ApplyOverrides(Input_=panel_66, RadFiles=graft(join_3), Dim=graft(overrides_14.Output), Target=graft(concat_5))  # -> Output, Pairs
executessh_12 = ExecuteSSH(
    _SSHCommands=overrides_32.Output,
    Run=[executessh_8.Ran, executessh_11.Ran],
    addPrefix=True,
    description="mkdir -p ~/simulation/boston/BSDF;genBSDF -n 11 -dim 0.23 0.77 0.48558 1.541785 -0.15 0 /home/mss/simulation/boston/radFiles/BSDF_Mods__GlassBSDF_70_mat.rad /home/mss/simulation/boston/radFiles/blinds_001.rad /home/mss/simulation/boston/radFiles/BSDF_Geo__GlassBSDF_70_mat.rad > ~/simulation/boston/BSDF/blinds_001__GlassBSDF_70_mat.xml;echo \"~/simulation/boston/BSDF/blinds_001__GlassBSDF_70_mat.xml\"",
    fireLogs=False,
    lastRunTime=150197,
    results="~/simulation/boston/BSDF/blinds_001__GlassBSDF_70_mat.xml",
    stderr="Recover using: /usr/local/radiance/bin/genBSDF -recover /tmp/genBSDF.406ojx",
    suppressWarnings=True)  # -> Stdout, Stderr, Ran

convertpaths_6 = ConvertPaths(I=merge)  # -> Linux, Windows
radviewer_5 = RadViewer(
    RadFiles=flatten(convertpaths_6.Windows),
    IsTwoSided=False,
    Polychromatic=True,
    ShowEdges=True,
    Transparent=True,
    ColorNames=["blindmat", "_GlassBSDF_70_mat"],
    Colors=[RGB(225, 103, 226), RGB(155, 133, 174)])  # -> Geo, ModifierNames, Modifiers, FailedWireFrame

panel_68 = Panel(executessh_12.Stdout)

bsdf_venetian = Text(flatten(executessh_12.Stdout))

# ----
# Dctimestep (matrixmultiplication for image based)
# mkdir -p "<proj>/mtxs/3ph_view_<view>"
# dctimestep -h <vmx> <bsdf> <dmx> <sv> > "~/simulation/hi_<aperture>_<skyname>.hdr"
# echo "~/simulation/hi_<aperture>_<skyname>.hdr"
# rmtxop <vmx> <bsdf> <dmx> <smx> | rmtxop -fa -c 47.4 119.9 11.6 - > "<proj>/results/3ph_view_<view>"/<aperture>.ill
# "<proj>/results/3ph_view_<view>"
panel_69 = Panel("""mkdir -p <proj>/mtxs/3ph_view_<view>
dctimestep -h <vmx> <bsdf> <dmx> <sv> > <proj>/mtxs/3ph_view_<view>/<aperture>_<skyname>.hdr
echo <proj>/mtxs/3ph_view_<view>/<aperture>_<skyname>.hdr""")
aperturename = Text(glassname)
viewnames_2 = Data(view_names)
skyvector = Text(executessh_5.Stdout)
skyname = Text(python_8)
vmx = Text(viewmatrix_img)
dmx_2 = Text(dmx)
bsdf = Text(executessh_12.Stdout)
crossref_4 = CrossReference(ListA=vmx, ListB=bsdf, ListC=viewnames_2, ListD=skyname, CrossMode=1)  # -> ListA, ListB, ListC, ListD
crossref_5 = CrossReference(ListA=aperturename, ListB=bsdf, ListC=viewnames_2, ListD=skyvector, CrossMode=1)  # -> ListA, ListB, ListC, ListD
crossref_6 = CrossReference(ListA=dmx_2, ListB=bsdf, ListC=viewnames_2, ListD=skyname, CrossMode=1)  # -> ListA, ListB, ListC, ListD
overrides_33 = ApplyOverrides(
    Input_=panel_69,
    Vmx=graft(crossref_4.ListA),
    Aperture=graft(crossref_5.ListA),
    Sv=graft(crossref_5.ListD),
    Dmx=graft(crossref_6.ListA),
    Bsdf=graft(crossref_6.ListB),
    View=graft(crossref_6.ListC),
    Skyname=graft(crossref_6.ListD))  # -> graft(Output), Pairs
panel_70 = Panel(overrides_33.Output)
falsestart_8 = LBFalseStartToggle(False)
executessh_13 = ExecuteSSH(
    _SSHCommands_=overrides_33.Output,
    Run=falsestart_8,
    addPrefix=True,
    description="""mkdir -p "~/simulation/test_project2/mtxs/3ph_view_P1"
dctimestep -h ~/simulation/test_project2/mtxs/3ph_view_P1/GlassSouth_70_%03d.hdr ~/simulation/test_project2/BSDF/blinds_001_GlassSouth_70_mat.xml ~/simulation/test_project2/mtxs/3ph_view_P1/GlassSouth_70.dmx ~/simulation/test_project2/skyvectors/DNK_CIEs_062115.vec > "~/simulation/test_project2/mtxs/3ph_view_P1/GlassSouth_70_DNK_CIEs_062115.hdr"
echo "~/simulation/test_project2/mtxs/3ph_view_P1/GlassSouth_70_DNK_CIEs_062115.hdr"
mkdir -p "~/simulation/test_project2/mtxs/3ph_view_P1"
dctimestep -h ~/simulation/test_project2/mtxs/3ph_view_P1/GlassWest_70_%03d.hdr ~/simulation/test_project2/BSDF/blinds_001_GlassSouth_70_mat.xml ~/simulation/test_project2/mtxs/3ph_view_P1/GlassWest_70.dmx ~/simulation/test_project2/skyvectors/DNK_CIEs_062115.vec > "~/simulation/test_project2/mtxs/3ph_view_P1/GlassWest_70_DNK_CIEs_062115.hdr"
echo "~/simulation/test_project2/mtxs/3ph_view_P1/GlassWest_70_DNK_CIEs_062115.hdr"
""",
    fireLogs=True,
    lastRunTime=7065,
    name="DcTimeStep",
    results="""~/simulation/test_project2/mtxs/3ph_view_P1/GlassSouth_70_DNK_CIEs_062115.hdr
_JOIN_
~/simulation/test_project2/mtxs/3ph_view_P1/GlassWest_70_DNK_CIEs_062115.hdr""",
    suppressWarnings=False)  # -> flatten(Stdout), Stderr_, Ran
panel_71 = Panel("""C:\Users\mm1013\simulation\test_project2\mtxs\3ph_view_P1\GlassSouth_70_DNK_CIEs_062115.hdr
C:\Users\mm1013\simulation\test_project2\mtxs\3ph_view_P1\GlassWest_70_DNK_CIEs_062115.hdr""")
convertpaths_7 = ConvertPaths(I=executessh_13.Stdout)  # -> Linux, Windows
panel_72 = Panel(convertpaths_7.Windows)
imageviewer = LBImageViewer(ImagePath_=convertpaths_7.Windows, _scale_=1, DisableClickable=False, SaveImgWithCoords=False, scale=1)  # -> ImagePath, Values, GIF

panel_73 = Panel("""normtiff <file> <file-.>.tif
convert <file-.>.tif <file-.>.png
echo <file-.>.png""")
overrides_34 = ApplyOverrides(Input_=panel_73, File=graft(executessh_13.Stdout))  # -> Output, Pairs
executessh_14 = ExecuteSSH(
    _SSHCommands_=flatten(overrides_34.Output),
    Run=executessh_13.Ran,
    addPrefix=True,
    description="""normtiff ~/simulation/test_project2/mtxs/3ph_view_P1/GlassSouth_70_DNK_CIEs_062115.hdr ~/simulation/test_project2/mtxs/3ph_view_P1/GlassSouth_70_DNK_CIEs_062115.tif
convert ~/simulation/test_project2/mtxs/3ph_view_P1/GlassSouth_70_DNK_CIEs_062115.tif ~/simulation/test_project2/mtxs/3ph_view_P1/GlassSouth_70_DNK_CIEs_062115.png
echo ~/simulation/test_project2/mtxs/3ph_view_P1/GlassSouth_70_DNK_CIEs_062115.png
normtiff ~/simulation/test_project2/mtxs/3ph_view_P1/GlassWest_70_DNK_CIEs_062115.hdr ~/simulation/test_project2/mtxs/3ph_view_P1/GlassWest_70_DNK_CIEs_062115.tif
convert ~/simulation/test_project2/mtxs/3ph_view_P1/GlassWest_70_DNK_CIEs_062115.tif ~/simulation/test_project2/mtxs/3ph_view_P1/GlassWest_70_DNK_CIEs_062115.png
echo ~/simulation/test_project2/mtxs/3ph_view_P1/GlassWest_70_DNK_CIEs_062115.png""",
    fireLogs=False,
    lastRunTime=5,
    results="""/home/mss/simulation/test_project2/mtxs/3ph_view_P1/GlassSouth_70_DNK_CIEs_062115.png
_JOIN_
/home/mss/simulation/test_project2/mtxs/3ph_view_P1/GlassWest_70_DNK_CIEs_062115.png""",
    stderr="""TIFFOpen: /home/mss/simulation/test_project2/mtxs/3ph_view_P1/GlassSouth_70_DNK_CIEs_062115.hdr: No such file or directory.
normtiff: cannot open or interpret file "/home/mss/simulation/test_project2/mtxs/3ph_view_P1/GlassSouth_70_DNK_CIEs_062115.hdr"
convert-im6.q16: unable to open image `/home/mss/simulation/test_project2/mtxs/3ph_view_P1/GlassSouth_70_DNK_CIEs_062115.tif': No such file or directory @ error/blob.c/OpenBlob/2874.
convert-im6.q16: no images defined `/home/mss/simulation/test_project2/mtxs/3ph_view_P1/GlassSouth_70_DNK_CIEs_062115.png' @ error/convert.c/ConvertImageCommand/3258.
TIFFOpen: /home/mss/simulation/test_project2/mtxs/3ph_view_P1/GlassWest_70_DNK_CIEs_062115.hdr: No such file or directory.
normtiff: cannot open or interpret file "/home/mss/simulation/test_project2/mtxs/3ph_view_P1/GlassWest_70_DNK_CIEs_062115.hdr"
convert-im6.q16: unable to open image `/home/mss/simulation/test_project2/mtxs/3ph_view_P1/GlassWest_70_DNK_CIEs_062115.tif': No such file or directory @ error/blob.c/OpenBlob/2874.
convert-im6.q16: no images defined `/home/mss/simulation/test_project2/mtxs/3ph_view_P1/GlassWest_70_DNK_CIEs_062115.png' @ error/convert.c/ConvertImageCommand/3258.""",
    suppressWarnings=False)  # -> Stdout, Stderr_, Ran

# ----
# rmtxop (matrixmultiplication for grid based(
# mkdir -p <proj>/results/3PhGrid
# rmtxop <vmx> <bsdf> <dmx> <smx> | rmtxop -fa -c 47.4 119.9 11.6 - > <proj>/results/3PhGrid/<aperture><bsdfName>.ill
# echo "<proj>/results/3PhGrid/<aperture><bsdfName>.ill"
bsdf_micro = Text(flatten(upload.FilePaths))
panel_74 = Panel("""mkdir -p <proj>/results/3PhGrid
rmtxop <vmx> "<bsdf>" <dmx> <smx> | rmtxop -fa -c 47.4 119.9 11.6 - | rcollate -t > <proj>/results/3PhGrid/<aperture><bsdfName>.ill
echo "<proj>/results/3PhGrid/<aperture><bsdfName>.ill"
""")
aperturename_2 = Text(glassname)
vmx_grid_2 = Text(vmx_grid)
dmx_3 = Text(dmx)
skymtx_3 = Text(skymtx)
falsestart_9 = LBFalseStartToggle(True)

entwine_3 = Entwine(Branch00=bsdf_micro, Branch01=bsdf_venetian, FlattenInputs=True)  # -> flatten(Result)
crossref_7 = CrossReference(ListA=dmx_3, ListB=panel_41, ListC=aperturename_2, CrossMode=1)  # -> ListA, ListB, ListC, ListD

crossref_8 = CrossReference(ListA=aperturename_2, ListB=entwine_3, ListC=dmx_3, CrossMode=1)  # -> ListA, ListB, ListC, ListD
crossref_9 = CrossReference(ListA=dmx_3, ListB=entwine_3, ListC=aperturename_2, CrossMode=1)  # -> ListA, ListB, ListC, ListD
crossref_10 = CrossReference(ListA=vmx_grid_2, ListB=entwine_3, ListC=dmx_3, CrossMode=1)  # -> ListA, ListB, ListC, ListD
overrides_35 = ApplyOverrides(
    Input_=panel_74,
    Vmx=graft(crossref_10.ListA),
    Aperture=graft(crossref_8.ListA),
    Dmx=graft(crossref_9.ListA),
    Bsdf=graft(crossref_9.ListB),
    Smx=graft(skymtx_3),
    BsdfName=graft(crossref_7.ListB))  # -> graft(Output), Pairs
panel_75 = Panel(overrides_35.Output)
executessh_15 = ExecuteSSH(
    _SSHCommands_=overrides_35.Output,
    Run=falsestart_9,
    addPrefix=True,
    commands="""mkdir -p ~/simulation/boston/results/3PhGrid
rmtxop /home/mss/simulation/boston/mtxs/3phGrid/room__GlassBSDF_70.vmx "~/simulation/boston/BSDF/blinds_001__GlassBSDF_70_mat.xml" ~/simulation/boston/mtxs/3ph_dmx/_GlassBSDF_70.dmx /home/mss/simulation/weatherData/DNK_DRY_OFFICIAL_2001-2010_epw-fil_m1.smx | rmtxop -fa -c 47.4 119.9 11.6 - | rcollate -t > ~/simulation/boston/results/3PhGrid/_GlassBSDF_70venetian.ill
echo "~/simulation/boston/results/3PhGrid/_GlassBSDF_70venetian.ill"mkdir -p ~/simulation/boston/results/3PhGrid
rmtxop /home/mss/simulation/boston/mtxs/3phGrid/room__GlassBSDF_70.vmx "~/simulation/boston/8mm MS-F 6014 Rot 90.xml" ~/simulation/boston/mtxs/3ph_dmx/_GlassBSDF_70.dmx /home/mss/simulation/weatherData/DNK_DRY_OFFICIAL_2001-2010_epw-fil_m1.smx | rmtxop -fa -c 47.4 119.9 11.6 - | rcollate -t > ~/simulation/boston/results/3PhGrid/_GlassBSDF_70micro.ill
echo "~/simulation/boston/results/3PhGrid/_GlassBSDF_70micro.ill"
""",
    description="""mkdir -p ~/simulation/boston/results/3PhGrid
rmtxop /home/mss/simulation/boston/mtxs/3phGrid/room__GlassBSDF_70.vmx "~/simulation/boston/BSDF/blinds_001__GlassBSDF_70_mat.xml" ~/simulation/boston/mtxs/3ph_dmx/_GlassBSDF_70.dmx /home/mss/simulation/weatherData/DNK_DRY_OFFICIAL_2001-2010_epw-fil_m1.smx | rmtxop -fa -c 47.4 119.9 11.6 - | rcollate -t > ~/simulation/boston/results/3PhGrid/_GlassBSDF_70venetian.ill
echo "~/simulation/boston/results/3PhGrid/_GlassBSDF_70venetian.ill"
mkdir -p ~/simulation/boston/results/3PhGrid
rmtxop /home/mss/simulation/boston/mtxs/3phGrid/room__GlassBSDF_70.vmx "~/simulation/boston/8mm MS-F 6014 Rot 90.xml" ~/simulation/boston/mtxs/3ph_dmx/_GlassBSDF_70.dmx /home/mss/simulation/weatherData/DNK_DRY_OFFICIAL_2001-2010_epw-fil_m1.smx | rmtxop -fa -c 47.4 119.9 11.6 - | rcollate -t > ~/simulation/boston/results/3PhGrid/_GlassBSDF_70micro.ill
echo "~/simulation/boston/results/3PhGrid/_GlassBSDF_70micro.ill"
""",
    fireLogs=True,
    lastRunTime=3361.825,
    name="Rmtxop",
    results="""~/simulation/boston/results/3PhGrid/_GlassBSDF_70micro.ill
~/simulation/boston/results/3PhGrid/_GlassBSDF_70venetian.ill""",
    suppressWarnings=False)  # -> flatten(Stdout), Stderr_, Ran
ill_file = Text(executessh_15.Stdout)

# ----
# preview grid results
ill_file_2 = Text(ill_file)
convertpaths_8 = ConvertPaths(I=ill_file_2)  # -> Linux, Windows
_17037_schedule = Integer(cluster_2)
list_3 = ItemSelector(
    convertpaths_8.Windows,
    {"C:\Users\mm1013\simulation\boston\results\3PhGrid\_GlassBSDF_70micro.ill", "C:\Users\mm1013\simulation\boston\results\3PhGrid\_GlassBSDF_70venetian.ill"}, selected="C:\Users\mm1013\simulation\boston\results\3PhGrid\_GlassBSDF_70micro.ill")
falsestart_10 = LBFalseStartToggle(True)
annualresults = AnnualResults(
    IllFile=list_3,
    Schedule=_17037_schedule,
    Min="100",
    Max=-1,
    Run=falsestart_10,
    stdouts="#?RADIANCE>JOIN<rmtxop -fa -c 47.4 119.9 11.6 ->JOIN<rmtxop /home/mss/simulation/boston/mtxs/3phGrid/room__GlassBSDF_70.vmx \"~/simulation/boston/8mm MS-F 6014 Rot 90.xml\" /home/mss/simulation/boston/mtxs/3ph_dmx/_GlassBSDF_70.dmx /home/mss/simulation/weatherData/DNK_DRY_OFFICIAL_2001-2010_epw-fil_m1.smx>JOIN<Applied 1x3 matrix transform>JOIN<rcollate -t>JOIN<NROWS=8760>JOIN<NCOLS=48>JOIN<NCOMP=1>JOIN<FORMAT=ascii",
    numbers=[0.101826484, 0.5134703196, 0.4289954338, 0.5479452055, 0.5285388128, 0.1634703196, 0.2043378995, 0.4054794521, 0.352283105, 0.4200913242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])  # -> Headers, Results, Ran
find_file = FindOpenFileManiFolderExplorer(L=list_3, data=Button())
bnd = Bounds(Numbers=annualresults.Results)
pt_2 = Point(flatten(pt))
gradient = Gradient(
    LowerLimit="1",
    UpperLimit="0",
    Parameter=annualresults.Results,
    stops=[0: RGB(234, 38, 0), 0.25: RGB(234, 126, 0), 0.5: RGB(254, 244, 84), 0.75: RGB(173, 203, 249), 1: RGB(75, 107, 169)])
mesh_explode = MeshExplode(m=move.Geometry)  # -> out, simplify(A); same code as mesh_explode
pt_3 = Point(pt_2)
mcol = MeshColours(Mesh=graft(mesh_explode.A), Colours=graft(gradient))
expression = Expression(x=annualresults.Results, Expression="Format(\"{0:0}\", x*100)")
mjoin = MeshJoin(Meshes=flatten(mcol))
preview = CustomPreview(Geometry=pt_3, Material=gradient)
medges = MeshEdges(Mesh=mjoin)  # -> NakedEdges, InteriorEdges, NonManifoldEdges
tag = TextTag3D(Location=pt_3, Text=expression, Size="0.2", Colour=ColourSwatch(SwatchColor=RGB(255, 255, 255)), Justification=5)
preview_2 = CustomPreview(Geometry=[medges.NakedEdges, medges.InteriorEdges], Material=ColourSwatch(SwatchColor=RGB(0, 0, 0)))

# ----
# round to .2 (visual)
panel_76 = Panel(".2")
division = Division(A=annualresults.Results, B=panel_76)
int_2 = Integer(division)
multiplication = Multiplication(A=int_2, B=panel_76)

# ==== cluster Normals
amplitude = ClusterInput()
amplitude_2 = Data(amplitude)
geo = ClusterInput()
merge = Merge(Data1=flatten(amplitude_2), Data2=flatten("1m"))
geo_2 = Geometry(geo)
item = ListItem(List=merge, Index=0, Wrap=True)
facen = FaceNormals(Mesh=geo_2)  # -> Centers, Normals
U = Units(ValueString=item)
avr = Average(Input=facen.Centers)
avr_2 = Average(Input=facen.Normals)
unflatten = UnflattenTree(Tree=avr, Guide=geo_2)
unflatten_2 = UnflattenTree(Tree=avr_2, Guide=geo_2)
amp = Amplitude(Vector=unflatten_2, Amplitude=U)
pl = PlaneNormal(Origin=unflatten, ZAxis=unflatten_2)
norm = Vector(amp)
center = Point(unflatten)
P = ClusterOutput(pl)
norm_2 = ClusterOutput(norm)
center_2 = ClusterOutput(center)

# ==== cluster Cluster
horizontaldiffrad = ClusterInput()
horizontaldiffrad_2 = Number(horizontaldiffrad)
lng = ListLength(List=horizontaldiffrad_2)
lng_2 = ListLength(List=horizontaldiffrad_2)
series = Series(Start=0, Step=0, Count=lng)
division = Division(A=lng, B=2)
series_2 = Series(Start=0, Step=1, Count=lng_2)
subtraction = Subtraction(A=division, B=1)
sort = SortList(Keys=horizontaldiffrad_2, ValuesA=series_2)  # -> reverse(Keys), reverse(ValuesA)
dom = ConstructDomain(DomainStart="0", DomainEnd=subtraction)
subset = SubList(List=sort.ValuesA, Domain=dom, Wrap=True)  # -> List, Index
replace = ReplaceItems(List=series, Item="1", Indices=subset.List, Wrap=False)
schedule_01 = ClusterOutput(replace)

# ==== cluster DefaultMSS
default_value_flattened = ClusterInput()
data = ClusterInput()
data_2 = Data(data)
merge = Merge(Data1=flatten(data_2), Data2="0")  # -> flatten(Result)
default_value_flattened_2 = Data(flatten(default_value_flattened))
lng = ListLength(List=merge)
equals = Equality(FirstNumber=lng, SecondNumber="1")  # -> Equality, Inequality
cull = CullPattern(List=data_2, CullPattern=invert(equals.Equality))
panel = Panel(equals.Equality)
cull_2 = CullPattern(List=default_value_flattened_2, CullPattern=equals.Equality)
data_3 = Data([cull, cull_2])
data_4 = ClusterOutput(data_3)

# ==== cluster MeshIt2: Meshes everything in the input. Graft the input if you want to make several meshes, otherwise returns a joined mesh.
mesh_brep = ClusterInput()
mesh_brep_2 = Geometry(simplify(mesh_brep))
tmatch = MatchText(Text=mesh_brep_2, RegEx="(mesh)", Case=False)
tmatch_2 = MatchText(Text=mesh_brep_2, RegEx="(brep)|(polysurface)|(surface)|(extrusion)", Case=False)
group = Group(Objects=mesh_brep_2)
cull = CullPattern(List=mesh_brep_2, CullPattern=tmatch_2)
mesh = MeshBrep(
    Brep=cull,
    Settings={GridMaxCount=0, GridMinCount=16, JaggedSeams=False, MaxEdgeLength=0, MinEdgeLength=0.0001, MinTolerance=0, Refine=True, RefineAngle=0, RelativeTolerance=0.65, SimplePlanes=True, Tolerance=0})  # -> simplify(Mesh)
cull_2 = CullPattern(List=mesh_brep_2, CullPattern=tmatch)  # -> simplify(List)

# ----
# Fix invalid mesh
panel = Panel("Invalid Mesh")  # disabled
mesh_2 = Mesh(mesh)  # disabled
tmatch_3 = MatchText(Text=mesh_2, RegEx=panel, Case=False)  # disabled
unweave = Unweave(List=mesh_2, UnweavePattern=tmatch_3)  # -> Data0, Data1; disabled
explode = MeshExplode(Mesh=unweave.Data1, Interpolate=False)  # -> simplify(Faces); disabled
abc_a = ABC(data=explode)  # disabled
panel_2 = Panel("0")  # disabled
num = Number(panel_2)  # disabled
area = MeshArea(Mesh=abc_a)  # -> Area, Centroid; disabled
equals = Equality(FirstNumber=area.Area, SecondNumber=num)  # -> Equality, Inequality; disabled
cull_3 = CullPattern(List=abc_a, CullPattern=equals.Inequality)  # disabled
mjoin = MeshJoin(Meshes=[cull_3, unweave.Data0])  # disabled

# ----
# Fix invalid mesh
panel_3 = Panel("Invalid Mesh")  # disabled
mesh_3 = Mesh(cull_2)  # disabled
tmatch_4 = MatchText(Text=mesh_3, RegEx=panel_3, Case=False)  # disabled
unweave_2 = Unweave(List=mesh_3, UnweavePattern=tmatch_4)  # -> Data0, Data1; disabled
explode_2 = MeshExplode(Mesh=unweave_2.Data1, Interpolate=False)  # -> simplify(Faces); disabled
abc_a_2 = ABC(data=explode_2)  # disabled
panel_4 = Panel("0")  # disabled
num_2 = Number(panel_4)  # disabled
area_2 = MeshArea(Mesh=abc_a_2)  # -> Area, Centroid; disabled
equals_2 = Equality(FirstNumber=area_2.Area, SecondNumber=num_2)  # -> Equality, Inequality; disabled
cull_4 = CullPattern(List=abc_a_2, CullPattern=equals_2.Inequality)  # disabled
mjoin_2 = MeshJoin(Meshes=[cull_4, unweave_2.Data0])  # disabled

mjoin_3 = MeshJoin(Meshes=[mesh, cull_2])
c_script = CSharpScript(mesh=mjoin_3)  # -> A; inputs mesh: Mesh
# ---------- c_script: C# ----------
    mesh.Faces.CullDegenerateFaces();
    A = mesh;
# ---------- end c_script ----------
abc_a_3 = ABC(data=mjoin)  # disabled
abc_a_4 = ABC(data=mjoin_2)  # disabled
clean = CleanTree(RemoveNulls=True, RemoveInvalid=True, RemoveEmpty=False, Tree=[abc_a_3, abc_a_4])  # disabled
mjoin_4 = MeshJoin(Meshes=clean)  # disabled
unflatten = UnflattenTree(Tree=c_script, Guide=group)
mesh_explode = MeshExplode(m=mjoin_4)  # -> out, simplify(A); disabled
# ---------- mesh_explode: VB ----------
    Component.Params.Input(0).Name = "Mesh"
    Component.Params.Input(0).Description = "Open or closed mesh"

    Component.Params.Output(1).Name = "Mesh"
    Component.Params.Output(1).Description = "If successful, a valid mesh"

    If m IsNot Nothing Then
      Dim pts As Rhino.Geometry.Collections.MeshVertexList
      Dim faces As Rhino.Geometry.Collections.MeshFaceList
      Dim clrs As Rhino.Geometry.Collections.MeshVertexColorList
      Dim i As Integer
      Dim mshs As New list(Of mesh)

      faces = m.Faces
      pts = m.Vertices
      If m.VertexColors.count() = 0 Then m.VertexColors.CreateMonotoneMesh(color.FromArgb(100, 100, 100))
      clrs = m.VertexColors

      For i = 0 To faces.count() - 1 Step 1
        Dim fc As New meshFace
        Dim face As New MeshFace
        Dim ptList As New list(Of point3d)
        Dim clrList As New list(Of color)
        Dim msh As New mesh

        face = faces(i)

        ptList.add(New point3d(pts(face.A)))
        ptList.add(New point3d(pts(face.B)))
        ptList.add(New point3d(pts(face.C)))
        If face.IsQuad Then ptList.add(New point3d(pts(face.D)))

        clrList.add(clrs(face.A))
        clrList.add(clrs(face.B))
        clrList.add(clrs(face.C))
        If face.IsQuad Then clrList.add(clrs(face.D))

        If face.IsQuad Then fc = New meshFace(0, 1, 2, 3) Else fc = New meshface(0, 1, 2)

        msh.Vertices.AddVertices(ptList.toarray())
        msh.Faces.AddFace(fc)
        msh.VertexColors.SetColors(clrList.toarray())
        mshs.add(msh)
      Next

      A = mshs
    End If
# ---------- end mesh_explode ----------
c_script_2 = CSharpScript(mesh=mjoin_4)  # -> A; inputs mesh: Mesh; disabled; same code as c_script
c_script_3 = CSharpScript(mesh=mesh_explode.A)  # -> out, A; inputs mesh: list of Mesh; disabled
# ---------- c_script_3: C# ----------
    List<bool> isValid = new List<bool>();
    for (int i = 0; i < mesh.Count; i++)
    {
      isValid.Add(mesh[i].IsValid);
    }
    
    A = isValid;
# ---------- end c_script_3 ----------
mesh_joined = Mesh(unflatten)
cullf = CullFaces(Mesh=mjoin_4, Pattern=invert(c_script_3.A))  # disabled
mesh_joined_2 = ClusterOutput(mesh_joined)

# ==== cluster LargestBREP
window_breps = ClusterInput()
window_breps_2 = Brep(window_breps)
debrep = DeconstructBrep(Brep=window_breps_2)  # -> Faces, Edges, Vertices
area = Area(Geometry=debrep.Faces)  # -> Area, Centroid
sort = SortList(Keys=area.Area, ValuesA=debrep.Faces)  # -> Keys, ValuesA
item = ListItem(List=sort.ValuesA, Index=-1, Wrap=True)
group = Group(Objects=flatten(item))
grouped = ClusterOutput(group)

# ==== cluster Cluster_2
l = ClusterInput()
python = GhPythonScript(l=l)  # -> xmin, xmax, ymin, ymax, zmin; inputs l: list
# ---------- python: Python ----------
__author__ = "mm1013"
__version__ = "2022.08.20"

import rhinoscriptsyntax as rs
li = [s for s in l[1].split(" ") if len(s) > 0]
#print(li)
xmin, xmax, ymin, ymax, zmin, zmax = [float(v) for v in li]


if zmax > 0:
    print("Err, Zmax should be < 0!")
else:
    print("Zmax is OK (< 0)")
# ---------- end python ----------
panel = Panel("""0.23
0.77""")
dom = ConstructDomain(DomainStart=python.xmin, DomainEnd=python.xmax)
dom_2 = ConstructDomain(DomainStart=python.ymin, DomainEnd=python.ymax)
zmin = ClusterOutput(python.zmin)
remap = RemapNumbers(Value=panel, Source=Domain(0, 1), Target=dom)  # -> Mapped, Clipped
remap_2 = RemapNumbers(Value=panel, Source=Domain(0, 1), Target=dom_2)  # -> Mapped, Clipped
item = ListItem(List=remap.Mapped, Index=0, Wrap=True)  # -> Item, Item1
item_2 = ListItem(List=remap_2.Mapped, Index=0, Wrap=True)  # -> Item, Item1
xend = Number(item.Item1)
ystart = Number(item_2.Item)
yend = Number(item_2.Item1)
xstart = Number(item.Item)
xend_2 = ClusterOutput(xend)
ystart_2 = ClusterOutput(ystart)
yend_2 = ClusterOutput(yend)
xstart_2 = ClusterOutput(xstart)

# ==== cluster FindOpenFileManiFolderExplorer
data = ClusterInput()
L = ClusterInput()
default = DefaultMSS(data=data, default_value_flattened=Toggle(False))
item = ListItem(List=L, Index=-1, Wrap=True)  # -> flatten(Item)
cull = CullPattern(List=item, CullPattern=default)
open_folder = PythonScript(path=cull)
# ---------- open_folder: Python ----------
try:
    _path = _path.replace("/", "\\")
    import subprocess
    subprocess.Popen(r'explorer /select,' + _path)
except AttributeError:
    pass
# ---------- end open_folder ----------

# ==== cluster ABC
data = ClusterInput()
data_2 = Data(data)
path_mapper = PathMapper(
    data_2,
    source=["{A;B;C;D;E;F;G}", "{A;B;C;D;E;F}", "{A;B;C;D;E}", "{A;B;C;D}", "{A;B;C}", "{A;B}", "{A}"],
    target=["{A}", "{A}", "{A}", "{A}", "{A}", "{A}", "{A}"])
data_3 = Data(path_mapper)
data_4 = ClusterOutput(data_3)
