# Grasshopper definition Test_3Ph_multirooms.gh (Grasshopper 1.0.7)
# Copyright: 2021
# Copyright: 2022-11-38
# Copyright: 2022-06-43
# plug-ins: MantaRay, Human, HDTTreeUtils, LadybugGrasshopper

# ----
# Connect
toggle = BooleanToggle(True)
connect = ConnectSSHFTP(User="mss", Ip="localhost", Password="_prompt", _port=22, Connect=toggle)  # -> Status, Prefixes, Run
panel = Panel(connect.Prefixes)
panel_2 = Panel(connect.Status)

pt = Point(Point(53.51909518, 189.2547542, 113.9008082))
plan = Plane(Plane(origin=(49.9615704, 187.2645336, 111.7766989), x=(0.9238795325, -0.3826834324, 0), y=(0.3826834324, 0.9238795325, 0)))
along = Plane(Plane(origin=(51.76482638, 191.2260022, 110.7700015), x=(0.9238798022, -0.3826827813, 0), y=(4.012087945e-07, 9.686056606e-07, 1)))

# ----
# Overview of all running tasks in linux
panel_3 = Panel("ps aux | grep '<AllRadProgs>'")
logviewer = LogViewer(Number=10)  # -> CurrentTasks, Logs
default = DefaultMSS(data=flatten(panel_3), default_value_flattened=flatten(logviewer.CurrentTasks))
executessh_wip = ExecuteSSHWIP(
    _SSHCommands_=default,
    Run=Toggle(True),
    addPrefix=True,
    description="ps aux | grep '<AllRadProgs>'",
    fireLogs=False,
    lastRunTime=11.3262,
    suppressWarnings=False,
    results="""mss      15043  0.0  0.0   8620  3208 ?        Ss   22:54   0:00 bash -c export PATH=$PATH:/usr/local/radiance/bin;export RAYPATH=.:/usr/local/radiance/lib;export DISPLAY=$(ip route list default | awk '{print $3}'):0;export LIBGL_ALWAYS_INDIRECT=1;ps aux | grep '<AllRadProgs>'
mss      15048  0.0  0.0   8168   712 ?        S    22:54   0:00 grep <AllRadProgs>""",
    commands="ps aux | grep '<AllRadProgs>'")  # -> Stdout, Stderr_, Ran
python = GhPythonScript(x=executessh_wip.Stdout)  # -> a
# ---------- python: Python ----------
__author__ = "mm1013"
__version__ = "2022.08.30"

import rhinoscriptsyntax as rs

a = [l for l in x.split("\n") if "grep" not in l]
# ---------- end python ----------
panel_4 = Panel(python)
panel_5 = Panel(logviewer.CurrentTasks)

od_outdated = ColourSwatch(SwatchColor=RGBA(97, 97, 97, 150))
u_updated = ColourSwatch(SwatchColor=RGBA(208, 115, 230, 112))
toggle_2 = BooleanToggle(True)
g_general = ColourSwatch(SwatchColor=RGBA(245, 243, 237, 156))
o_outputs = ColourSwatch(SwatchColor=RGBA(160, 218, 242, 203))
s_settings = ColourSwatch(SwatchColor=RGBA(224, 145, 81, 154))
cc_core2 = ColourSwatch(SwatchColor=RGBA(230, 216, 186, 208))
y_yellow = ColourSwatch(SwatchColor=RGBA(247, 244, 64, 188))
i_inputs = ColourSwatch(SwatchColor=RGBA(125, 217, 98, 150))
c_core = ColourSwatch(SwatchColor=RGBA(235, 227, 206, 203))
r_red = ColourSwatch(SwatchColor=RGBA(242, 63, 63, 203))

brep = Brep(<brep referenced from the Rhino model>)
cross = Plane(Plane(origin=(54.95220857, 189.9057479, 110.7700015), x=(-0.3826825854, -0.9238798833, 0), y=(8.430999378e-07, -3.492225232e-07, 1)))
xy = XYPlane(Origin=pt)

# ----
# Setup globals
panel_6 = Panel("""proj
projname
projfolder""")
panel_7 = Panel("""~/simulation/boston2
boston2
/simulation/boston2""")
global_overrides = GlobalOverrides(Keys=panel_6, Values=panel_7)
panel_8 = Panel(global_overrides)

Z = UnitZ(Factor="-0.2")
area = Area(Geometry=brep)  # -> Area, Centroid
project = Project(Geometry=plan, Plane=xy)  # -> Geometry, Transform

colorgroups = CSharpScript(
    Colors=[i_inputs, s_settings, g_general, c_core, o_outputs, r_red, y_yellow, u_updated, od_outdated, cc_core2],
    Enable=toggle_2,
    Rename=Toggle(False),
    RunOnce=Button(),
    Debug=Toggle(False))  # -> out; inputs Colors: list of Color, Enable: Boolean, Rename: Boolean, RunOnce: Boolean, Debug: Boolean
# ---------- colorgroups: C# usings ----------
using System.Linq;
using System.Text;
using System.Reflection;
# ---------- colorgroups: C# ----------
    msg.Clear();


    this.Component.Message = "id: " + id.ToString();

    _debug = Debug; //Set to true to have all events printed in rhino log
    _rename = Rename;

    if (Enable)
    {
      msg.AppendFormat("Set up events on ID {0}\n", id);
      SetupDict(); // Create a dictionary of the input swatches
      SetEventHandlers(); // This would do the job.


    }
    else
    {
      RemoveEventHandlers();
    }
    if (RunOnce)
    {
      foreach(Grasshopper.Kernel.Special.GH_Group grp in Grasshopper.Instances.ActiveCanvas.Document.Objects.OfType<Grasshopper.Kernel.Special.GH_Group>())
      {
        ColorGroup(grp, null); // You decide if it should run once on all existing groups

      }
    }

    Print(msg.ToString());


    // Component setup
    Component.Description = "Set up event handlers to color groups based on prefixes such as 'in_' and 'out_'.\n"
      + "Please insert only swatcheds directly into the Colors input\n\n"
      + "MIT License. Copyright Mathias Sønderskov Schaltz 2022";
    Component.Params.Input[0].Description = "Please insert only swatcheds directly into the Colors input.\nRemember to rename them";
    Component.Params.Input[1].Description = "Toggle to run...";
    Component.Params.Input[2].Description = "Set to true if you want to automatically rename the groups and remove prefix. Default is false.";
    Component.Params.Input[3].Description = "Set to true to run it once and color all existing groups.";
    Component.Params.Input[Component.Params.Input.Count - 1].Description = "Set debug to true to get all the events printed in the rhino log";
# ---------- colorgroups: C# additional code ----------
  public static Random rnd = new Random();
  public int id = rnd.Next(0, 1000);
  StringBuilder msg = new StringBuilder();
  Dictionary<string, System.Drawing.Color> colorDict = new Dictionary<string, System.Drawing.Color>();

  bool _debug = false;
  bool _rename = false;

  public bool IdExists(int id)
  {
    IList<IGH_DocumentObject> objs = Grasshopper.Instances.ActiveCanvas.Document.Objects;
    return objs
      .OfType<IGH_Component>()
      .Where(ob => ob.NickName == this.Component.NickName)
      .Where(ob => ob.GetType().ToString() == "ScriptComponents.Component_CSNET_Script")
      .Where(ob => ob.Message == "id: " + id.ToString()).Any();

  }


  public void SetupDict()
  {
    colorDict.Clear();
    // Get all inputs to "Colors"
    IList<IGH_Param> colorSources = this.Component.Params.Input[0].Sources;
    if (colorSources.Count == 0)
    {
      throw new Exception("You forgot to setup the colors. Please input swatch components and rename them");
    }
    foreach(IGH_Param source in colorSources)
    {
      //if (source.Type.ToString() == "Grasshopper.Kernel.Types.GH_Colour")
      if (source is Grasshopper.Kernel.Special.GH_ColourSwatch)
      {
        string nickName = source.NickName.Split('_')[0].Trim() + "_";
        if(!colorDict.ContainsKey(nickName))
        {
          Grasshopper.Kernel.Special.GH_ColourSwatch swatch = (Grasshopper.Kernel.Special.GH_ColourSwatch) source;
          colorDict.Add(nickName, swatch.SwatchColour);
        }
        else
        {
          throw new Exception("Multiple swatches using the same name detected. Please rename");
        }
      }
      else
      {
        throw new Exception("Whacko! Why did you input a non-swatch into the Colors? " + source.Type.ToString());
      }

    }

    msg.AppendFormat("Set up the dictionaries with {0} colors\n", colorDict.Count);
    foreach(var pairs in colorDict)
    {
      msg.AppendFormat("{0} -> {1}\n", ("\"" + pairs.Key + "\"").PadRight(5 + colorDict.Keys.Select(k => k.Length).Max()), pairs.Value);
    }
  }

  public void SetEventHandlers()
  {

    // Always remove events first to avoid duplicates
    GrasshopperDocument.ObjectsAdded -= OnObjectsAdded;
    GrasshopperDocument.ObjectsDeleted -= OnObjectsRemoved;
    GrasshopperDocument.ObjectsDeleted -= OnDeleteThisComponent;

    // Attach events
    GrasshopperDocument.ObjectsAdded += OnObjectsAdded;
    GrasshopperDocument.ObjectsDeleted += OnObjectsRemoved;
    GrasshopperDocument.ObjectsDeleted += OnDeleteThisComponent;


    foreach(Grasshopper.Kernel.Special.GH_Group grp in GrasshopperDocument.Objects.OfType<Grasshopper.Kernel.Special.GH_Group>())
    {
      grp.ObjectChanged -= ColorGroup;
      grp.ObjectChanged += ColorGroup;

      //ColorGroup(grp, null); // Make sure to run it once
    }
    msg.AppendFormat("Added the eventhandlers on {0} existing groups and on future created groups\n", GrasshopperDocument.Objects.OfType<Grasshopper.Kernel.Special.GH_Group>().Count());
  }

  public void OnObjectsAdded(object sender, GH_DocObjectEventArgs e)
  {
    bool any = false;
    foreach (Grasshopper.Kernel.Special.GH_Group grp in e.Objects.OfType<Grasshopper.Kernel.Special.GH_Group>())
    {
      grp.ObjectChanged -= ColorGroup;
      grp.ObjectChanged += ColorGroup;
      any = true;
    }

    DebugWrite(any ? "Group Objects Added: Attaching Events to ObjectChanged" : "Objects Added - but no groups");
  }

  //Same but reversed
  public void OnObjectsRemoved(object sender, GH_DocObjectEventArgs e)
  {
    bool any = false;
    foreach (Grasshopper.Kernel.Special.GH_Group grp in e.Objects.OfType<Grasshopper.Kernel.Special.GH_Group>())
    {
      grp.ObjectChanged -= ColorGroup;
      any = true;
    }

    DebugWrite(any ? "Group Objects Removed, removing event" : "Objects Removed - although not a group");

  }



  public void RemoveEventHandlers()
  {
    GrasshopperDocument.ObjectsAdded -= OnObjectsAdded;
    GrasshopperDocument.ObjectsDeleted -= OnObjectsRemoved;


    foreach(Grasshopper.Kernel.Special.GH_Group grp in GrasshopperDocument.Objects.OfType<Grasshopper.Kernel.Special.GH_Group>())
    {
      grp.ObjectChanged -= ColorGroup;

    }
    msg.AppendFormat("Removed event handlers on document and on {0} groups\n", GrasshopperDocument.Objects.OfType<Grasshopper.Kernel.Special.GH_Group>().Count());

  }

  public void ColorGroup(object sender, EventArgs e)
  {
    if (!IdExists(id))
    {
      DebugWrite("Component not relevant. Disabling old id + " + id.ToString());
      RemoveEventHandlers();
      return;
    }

    Grasshopper.Kernel.Special.GH_Group grp = sender as Grasshopper.Kernel.Special.GH_Group;
    if (grp == null) return; //not type GH_Group
    //if (!grp.NickName.EndsWith("_")) return;

    string[] nameParts = grp.NickName.Split('_');
    if (nameParts.Length <= 1)
      return;
    string prefix = grp.NickName.Split('_')[0].Trim() + '_';

    string prefixes = String.Join(", ", colorDict.Keys.Select(k => "\"" + k + "\""));

    msg.Append("prefix " + prefix + "\n");
    if (colorDict.ContainsKey(prefix))
    {
      //if (grp.NickName.EndsWith("_"))
      grp.Colour = colorDict[prefix];
      if (_rename)
      {
        grp.NickName = grp.NickName.Replace(prefix, "");
      }

      DebugWrite("Colored " + grp.NickName);

    }
    else
    {
      DebugWrite("Group changed but not relevant: prefix " + prefix + " is not among " + prefixes);
    }

  }
  public void DebugWrite(string msg)
  {
    if (_debug)
    {
      Rhino.RhinoApp.WriteLine(String.Format("[ColGrps {0}]: {1}", id, msg));
    }
  }

  public void OnDeleteThisComponent(object sender, GH_DocObjectEventArgs e)
  {

    if (e.Objects.OfType<Grasshopper.Kernel.GH_Component>().Where(o => o.NickName == this.Component.NickName).Any())
    {
      DebugWrite("Removed template component. Removing all the eventhandlers");
      RemoveEventHandlers();
    }

  }
# ---------- end colorgroups ----------

fixparams = CSharpScript(FixOnce=Button(), Enable=toggle_2, Debug=Toggle(False))  # -> out; inputs FixOnce: Boolean, Enable: Boolean, Debug: Boolean
# ---------- fixparams: C# usings ----------
using System.Text;
using System.Linq;
using Grasshopper.Kernel.Special;
# ---------- fixparams: C# ----------
    _debug = Debug;
    _enable = Enable;
    msg.Clear();
    this.Component.Message = "id: " + id.ToString();




    if (Enable)
    {
      SetEventHandlers();
    }
    else
    {
      RemoveEventHandlers();
    }


    if (FixOnce)
    {
      FixAll();
    }

    Print(msg.ToString());

    // Component setup
    Component.Description = "Set up event handlers to change params to show nickname and not icon"
      + "\n\n"
      + "MIT License. Copyright Mathias Sønderskov Schaltz 2022";
    Component.Params.Input[0].Description = "Run me once on the document";
    Component.Params.Input[1].Description = "Toggle to enable event listener";
    Component.Params.Input[Component.Params.Input.Count - 1].Description = "Set debug to true to get all the events printed in the rhino log";
# ---------- fixparams: C# additional code ----------
  public static Random rnd = new Random();
  public int id = rnd.Next(0, 1000);
  StringBuilder msg = new StringBuilder();
  bool _debug = false;
  bool _enable = false;

  public Dictionary<IGH_ActiveObject, HashSet<GH_Group>> groupsPerObject = new Dictionary<IGH_ActiveObject, HashSet<GH_Group>>();


  public void OnObjectsAdded(object sender, GH_DocObjectEventArgs e)
  {
    if (!IdExists(id))
    {
      DebugWrite("[FixParam] Component not relevant. Disabling old id " + id.ToString());
      RemoveEventHandlers();
      return;
    }


    if(_enable)
    {
      foreach(IGH_Param par in e.Objects.OfType<IGH_Param>())
      {
        FixInputs(par);
      }
    }


  }

  public void FixAll()
  {
    //DebugWrite("Fixing all?");
    foreach(IGH_Param par in GrasshopperDocument.Objects.OfType<IGH_Param>())
    {

      FixInputs(par);
    }
  }




  public void FixInputs(IGH_ActiveObject obj)
  {



    IGH_Param par = obj as IGH_Param;
    if (par != null)
    {

      par.IconDisplayMode = GH_IconDisplayMode.name;


    }

  }


  public void SetEventHandlers()
  {

    GrasshopperDocument.ObjectsAdded -= OnObjectsAdded;
    GrasshopperDocument.ObjectsAdded += OnObjectsAdded;
    GrasshopperDocument.ObjectsDeleted -= OnDeleteThisComponent;
    GrasshopperDocument.ObjectsDeleted += OnDeleteThisComponent;
    msg.AppendFormat("Added the eventhandlers to OnObjectsAdded\n", GrasshopperDocument.Objects.OfType<Grasshopper.Kernel.Special.GH_Group>().Count());
  }

  public void RemoveEventHandlers()
  {
    GrasshopperDocument.ObjectsAdded -= OnObjectsAdded;
    GrasshopperDocument.ObjectsDeleted -= OnDeleteThisComponent;

    msg.AppendFormat("Removed wire event handlers on document\n", GrasshopperDocument.Objects.OfType<Grasshopper.Kernel.Special.GH_Group>().Count());

  }

  public void OnDeleteThisComponent(object sender, GH_DocObjectEventArgs e)
  {

    if (e.Objects.OfType<Grasshopper.Kernel.GH_Component>().Where(o => o.NickName == this.Component.NickName).Any())
    {
      DebugWrite("Removed template component. Removing all the eventhandlers");
      RemoveEventHandlers();
    }

  }

  public bool IdExists(int id)
  {
    IList<IGH_DocumentObject> objs = Grasshopper.Instances.ActiveCanvas.Document.Objects;
    return objs
      .OfType<IGH_Component>()
      .Where(ob => ob.NickName == this.Component.NickName)
      .Where(ob => ob.GetType().ToString() == "ScriptComponents.Component_CSNET_Script")
      .Where(ob => ob.Message == "id: " + id.ToString()).Any();

  }

  public void DebugWrite(string msg)
  {
    if (_debug)
    {
      Rhino.RhinoApp.WriteLine(String.Format("[FixParams {0}]: {1}", id, msg));
    }
  }
# ---------- end fixparams ----------

fixwires = CSharpScript(FixOnce=Button(), Enable=toggle_2, Debug=Toggle(False))  # -> out; inputs FixOnce: Boolean, Enable: Boolean, Debug: Boolean
# ---------- fixwires: C# ----------
    _debug = Debug;
    _enable = Enable;
    msg.Clear();
    this.Component.Message = "id: " + id.ToString();


    SetDictionary();

    if (Enable)
    {
      SetEventHandlers();
    }
    else
    {
      RemoveEventHandlers();
    }


    if (FixOnce)
    {
      FixAll();
    }

    Print(msg.ToString());
    
    // Component setup
    Component.Description = "Set up event handlers to change all wire types across groups to faint"
      + "\n\n"
      + "MIT License. Copyright Mathias Sønderskov Schaltz 2022";
    Component.Params.Input[0].Description = "Run me once on the document";
    Component.Params.Input[1].Description = "Toggle to enable event listener";
    Component.Params.Input[Component.Params.Input.Count - 1].Description = "Set debug to true to get all the events printed in the rhino log";
# ---------- fixwires: C# additional code ----------
  public static Random rnd = new Random();
  public int id = rnd.Next(0, 1000);
  StringBuilder msg = new StringBuilder();
  bool _debug = false;
  bool _enable = false;

  public Dictionary<IGH_ActiveObject, HashSet<GH_Group>> groupsPerObject = new Dictionary<IGH_ActiveObject, HashSet<GH_Group>>();


  public void OnSolutionExpired(object sender, GH_DocUndoEventArgs e)
  {
    if(_enable)
      FixAll();
  }

  public void FixAll()
  {
    //DebugWrite("Fixing all?");
    foreach(IGH_ActiveObject key in groupsPerObject.Keys.Where(k => groupsPerObject[k].Count() > 0))
    {

      FixInputs(key);
    }
  }



  public bool HasGroup(IGH_ActiveObject obj)
  {
    return groupsPerObject[obj].Count > 0;
  }


  public void FixInputs(IGH_ActiveObject obj)
  {

    if (!IdExists(id))
    {
      DebugWrite("Component not relevant. Disabling old id " + id.ToString());
      RemoveEventHandlers();
      return;
    }

    //List<List<IGH_ActiveObject>> parents = new List<List<IGH_ActiveObject>>();
    IGH_Param par = obj as IGH_Param;
    if (par != null && par.Sources != null)
    {


      IEnumerable<IGH_ActiveObject> p = par.Sources.Select(s => s.Attributes.GetTopLevel.DocObject as IGH_ActiveObject);
      //parents.Add(p);
      if(HasGroup(obj) && p.All(o => !HasGroupsInCommon(o, obj)) && par.WireDisplay != GH_ParamWireDisplay.faint)
      {
        DebugWrite("Fixing " + par.Attributes.GetTopLevel.DocObject.NickName);
        par.WireDisplay = GH_ParamWireDisplay.faint;
      }

    }

    IGH_Component comp = obj as IGH_Component;
    if (comp != null)
    {
      foreach(IGH_Param inp in comp.Params.Input)
      {

        IEnumerable<IGH_ActiveObject> p = inp.Sources.Select(i => i.Attributes.GetTopLevel.DocObject as IGH_ActiveObject);

        if(HasGroup(obj) && p.All(o => !HasGroupsInCommon(o, obj)) && inp.WireDisplay != GH_ParamWireDisplay.faint)
        {
          DebugWrite("Fixing " + inp.Attributes.GetTopLevel.DocObject.NickName);
          inp.WireDisplay = GH_ParamWireDisplay.faint;
        }
      }

    }



  }





  public void SetDictionary()
  {
    IList<IGH_DocumentObject> objects = Grasshopper.Instances.ActiveCanvas.Document.Objects.ToList();
    //Print(String.Join(", ", objects.Select(o => o.NickName)));

    groupsPerObject = objects
      .Where(o => o.GetType() != typeof(GH_Group))
      .OfType<IGH_ActiveObject>()
      .ToDictionary(o => o, o => new HashSet<GH_Group>());

    foreach(GH_Group grp in objects.OfType<GH_Group>())
    {

      foreach(IGH_ActiveObject obj in grp.ObjectsRecursive().OfType<IGH_ActiveObject>())
      {
        groupsPerObject[obj].Add(grp);

      }
    }



  }

  public bool HasGroupsInCommon(IGH_ActiveObject obj1, IGH_ActiveObject obj2)
  {
    HashSet<GH_Group> set1 = groupsPerObject[obj1];
    HashSet<GH_Group> set2 = groupsPerObject[obj2];

    set1.IntersectWith(set2);

    return set1.Any();
  }

  public void SetEventHandlers()
  {

    GrasshopperDocument.UndoStateChanged -= OnSolutionExpired;
    GrasshopperDocument.UndoStateChanged += OnSolutionExpired;
    GrasshopperDocument.ObjectsDeleted -= OnDeleteThisComponent;
    GrasshopperDocument.ObjectsDeleted += OnDeleteThisComponent;
    msg.AppendFormat("Added the eventhandlers to UndoStateChanged\n", GrasshopperDocument.Objects.OfType<Grasshopper.Kernel.Special.GH_Group>().Count());
  }

  public void RemoveEventHandlers()
  {
    GrasshopperDocument.UndoStateChanged -= OnSolutionExpired;
    GrasshopperDocument.ObjectsDeleted -= OnDeleteThisComponent;

    msg.AppendFormat("Removed wire event handlers on document\n", GrasshopperDocument.Objects.OfType<Grasshopper.Kernel.Special.GH_Group>().Count());

  }

  public void OnDeleteThisComponent(object sender, GH_DocObjectEventArgs e)
  {

    if (e.Objects.OfType<Grasshopper.Kernel.GH_Component>().Where(o => o.NickName == this.Component.NickName).Any())
    {
      DebugWrite("Removed template component. Removing all the eventhandlers");
      RemoveEventHandlers();
    }

  }

  public bool IdExists(int id)
  {
    IList<IGH_DocumentObject> objs = Grasshopper.Instances.ActiveCanvas.Document.Objects;
    return objs
      .OfType<IGH_Component>()
      .Where(ob => ob.NickName == this.Component.NickName)
      .Where(ob => ob.GetType().ToString() == "ScriptComponents.Component_CSNET_Script")
      .Where(ob => ob.Message == "id: " + id.ToString()).Any();

  }

  public void DebugWrite(string msg)
  {
    if (_debug)
    {
      Rhino.RhinoApp.WriteLine(String.Format("[FixWire {0}]: {1}", id, msg));
    }
  }
# ---------- end fixwires ----------

number_slider = Slider(0, range=-15..0)
move = Move(Geometry=project.Geometry, Motion=Z)  # -> Geometry, Transform
pl_origin = PlaneOrigin(Base=along, Origin=area.Centroid)
pl_origin_2 = PlaneOrigin(Base=cross, Origin=area.Centroid)
project_2 = Project(Geometry=cross, Plane=pl_origin_2)  # -> Geometry, Transform
project_3 = Project(Geometry=along, Plane=pl_origin)  # -> Geometry, Transform
dom = ConstructDomain(DomainStart=number_slider, DomainEnd=Slider(7, range=0..15))
dom_2 = ConstructDomain(DomainStart=number_slider, DomainEnd=Slider(7, range=0..15))
dom_3 = ConstructDomain(DomainStart=Slider(-1.49, range=-15..0), DomainEnd=Slider(5, range=0..15))

# ----
# Template methods
# By Mathias Sønderskov Schaltz 2022
# Check for updates here https://github.com/Sonderwoods/GrasshopperScribbles
panel_9 = Panel(fixwires)
panel_10 = Panel(fixparams)
panel_11 = Panel(colorgroups)

dom_4 = ConstructDomain(DomainStart=Slider(-0.106, range=-15..0), DomainEnd=Slider(3.55, range=0..15))
dom_5 = ConstructDomain(DomainStart=Slider(-0.6, range=-15..0), DomainEnd=Slider(4.382, range=0..15))
dom_6 = ConstructDomain(DomainStart=Slider(-0.711, range=-1..1), DomainEnd=Slider(4.3, range=2..5))
rectangle = Rectangle(Plane=project_3.Geometry, XSize=dom_4, YSize=dom_2, Radius=0)  # -> Rectangle, Length
rectangle_2 = Rectangle(Plane=project_2.Geometry, XSize=dom_3, YSize=dom, Radius=0)  # -> Rectangle, Length
rectangle_3 = Rectangle(Plane=project.Geometry, XSize=dom_6, YSize=dom_5, Radius=0)  # -> Rectangle, Length
logviewer_2 = LogViewer(Number=10)  # -> CurrentTasks, Logs
pln = Plane(Plane(origin=(-36.43903842, 259.3831763, 111.7766989), x=(0.9238795325, -0.3826834324, 0), y=(0.3826834324, 0.9238795325, 0)))
pln_2 = Plane(Plane(origin=(-20.82258062, 252.7695813, 111.7766989), x=(0.9238795325, -0.3826834324, 0), y=(0.3826834324, 0.9238795325, 0)))
# Log of latest(10) SSH Commands
panel_12 = Panel(logviewer_2.Logs)
pln_3 = Plane(Plane(origin=(-26.90511074, 255.2890478, 111.7766989), x=(0.9238795325, -0.3826834324, 0), y=(0.3826834324, 0.9238795325, 0)))
orient = Orient(Geometry=brep, Source=project.Geometry, Target=pln)  # -> Geometry, Transform
panel_13 = Panel("""0.2
0.2""")
# Vertex order (and normal)
# 
# source : https://www.radiance-online.org/learning/tutorials/Tutorial-ThreePhaseMethod.pdf
# FILE NAMES: *.vmx - view matrix (data)
# *.hdr - view matrix (renderings)
# *.dmx - daylight matrix
# *.skv - sky vector
# *.smx – sky matrix
# *.xml - transmission matrix (the file is xml format)
# 
# *.rad - radiance scene data
# *.oct - octree file
# *.vf - view file
# *.dat - data
# 
# source : https://www.radiance-online.org/learning/tutorials/Tutorial-ThreePhaseMethod.pdf
image = ImageSampler(
    FilePath="C:\Users\mm1013\Desktop\window normals.png",
    Filter="Colour",
    Interpolate=True,
    Umax=1,
    Umin=0,
    Vmax=1,
    Vmin=0,
    Wrap=1)  # disabled
orient_2 = Orient(Geometry=rectangle_2.Rectangle, Source=project_2.Geometry, Target=pln_3)  # -> Geometry, Transform
orient_3 = Orient(Geometry=rectangle.Rectangle, Source=project_3.Geometry, Target=pln_2)  # -> Geometry, Transform
orient_4 = Orient(Geometry=rectangle_3.Rectangle, Source=project.Geometry, Target=pln)  # -> Geometry, Transform
largest_brep = LargestBREP(window_breps=[<geometry referenced from the Rhino model> x224])
edges = BrepEdges(Brep=orient.Geometry)  # -> Naked, Interior, NonManifold

# ----
# Raytrace interior viewmatrix (VMX)
calculate_vmx_interior = LBFalseStartToggle(True)
vmx_rad_parameters = Panel("-ab 2 -ad 1024 -lw 1e-3")

# ----
# Raytrace exterior daylightmatrix (DMX)
raytrace_daylight_matrix_exterior = LBFalseStartToggle(True)
dmx_rad_parameters = Panel("-ab 3 -ad 1024 -lw 0.001")

# ----
# set path for epw file
path = FilePath("Z:\LINK IO - Parametrisk Design\Projects\NRH - Rikshospitatlet_MS_S22\Analysis of U1\02_Rhino files\02-03__Iteration_03\NOR_Oslo.Fornebu.014880_IWEC.epw")
panel_14 = Panel(path)

# ----
# grid settings
grid_size = Panel("0.3m")
vertical_offset = Panel("0.75m")
docunits = ConvertToDocumentUnits(ValueString=vertical_offset)
docunits_2 = ConvertToDocumentUnits(ValueString=grid_size)

# ----
# Prepare!
prepare_3_phase_geo_and_wea = LBFalseStartToggle(True)

# ----
# All geometry
# simulation grids (as closed curves)
panel_15 = Panel("Daylight_Inputs::*")
panel_16 = Panel("""Mesh
Polysurface
Surface
Extrusion""")

# ----
# importing from rhino layers
# Examples: (_Name_refl  OR  _Name_trans%)
# Daylight_Inputs::_Wall_50
# Daylight_Inputs::_WindowSouth_50%
# Daylight_Inputs::_Skylights_40%
# 
# For receivers (_Name_BSDF)
# Daylight_Inputs::_WindowReceiver_BSDF
# Daylight_Inputs::_Roof_BSDF
# Daylight_Inputs::_InternalGlass_BSDF
dpipeline = DynamicGeometryPipeline(
    LayerFilter=panel_15,
    TypeFilter=panel_16,
    NameFilter="*",
    GroupByLayer=False,
    GroupByType=False,
    IncludeHidden=True,
    IncludeLocked=True,
    enableFullPath=True,
    listenToAttributes=True)
dpipeline_2 = DynamicGeometryPipeline(
    LayerFilter="Daylight_Inputs::_Curves",
    TypeFilter="Curve",
    NameFilter="*",
    GroupByLayer=False,
    GroupByType=False,
    IncludeHidden=True,
    IncludeLocked=True,
    enableFullPath=True,
    listenToAttributes=True)

dam = DataDam(DataA=dpipeline, BufferDelay=10000000, BufferMode=0)
meshit2 = MeshIt2(mesh_brep=dam)
sec = MeshPlane(Mesh=meshit2, Plane=project_2.Geometry)
sec_2 = MeshPlane(Mesh=meshit2, Plane=project_3.Geometry)
sec_3 = MeshPlane(Mesh=meshit2, Plane=move.Geometry)
sec_4 = MeshPlane(Mesh=meshit2, Plane=project.Geometry)
trim = TrimWithRegion(Curve=sec, Region=rectangle_2.Rectangle)  # -> Inside, Outside
trim_2 = TrimWithRegion(Curve=sec_3, Region=rectangle_3.Rectangle)  # -> Inside, Outside
trim_3 = TrimWithRegion(Curve=sec_4, Region=rectangle_3.Rectangle)  # -> Inside, Outside
trim_4 = TrimWithRegion(Curve=sec_2, Region=rectangle.Rectangle)  # -> Inside, Outside
crv = Curve(trim.Inside)
crv_2 = Curve(trim_3.Inside)
crv_3 = Curve(trim_2.Inside)
crv_4 = Curve(trim_4.Inside)
orient_5 = Orient(Geometry=crv_3, Source=move.Geometry, Target=pln)  # -> Geometry, Transform
orient_6 = Orient(Geometry=crv_2, Source=project.Geometry, Target=pln)  # -> Geometry, Transform
orient_7 = Orient(Geometry=crv_4, Source=project_3.Geometry, Target=pln_2)  # -> Geometry, Transform
orient_8 = Orient(Geometry=crv, Source=project_2.Geometry, Target=pln_3)  # -> Geometry, Transform

# ---- group: update me
dam_2 = DataDam(DataA=dpipeline, DataB=dpipeline_2, BufferDelay=10000000, BufferMode=0)  # -> DataA, DataB

# ----
# importing from rhino layers
geo = Geometry(dam_2.DataA)
geo_2 = Geometry(dam_2.DataB)
objatts = ObjectAttributes(ObjectOrAttributes=geo)  # -> Name, LayerName, LayerFullPath, Color, MaterialName, LinetypeName, GroupIndices, PlotWeight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
objatts_2 = ObjectAttributes(ObjectOrAttributes=geo_2)  # -> Name, LayerName, LayerFullPath, Color, MaterialName, LinetypeName, GroupIndices, PlotWeight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
cset = CreateSet(List=objatts.LayerName)  # -> Set, Map
cset_2 = CreateSet(List=objatts_2.LayerName)  # -> Set, Map
assign_paths = AssignPaths(InputData=flatten(geo), PathsToAssign=flatten(cset.Map))
assign_paths_2 = AssignPaths(InputData=flatten(geo_2), PathsToAssign=flatten(cset_2.Map))
python_2 = GhPythonScript(layer_name=graft(cset.Set))  # -> is_opaque, is_transparent, is_grid, is_HB_Room, is_HB_Window, is_receiver
# ---------- python_2: Python ----------
__author__ = "mm1013"
__version__ = "2022.01.16"

import rhinoscriptsyntax as rs

is_grid = layer_name == "Grids" or layer_name == "_Curves"

if layer_name.startswith("HB_"):
    is_opaque = is_transparent = is_grid = False
    
    is_HB_Window = layer_name.endswith("%")
    is_HB_Room = layer_name == "HB_Rooms"
    
    
else:
    if is_grid:
        is_opaque = False
        is_transparent = False
        is_receiver = False
    else:
        is_receiver = layer_name.endswith("_BSDF")
        is_transparent = layer_name.endswith("%")
        if is_transparent:
            transmittance = layer_name.split("_")[-1].replace("%","")
        is_opaque = not is_transparent and not is_receiver
# ---------- end python_2 ----------
python_3 = GhPythonScript(layer_name=graft(cset_2.Set))  # -> is_opaque, is_transparent, is_grid, is_HB_Room, is_HB_Window
# ---------- python_3: Python ----------
__author__ = "mm1013"
__version__ = "2022.01.16"

import rhinoscriptsyntax as rs

is_grid = layer_name == "Grids" or layer_name == "_Curves"

if layer_name.startswith("HB_"):
    is_opaque = is_transparent = is_grid = False
    
    is_HB_Window = layer_name.endswith("%")
    is_HB_Room = layer_name == "HB_Rooms"
    
    
else:
    if is_grid:
        is_opaque = False
        is_transparent = False
    else:
        is_transparent = layer_name.endswith("%")
        if is_transparent:
            transmittance = layer_name.split("_")[-1].replace("%","")
        is_opaque = not is_transparent
# ---------- end python_3 ----------
layer_name = Text(cset_2.Set)
layer_name_2 = Text(cset.Set)
geo_3 = Geometry(assign_paths_2)
geo_4 = Geometry(assign_paths)

# ----
# Glass geometries
cull = CullPattern(List=geo_4, CullPattern=python_2.is_transparent)
cull_2 = CullPattern(List=graft(layer_name_2), CullPattern=graft(python_2.is_transparent))  # -> simplify(List)
python_4 = GhPythonScript(layer_name=cull_2)  # -> out, transmittance, name
# ---------- python_4: Python ----------
__author__ = "mm1013"
__version__ = "2022.01.16"

import rhinoscriptsyntax as rs

try:
    transmittance = layer_name.split("_")[-1].replace("%","")
    name = layer_name.replace("%","")
except:
    transmittance = None
    name = None
# ---------- end python_4 ----------
clean = CleanTree(
    RemoveNulls=True,
    RemoveInvalid=True,
    RemoveEmpty=True,
    Tree=simplify(cull),
    SynchronousTree1=simplify(python_4.name),
    SynchronousTree2=simplify(python_4.transmittance))  # -> Tree, SynchronousTree1, SynchronousTree2
meshit2_2 = MeshIt2(mesh_brep=graft(clean.Tree))
name = Text(clean.SynchronousTree1)
unflatten = UnflattenTree(Tree=meshit2_2, Guide=clean.Tree)
panel_17 = Panel(name)
geo_5 = Geometry(unflatten)
meshit2_3 = MeshIt2(mesh_brep=geo_5)
transmittance = Number(expr("x/100", clean.SynchronousTree2))
concat = Concatenate(FragmentA=name, FragmentB="_mat")
mesh = Mesh(meshit2_3)

# ----
# opaque geometries
cull_3 = CullPattern(List=graft(layer_name_2), CullPattern=graft(python_2.is_opaque))  # -> simplify(List)
cull_4 = CullPattern(List=geo_4, CullPattern=graft(python_2.is_opaque))  # -> simplify(List)
python_5 = GhPythonScript(layer_name=cull_3)  # -> out, reflectance
# ---------- python_5: Python ----------
__author__ = "mm1013"
__version__ = "2022.01.16"

import rhinoscriptsyntax as rs
try:
    reflectance = layer_name.split("_")[-1]
    
except:
    reflectance = None
# ---------- end python_5 ----------
clean_2 = CleanTree(
    RemoveNulls=True,
    RemoveInvalid=True,
    RemoveEmpty=True,
    Tree=cull_3,
    SynchronousTree1=cull_4,
    SynchronousTree2=python_5.reflectance)  # -> Tree, SynchronousTree1, SynchronousTree2
geo_6 = Geometry(clean_2.SynchronousTree1)
refl = Number(clean_2.SynchronousTree2)
name_2 = Text(clean_2.Tree)
meshit2_4 = MeshIt2(mesh_brep=geo_6)
concat_2 = Concatenate(FragmentA=name_2, FragmentB="_mat")

# ----
# Grid
cull_5 = CullPattern(List=graft(layer_name), CullPattern=graft(python_3.is_grid))  # -> simplify(List)
cull_6 = CullPattern(List=graft(layer_name_2), CullPattern=graft(python_2.is_grid))  # -> simplify(List)
cull_7 = CullPattern(List=geo_3, CullPattern=python_3.is_grid)  # -> simplify(List)
cull_8 = CullPattern(List=geo_4, CullPattern=python_2.is_grid)
clean_3 = CleanTree(RemoveNulls=True, RemoveInvalid=True, RemoveEmpty=True, Tree=cull_6, SynchronousTree1=simplify(cull_8))  # -> Tree, flatten(SynchronousTree1)
clean_4 = CleanTree(RemoveNulls=True, RemoveInvalid=True, RemoveEmpty=True, Tree=cull_5, SynchronousTree1=simplify(cull_7))  # -> Tree, SynchronousTree1
boundary = BoundarySurfaces(Edges=clean_4.SynchronousTree1)  # -> flatten(Surfaces)
geo_7 = Geometry(flatten([clean_3.SynchronousTree1, boundary]))
geo_8 = Geometry(graft(geo_7))

# ----
# Paths
panel_18 = Panel("<projfolder>/radFiles")
overrides = ApplyOverrides(Input=panel_18)  # -> Output, Pairs
overrides_2 = ApplyOverrides(Input="<projfolder>")  # -> Output, Pairs
concat_3 = Concatenate(FragmentA=overrides_2.Output, FragmentB="/obj")

# ----
# room numbers
lng = ListLength(List=geo_8)
series = Series(Start=0, Step=1, Count=lng)  # -> graft(Series)
roomnumber = Text(series)
room_numbers = Panel(roomnumber)

cull_9 = CullPattern(List=graft(layer_name_2), CullPattern=graft(python_2.is_receiver))  # -> simplify(List)
cull_10 = CullPattern(List=geo_4, CullPattern=graft(python_2.is_receiver))  # -> simplify(List)
cull_11 = CullPattern(List=graft(layer_name_2), CullPattern=graft(python_2.is_receiver))  # -> simplify(List)
clean_5 = CleanTree(
    RemoveNulls=True,
    RemoveInvalid=True,
    RemoveEmpty=True,
    Tree=cull_9,
    SynchronousTree1=cull_10,
    SynchronousTree2=python_5.reflectance,
    SynchronousTree3=cull_11)  # -> Tree, SynchronousTree1, SynchronousTree2, SynchronousTree3
geo_9 = Geometry(clean_5.SynchronousTree1)
layer = Text(clean_5.SynchronousTree3)
name_3 = Text(clean_5.Tree)
long = LongestList(ListD=name_3, ListA=geo_9, ListB=layer, PaddingMode=2)  # -> ListD, ListA, ListB
name_4 = Text(long.ListD)
geo_10 = Geometry(long.ListA)
layer_2 = Text(long.ListB)

# ----
# Grid
# Setting up grid points
geo_11 = Geometry(graft(geo_8))
vertical_offset_2 = Panel(docunits)
grid_size_2 = Panel(docunits_2)
rectangle_4 = Rectangle(Plane=PlaneXY(0, 0, 0), XSize=Domain(-1, 1), YSize=Domain(-2, 2), Radius=0)  # -> Rectangle, Length
flip = Flip(Surface=geo_11, Guide=rectangle_4.Rectangle)  # -> Surface, Result
grid_size_3 = Number(grid_size_2)
offset = Number(vertical_offset_2)
custom_mesh_settings = SettingsCustom(
    StitchSeams=True,
    SimplePlanes=False,
    Refine=True,
    MinCount=16,
    MaxCount=400,
    AspectRatio=20,
    MaxDistance=0,
    MaxAngle=20,
    MinEdge=grid_size_3,
    MaxEdge=grid_size_3)
normals = Normals(geo=flip.Surface, amplitude=offset)  # -> center_2, norm_2, P
mesh_2 = MeshBrep(Brep=flip.Surface, Settings=custom_mesh_settings)
move_2 = Move(Geometry=mesh_2, Motion=normals.norm_2)  # -> Geometry, Transform
facen = FaceNormals(Mesh=move_2.Geometry)  # -> Centers, Normals

bsdf_name = Panel("_GlassLT_70%")
bsdf_name_2 = Panel("_GlassLT_70%")

# ----
# genblinds
panel_19 = Panel("""mkdir -p <LinuxHome>/BSDF_Files/<projname>_radFiles
genblinds blindmat blind 0.08 1 2 28 20 +r 0.12 | xform -rz -90 -rx -90 -t 0 0 -0.15 > <LinuxHome>/BSDF_Files/<projname>_radFiles/<target>.rad;echo <LinuxHome>/BSDF_Files/<projname>_radFiles/<target>.rad""")
blindsname = Panel("blinds_001")
include_the_genblinds_result_in_the_bsdf = ValueList({"no": False, "yes": True}, selected="yes")

# ----
# genblinds
name_5 = Panel(blindsname)
overrides_3 = ApplyOverrides(Input_=panel_19, Target=graft(name_5))  # -> Output, Pairs
bool = Boolean(include_the_genblinds_result_in_the_bsdf)
executessh = ExecuteSSH(
    _SSHCommands_=overrides_3.Output,
    Run=bool,
    addPrefix=True,
    description="""mkdir -p ~/simulation/BSDF_Files/boston2_radFiles
genblinds blindmat blind 0.08 1 2 28 20 +r 0.12 | xform -rz -90 -rx -90 -t 0 0 -0.15 > ~/simulation/BSDF_Files/boston2_radFiles/blinds_001.rad;echo ~/simulation/BSDF_Files/boston2_radFiles/blinds_001.rad""",
    fireLogs=False,
    lastRunTime=7.7501,
    suppressWarnings=False,
    results="/home/mss/simulation/BSDF_Files/boston2_radFiles/blinds_001.rad",
    commands="""mkdir -p ~/simulation/BSDF_Files/boston2_radFiles
genblinds blindmat blind 0.08 1 2 28 20 +r 0.12 | xform -rz -90 -rx -90 -t 0 0 -0.15 > ~/simulation/BSDF_Files/boston2_radFiles/blinds_001.rad;echo ~/simulation/BSDF_Files/boston2_radFiles/blinds_001.rad""")  # -> Stdout, Stderr_, Ran
blindsname_2 = Text(name_5)
cull_12 = CullPattern(List=executessh.Stdout, CullPattern=bool)
cull_13 = CullPattern(List=blindsname_2, CullPattern=bool)
blindsradfile = Text(cull_12)
blindsname_3 = Text(cull_13)

# ----
# pick between existing BSDF
# files from library!
panel_20 = Panel("find <LinuxHome>/BSDF_Files/ -type f -name \"<p>*.xml\"")
filter = ValueList({"None": "awodkwa", "This project only": "<projname>", "All projects": ""}, selected="All projects")
overrides_4 = ApplyOverrides(Input_=panel_20, Text=filter)  # -> Output, Pairs
executessh_wip_2 = ExecuteSSHWIP(
    _SSHCommands_=overrides_4.Output,
    Run=Toggle(True),
    addPrefix=True,
    description="find ~/simulation/BSDF_Files/ -type f -name \"*.xml\"",
    fireLogs=False,
    lastRunTime=12.2076,
    suppressWarnings=False,
    results="""/home/mss/simulation/BSDF_Files/8mm MS-F 6014 Rot 90.xml
/home/mss/simulation/BSDF_Files/boston2_8mm_MS-F_6014_Rot_90.xml
/home/mss/simulation/BSDF_Files/boston2_blinds_001_GlassLT_70.xml""",
    commands="find ~/simulation/BSDF_Files/ -type f -name \"*.xml\"")  # -> Stdout, Stderr_, Ran
split = TextSplit(Text=executessh_wip_2.Stdout)
grep_filter = Panel("")
panel_21 = Panel(split)
overrides_5 = ApplyOverrides(Input="echo <in> | grep \"<grep>\"", in=graft(split), grep=grep_filter)  # -> Output, Pairs
executessh_wip_3 = ExecuteSSHWIP(
    _SSHCommands_=flatten(overrides_5.Output),
    Run=executessh_wip_2.Ran,
    addPrefix=True,
    description="""echo /home/mss/simulation/BSDF_Files/8mm MS-F 6014 Rot 90.xml | grep ""
echo /home/mss/simulation/BSDF_Files/boston2_8mm_MS-F_6014_Rot_90.xml | grep ""
echo /home/mss/simulation/BSDF_Files/boston2_blinds_001_GlassLT_70.xml | grep ""
""",
    fireLogs=False,
    lastRunTime=7.5235,
    suppressWarnings=False,
    results="""/home/mss/simulation/BSDF_Files/8mm MS-F 6014 Rot 90.xml
_JOIN_
/home/mss/simulation/BSDF_Files/boston2_8mm_MS-F_6014_Rot_90.xml
_JOIN_
/home/mss/simulation/BSDF_Files/boston2_blinds_001_GlassLT_70.xml""",
    commands="""echo /home/mss/simulation/BSDF_Files/8mm MS-F 6014 Rot 90.xml | grep ""
_JOIN_
echo /home/mss/simulation/BSDF_Files/boston2_8mm_MS-F_6014_Rot_90.xml | grep ""
_JOIN_
echo /home/mss/simulation/BSDF_Files/boston2_blinds_001_GlassLT_70.xml | grep ""
""")  # -> Stdout, Stderr_, Ran
cluster = Cluster_5(x=executessh_wip_3.Stdout)  # -> bsdf_name, bsdf_path
bsdf = BSDF(bsdf_name=graft(cluster.bsdf_name), bsdf_file_path_linux=graft(cluster.bsdf_path))
panel_22 = Panel(cluster.bsdf_path)
dam_3 = DataDam(DataA=bsdf, BufferDelay=10000000, BufferMode=0)
panel_23 = Panel(bsdf)

# ----
# import BSDFS
# use me if you want to upload a BSDF
# file from windows and use.
# 
# Have in mind that the BSDF should
# be combined of glass and shading
panel_24 = Panel("C:\Users\mm1013\Downloads\8mm MS-F 6014 Rot 90.xml")
overrides_6 = ApplyOverrides(Input_="<LinuxHome>/")  # -> Output, Pairs
falsestart = LBFalseStartToggle(True)
cluster_2 = Cluster_4(x=overrides_6.Output)
panel_25 = Panel("""mkdir -p <LinuxHome>/BSDF_Files
cp <bsdfFrom> <LinuxHome>/BSDF_Files/<projname>_<bsdfTo>
rm <bsdfFrom>
echo <LinuxHome>/BSDF_Files/<projname>_<bsdfTo>""")
upload = Upload(LocalFilePaths=panel_24, SubfolderOverride=cluster_2, Run=falsestart, stdouts="~/simulation/8mm MS-F 6014 Rot 90.xml")  # -> Status, FilePaths, Ran
python_6 = GhPythonScript(x=upload.FilePaths)  # -> a
# ---------- python_6: Python ----------
__author__ = "mm1013"
__version__ = "2022.09.09"

import rhinoscriptsyntax as rs

a = x = x.replace(" ","\ ")
# ---------- end python_6 ----------
python_7 = GhPythonScript(x=upload.FilePaths)  # -> a
# ---------- python_7: Python ----------
__author__ = "mm1013"
__version__ = "2022.09.09"

import rhinoscriptsyntax as rs

a = x.split("/")[-1].replace(" ","_")
# ---------- end python_7 ----------
overrides_7 = ApplyOverrides(Input_=panel_25, BsdfFrom=graft(python_6), BsdfTo=graft(python_7))  # -> Output, Pairs
executessh_wip_4 = ExecuteSSHWIP(
    _SSHCommands_=overrides_7.Output,
    Run=upload.Ran,
    addPrefix=True,
    description="""mkdir -p ~/simulation/BSDF_Files
cp ~/simulation/8mm\ MS-F\ 6014\ Rot\ 90.xml ~/simulation/BSDF_Files/boston2_8mm_MS-F_6014_Rot_90.xml
rm ~/simulation/8mm\ MS-F\ 6014\ Rot\ 90.xml
echo ~/simulation/BSDF_Files/boston2_8mm_MS-F_6014_Rot_90.xml""",
    fireLogs=False,
    lastRunTime=8.1194,
    suppressWarnings=False,
    results="/home/mss/simulation/BSDF_Files/boston2_8mm_MS-F_6014_Rot_90.xml",
    commands="""mkdir -p ~/simulation/BSDF_Files
cp ~/simulation/8mm\ MS-F\ 6014\ Rot\ 90.xml ~/simulation/BSDF_Files/boston2_8mm_MS-F_6014_Rot_90.xml
rm ~/simulation/8mm\ MS-F\ 6014\ Rot\ 90.xml
echo ~/simulation/BSDF_Files/boston2_8mm_MS-F_6014_Rot_90.xml""")  # -> Stdout, Stderr_, Ran
cluster_3 = Cluster_5(x=executessh_wip_4.Stdout)  # -> bsdf_name, bsdf_path
bsdf_2 = BSDF(bsdf_name=cluster_3.bsdf_name, bsdf_file_path_linux=cluster_3.bsdf_path)

bsdf_3 = BSDF(bsdf_name="LT70", bsdf_file_path_linux="~/simulation/boston2/BSDF/blinds_001__GlassTak_70_mat.xml")

bsdf_4 = BSDF(bsdf_name="MicroShade_SingleGlass", bsdf_file_path_linux="~/simulation/boston2/8mm MS-F 6014 Rot 90.xml")

bsdf_5 = BSDF_2(bsdf_pairs=dam_3)  # -> name_2, path_2
folder_exists = Panel("[ -f <proj> ] && echo \"1\" || echo \"0\"")
falsestart_2 = LBFalseStartToggle(False)

panel_26 = Panel("""0
0
0
0
0
0
0
0
1
1
1
1
1
1
1
1
1
1
0
0
0
0
0
0""")
int = Integer(panel_26)
dup = DuplicateData(Data=int, Number="365", Order=True)

pln_4 = Plane(Plane(origin=(52.07522972, 186.3890272, 115.72), x=(0.9238795325, -0.3826834324, 0), y=(0.3826834324, 0.9238795325, 0)))

# ----
# Prepare 3phase stuff
prep_3ph = Boolean(prepare_3_phase_geo_and_wea)

# ----
# create working directory
panel_27 = Panel("""mkdir -p <proj>
mkdir -p <proj>/obj
echo <proj>""")
overrides_8 = ApplyOverrides(Input_=panel_27)  # -> Output, Pairs
executessh_2 = ExecuteSSH(
    _SSHCommands_=overrides_8.Output,
    Run=prep_3ph,
    addPrefix=True,
    description="""mkdir -p ~/simulation/boston2
mkdir -p ~/simulation/boston2/obj
echo ~/simulation/boston2""",
    fireLogs=True,
    lastRunTime=9.446,
    name="Create workingdir",
    suppressWarnings=False,
    results="/home/mss/simulation/boston2",
    commands="""mkdir -p ~/simulation/boston2
mkdir -p ~/simulation/boston2/obj
echo ~/simulation/boston2""")  # -> Stdout, Stderr_, Ran

# ----
# Skydome
# The skydome is generic and not dependent on EPW etc.
panel_28 = Panel("""mkdir -p <proj>/radFiles;
echo "<skyrad>" > <proj>/radFiles/skyglow_3ph.rad
echo "<proj>/radFiles/skyglow_3ph.rad"
""")
panel_29 = Panel("""#@rfluxmtx h=r1 u=+Y
void glow sky_glow
0
0
4 1 1 1 0
sky_glow source sky
0
0
4 0 0 1 180
#@rfluxmtx h=u u=+Y
void glow ground_glow
0
0
4 1 1 1 0
ground_glow source ground
0
0
4 0 0 -1 180""")
overrides_9 = ApplyOverrides(Input_=panel_28, Skyrad=graft(panel_29))  # -> Output, Pairs
executessh_3 = ExecuteSSH(
    _SSHCommands_=overrides_9.Output,
    Run=prep_3ph,
    addPrefix=True,
    description="""mkdir -p ~/simulation/boston2/radFiles;
echo "#@rfluxmtx h=r1 u=+Y
void glow sky_glow
0
0
4 1 1 1 0
sky_glow source sky
0
0
4 0 0 1 180
#@rfluxmtx h=u u=+Y
void glow ground_glow
0
0
4 1 1 1 0
ground_glow source ground
0
0
4 0 0 -1 180" > ~/simulation/boston2/radFiles/skyglow_3ph.rad
echo "~/simulation/boston2/radFiles/skyglow_3ph.rad"
""",
    fireLogs=False,
    lastRunTime=9.9595,
    suppressWarnings=False,
    results="~/simulation/boston2/radFiles/skyglow_3ph.rad",
    commands="""mkdir -p ~/simulation/boston2/radFiles;
echo "#@rfluxmtx h=r1 u=+Y
void glow sky_glow
0
0
4 1 1 1 0
sky_glow source sky
0
0
4 0 0 1 180
#@rfluxmtx h=u u=+Y
void glow ground_glow
0
0
4 1 1 1 0
ground_glow source ground
0
0
4 0 0 -1 180" > ~/simulation/boston2/radFiles/skyglow_3ph.rad
echo "~/simulation/boston2/radFiles/skyglow_3ph.rad"
""")  # -> Stdout, Stderr_, Ran
skydome = Panel(executessh_3.Stdout)
skyglow = Text(executessh_3.Stdout)

# ----
# Non bsdf glass modifiers (materials)
panel_30 = Panel("<mat>.mat")
python_8 = GhPythonScript(matname=concat)  # -> filename
# ---------- python_8: Python ----------
__author__ = "mm1013"
__version__ = "2022.07.06"

import rhinoscriptsyntax as rs

filename = matname.replace(" ","_").replace(".","_")
# ---------- end python_8 ----------
glassmat = GlassMat(Name=concat, Transmittance_0_1=transmittance)  # -> RadMaterials, RadMaterialList
panel_31 = Panel("echo \"<mats>\" > <proj>/radFiles/<target>;echo \"<proj>/radFiles/<target>\"")
overrides_10 = ApplyOverrides(Input_=panel_30, Mat=graft(python_8))  # -> Output, Pairs
overrides_11 = ApplyOverrides(Input_=panel_31, Mats=graft(glassmat.RadMaterials), Target=graft(overrides_10.Output))  # -> Output, Pairs
executessh_wip_5 = ExecuteSSHWIP(
    _SSHCommands_=overrides_11.Output,
    Run=executessh_2.Ran,
    addPrefix=True,
    description="""echo "void glass _GlassFacade_74_mat
0
0
3 0.806 0.806 0.806" > ~/simulation/boston2/radFiles/_GlassFacade_74_mat.mat;echo "~/simulation/boston2/radFiles/_GlassFacade_74_mat.mat"


- - -

echo "void glass _GlassInt1_74_mat
0
0
3 0.806 0.806 0.806" > ~/simulation/boston2/radFiles/_GlassInt1_74_mat.mat;echo "~/simulation/boston2/radFiles/_GlassInt1_74_mat.mat"


- - -

echo "void glass _GlassTak_70_mat
0
0
3 0.763 0.763 0.763" > ~/simulation/boston2/radFiles/_GlassTak_70_mat.mat;echo "~/simulation/boston2/radFiles/_GlassTak_70_mat.mat"
""",
    fireLogs=True,
    lastRunTime=49.0668,
    name="glassMats",
    suppressWarnings=False,
    results=["~/simulation/boston2/radFiles/_GlassFacade_74_mat.mat", "~/simulation/boston2/radFiles/_GlassInt1_74_mat.mat", "~/simulation/boston2/radFiles/_GlassTak_70_mat.mat"],
    commands=["""echo "void glass _GlassFacade_74_mat
0
0
3 0.806 0.806 0.806" > ~/simulation/boston2/radFiles/_GlassFacade_74_mat.mat;echo "~/simulation/boston2/radFiles/_GlassFacade_74_mat.mat"
""", """echo "void glass _GlassInt1_74_mat
0
0
3 0.806 0.806 0.806" > ~/simulation/boston2/radFiles/_GlassInt1_74_mat.mat;echo "~/simulation/boston2/radFiles/_GlassInt1_74_mat.mat"
""", """echo "void glass _GlassTak_70_mat
0
0
3 0.763 0.763 0.763" > ~/simulation/boston2/radFiles/_GlassTak_70_mat.mat;echo "~/simulation/boston2/radFiles/_GlassTak_70_mat.mat"
"""])  # -> Stdout, Stderr_, Ran
glass_modifiers = Text(executessh_wip_5.Stdout)

# ----
# opaque modifiers (materials)
panel_32 = Panel("echo \"<mats>\" > <proj>/radFiles/<target>;echo \"<proj>/radFiles/<target>\"")
opaquegreymat = OpaqueGreyMat(Name=concat_2, Reflectance_0_1=refl, Specularity=0, Roughness=0)  # -> flatten(RadMaterials), RadMaterialList
join = TextJoin(Text=opaquegreymat.RadMaterials)
overrides_12 = ApplyOverrides(Input_=panel_32, Mats=graft(join), Target=graft("opaque_materials.mat"))  # -> Output, Pairs
executessh_wip_6 = ExecuteSSHWIP(
    _SSHCommands_=overrides_12.Output,
    Run=executessh_2.Ran,
    addPrefix=True,
    description="""echo "void plastic _Skylight_Vers1_70_mat
0
0
5 0.700 0.700 0.700 0.000 0.000
void plastic _SlabCeiling_80_mat
0
0
5 0.800 0.800 0.800 0.000 0.000
void plastic _Ground_30_mat
0
0
5 0.300 0.300 0.300 0.000 0.000
void plastic _SlabFloor_30_mat
0
0
5 0.300 0.300 0.300 0.000 0.000
void plastic _WallExt_50_mat
0
0
5 0.500 0.500 0.500 0.000 0.000
void plastic _WallInt_70_mat
0
0
5 0.700 0.700 0.700 0.000 0.000
void plastic _ContextMat_30_mat
0
0
5 0.300 0.300 0.300 0.000 0.000
void plastic _FacadeDark_30_mat
0
0
5 0.300 0.300 0.300 0.000 0.000
void plastic _FramesCW_50_mat
0
0
5 0.500 0.500 0.500 0.000 0.000
void plastic _Frames_50_mat
0
0
5 0.500 0.500 0.500 0.000 0.000
void plastic _Roofs_50_mat
0
0
5 0.500 0.500 0.500 0.000 0.000
void plastic _SkylightWall_70_mat
0
0
5 0.700 0.700 0.700 0.000 0.000
void plastic _Frames1_50_mat
0
0
5 0.500 0.500 0.500 0.000 0.000
void plastic _WallInt1_70_mat
0
0
5 0.700 0.700 0.700 0.000 0.000
void plastic _HRRoof1_80_mat
0
0
5 0.800 0.800 0.800 0.000 0.000
void plastic _SlabJ_50_mat
0
0
5 0.500 0.500 0.500 0.000 0.000
void plastic _SlabWall_50_mat
0
0
5 0.500 0.500 0.500 0.000 0.000
void plastic _Doors_50_mat
0
0
5 0.500 0.500 0.500 0.000 0.000" > ~/simulation/boston2/radFiles/opaque_materials.mat;echo "~/simulation/boston2/radFiles/opaque_materials.mat"
""",
    fireLogs=True,
    lastRunTime=11.9971,
    name="opaqueMats",
    suppressWarnings=False,
    results="~/simulation/boston2/radFiles/opaque_materials.mat",
    commands="""echo "void plastic _Skylight_Vers1_70_mat
0
0
5 0.700 0.700 0.700 0.000 0.000
void plastic _SlabCeiling_80_mat
0
0
5 0.800 0.800 0.800 0.000 0.000
void plastic _Ground_30_mat
0
0
5 0.300 0.300 0.300 0.000 0.000
void plastic _SlabFloor_30_mat
0
0
5 0.300 0.300 0.300 0.000 0.000
void plastic _WallExt_50_mat
0
0
5 0.500 0.500 0.500 0.000 0.000
void plastic _WallInt_70_mat
0
0
5 0.700 0.700 0.700 0.000 0.000
void plastic _ContextMat_30_mat
0
0
5 0.300 0.300 0.300 0.000 0.000
void plastic _FacadeDark_30_mat
0
0
5 0.300 0.300 0.300 0.000 0.000
void plastic _FramesCW_50_mat
0
0
5 0.500 0.500 0.500 0.000 0.000
void plastic _Frames_50_mat
0
0
5 0.500 0.500 0.500 0.000 0.000
void plastic _Roofs_50_mat
0
0
5 0.500 0.500 0.500 0.000 0.000
void plastic _SkylightWall_70_mat
0
0
5 0.700 0.700 0.700 0.000 0.000
void plastic _Frames1_50_mat
0
0
5 0.500 0.500 0.500 0.000 0.000
void plastic _WallInt1_70_mat
0
0
5 0.700 0.700 0.700 0.000 0.000
void plastic _HRRoof1_80_mat
0
0
5 0.800 0.800 0.800 0.000 0.000
void plastic _SlabJ_50_mat
0
0
5 0.500 0.500 0.500 0.000 0.000
void plastic _SlabWall_50_mat
0
0
5 0.500 0.500 0.500 0.000 0.000
void plastic _Doors_50_mat
0
0
5 0.500 0.500 0.500 0.000 0.000" > ~/simulation/boston2/radFiles/opaque_materials.mat;echo "~/simulation/boston2/radFiles/opaque_materials.mat"
""")  # -> Stdout, Stderr_, Ran
opaque_mat = Text(executessh_wip_6.Stdout)

# ----
# Window (non BSDF) geometry
panel_33 = Panel("mapping_windows")
mesh2obj = MeshToObj(
    Mesh=mesh,
    Name=graft(name),
    MapFileName=panel_33,
    ModifierName=graft(concat),
    SubfolderOverride=concat_3,
    Run=executessh_2.Ran)  # -> ObjFiles, MapFile, Run
obj2rad = ObjToRad(
    ObjFiles=mesh2obj.ObjFiles,
    MapFile=mesh2obj.MapFile,
    SubfolderOverride=overrides.Output,
    Run=mesh2obj.Run,
    stdouts="~/simulation/boston2/radFiles/_GlassTak_70.rad>JOIN<~/simulation/boston2/radFiles/_GlassInt1_74.rad>JOIN<~/simulation/boston2/radFiles/_GlassFacade_74.rad")  # -> Status, RadFiles, Run
panel_34 = Panel(obj2rad.RadFiles)
window_rad = Text(obj2rad.RadFiles)

# ----
# Opaque geometry
mesh_3 = Mesh(meshit2_4)
names = Text(name_2)
modnames = Text(concat_2)
mesh2obj_2 = MeshToObj(
    Mesh=mesh_3,
    Name=graft(names),
    MapFileName="mapping_opaque",
    ModifierName=graft(modnames),
    SubfolderOverride=concat_3,
    Run=executessh_2.Ran)  # -> ObjFiles, MapFile, Run
obj2rad_2 = ObjToRad(
    ObjFiles=mesh2obj_2.ObjFiles,
    MapFile=mesh2obj_2.MapFile,
    SubfolderOverride=overrides.Output,
    Run=mesh2obj_2.Run,
    stdouts="~/simulation/boston2/radFiles/_Doors_50.rad>JOIN<~/simulation/boston2/radFiles/_SlabWall_50.rad>JOIN<~/simulation/boston2/radFiles/_SlabJ_50.rad>JOIN<~/simulation/boston2/radFiles/_HRRoof1_80.rad>JOIN<~/simulation/boston2/radFiles/_WallInt1_70.rad>JOIN<~/simulation/boston2/radFiles/_Frames1_50.rad>JOIN<~/simulation/boston2/radFiles/_SkylightWall_70.rad>JOIN<~/simulation/boston2/radFiles/_Roofs_50.rad>JOIN<~/simulation/boston2/radFiles/_Frames_50.rad>JOIN<~/simulation/boston2/radFiles/_FramesCW_50.rad>JOIN<~/simulation/boston2/radFiles/_FacadeDark_30.rad>JOIN<~/simulation/boston2/radFiles/_ContextMat_30.rad>JOIN<~/simulation/boston2/radFiles/_WallInt_70.rad>JOIN<~/simulation/boston2/radFiles/_WallExt_50.rad>JOIN<~/simulation/boston2/radFiles/_SlabFloor_30.rad>JOIN<~/simulation/boston2/radFiles/_Ground_30.rad>JOIN<~/simulation/boston2/radFiles/_SlabCeiling_80.rad>JOIN<~/simulation/boston2/radFiles/_Skylight_Vers1_70.rad")  # -> Status, RadFiles, Run
panel_35 = Panel(obj2rad_2.RadFiles)
opaque_rad = Text(obj2rad_2.RadFiles)

# ----
# grid points
pt_2 = Point(facen.Centers)
vec = Vector(facen.Normals)
overrides_13 = ApplyOverrides(Input="<projfolder>")  # -> Output, Pairs
concat_4 = Concatenate(FragmentA=overrides_13.Output, FragmentB="/points")
points2pts = PointsToPts(Points=pt_2, Vectors=vec, Name=roomnumber, SubfolderOverride=concat_4, Run=executessh_2.Ran)  # -> PtsFile, Run
ptsfile = Text(points2pts.PtsFile)

# ----
# octrees for opaques (3ph)
# This octree contains all glass and opaque,
# but NOT the receivers on the BSDF layers.
opaque_mat_2 = Text(opaque_mat)
opaque_rad_2 = Text(opaque_rad)
window_mat = Text(glass_modifiers)
window_rad_2 = Text(window_rad)
panel_36 = Panel("""mkdir -p <proj>/octrees
oconv -w -f <rads> > <proj>/octrees/<target>.oct;echo <proj>/octrees/<target>.oct""")
entwine = Entwine(Branch00=opaque_mat_2, Branch01=opaque_rad_2, Branch02=window_mat, Branch03=window_rad_2, FlattenInputs=True)  # -> flatten(Result)
join_2 = TextJoin(Text=flatten(entwine), Join=" ")
overrides_14 = ApplyOverrides(Input_=panel_36, Rads=graft(join_2), Target=graft("full_scene"))  # -> Output, Pairs
executessh_wip_7 = ExecuteSSHWIP(
    _SSHCommands_=overrides_14.Output,
    Run=[executessh_wip_5.Ran, executessh_wip_6.Ran, obj2rad.Run, obj2rad_2.Run],
    addPrefix=True,
    description="""mkdir -p ~/simulation/boston2/octrees
oconv -w -f ~/simulation/boston2/radFiles/opaque_materials.mat ~/simulation/boston2/radFiles/_Doors_50.rad ~/simulation/boston2/radFiles/_SlabWall_50.rad ~/simulation/boston2/radFiles/_SlabJ_50.rad ~/simulation/boston2/radFiles/_HRRoof1_80.rad ~/simulation/boston2/radFiles/_WallInt1_70.rad ~/simulation/boston2/radFiles/_Frames1_50.rad ~/simulation/boston2/radFiles/_SkylightWall_70.rad ~/simulation/boston2/radFiles/_Roofs_50.rad ~/simulation/boston2/radFiles/_Frames_50.rad ~/simulation/boston2/radFiles/_FramesCW_50.rad ~/simulation/boston2/radFiles/_FacadeDark_30.rad ~/simulation/boston2/radFiles/_ContextMat_30.rad ~/simulation/boston2/radFiles/_WallInt_70.rad ~/simulation/boston2/radFiles/_WallExt_50.rad ~/simulation/boston2/radFiles/_SlabFloor_30.rad ~/simulation/boston2/radFiles/_Ground_30.rad ~/simulation/boston2/radFiles/_SlabCeiling_80.rad ~/simulation/boston2/radFiles/_Skylight_Vers1_70.rad ~/simulation/boston2/radFiles/_GlassFacade_74_mat.mat ~/simulation/boston2/radFiles/_GlassInt1_74_mat.mat ~/simulation/boston2/radFiles/_GlassTak_70_mat.mat ~/simulation/boston2/radFiles/_GlassTak_70.rad ~/simulation/boston2/radFiles/_GlassInt1_74.rad ~/simulation/boston2/radFiles/_GlassFacade_74.rad > ~/simulation/boston2/octrees/full_scene.oct;echo ~/simulation/boston2/octrees/full_scene.oct""",
    fireLogs=False,
    lastRunTime=16244.9982,
    suppressWarnings=False,
    results="/home/mss/simulation/boston2/octrees/full_scene.oct",
    commands="""mkdir -p ~/simulation/boston2/octrees
oconv -w -f ~/simulation/boston2/radFiles/opaque_materials.mat ~/simulation/boston2/radFiles/_Doors_50.rad ~/simulation/boston2/radFiles/_SlabWall_50.rad ~/simulation/boston2/radFiles/_SlabJ_50.rad ~/simulation/boston2/radFiles/_HRRoof1_80.rad ~/simulation/boston2/radFiles/_WallInt1_70.rad ~/simulation/boston2/radFiles/_Frames1_50.rad ~/simulation/boston2/radFiles/_SkylightWall_70.rad ~/simulation/boston2/radFiles/_Roofs_50.rad ~/simulation/boston2/radFiles/_Frames_50.rad ~/simulation/boston2/radFiles/_FramesCW_50.rad ~/simulation/boston2/radFiles/_FacadeDark_30.rad ~/simulation/boston2/radFiles/_ContextMat_30.rad ~/simulation/boston2/radFiles/_WallInt_70.rad ~/simulation/boston2/radFiles/_WallExt_50.rad ~/simulation/boston2/radFiles/_SlabFloor_30.rad ~/simulation/boston2/radFiles/_Ground_30.rad ~/simulation/boston2/radFiles/_SlabCeiling_80.rad ~/simulation/boston2/radFiles/_Skylight_Vers1_70.rad ~/simulation/boston2/radFiles/_GlassFacade_74_mat.mat ~/simulation/boston2/radFiles/_GlassInt1_74_mat.mat ~/simulation/boston2/radFiles/_GlassTak_70_mat.mat ~/simulation/boston2/radFiles/_GlassTak_70.rad ~/simulation/boston2/radFiles/_GlassInt1_74.rad ~/simulation/boston2/radFiles/_GlassFacade_74.rad > ~/simulation/boston2/octrees/full_scene.oct;echo ~/simulation/boston2/octrees/full_scene.oct""")  # -> Stdout, Stderr_, Ran
panel_37 = Panel(overrides_14.Output)
panel_38 = Panel(executessh_wip_7.Stdout)
octree = Text(executessh_wip_7.Stdout)

# ----
# preview rad files
window_mat_2 = Text(glass_modifiers)
opaque_mat_3 = Text(opaque_mat)
opaque_rad_3 = Text(opaque_rad)
window_rad_3 = Text(window_rad)
entwine_2 = Entwine(Branch00=window_mat_2, Branch01=window_rad_3, FlattenInputs=True)  # -> flatten(Result)
entwine_3 = Entwine(Branch00=opaque_mat_3, Branch01=opaque_rad_3, FlattenInputs=True)  # -> flatten(Result)
convertpaths = ConvertPaths(I=entwine_3)  # -> Linux, Windows
convertpaths_2 = ConvertPaths(I=entwine_2)  # -> Linux, Windows
radviewer = RadViewer(
    RadFiles=flatten(convertpaths.Windows),
    DisplayName="opaques",
    IsTwoSided=False,
    Polychromatic=True,
    ShowEdges=True,
    Transparent=False,
    ColorNames=["_Doors_50_mat", "_SlabWall_50_mat", "_SlabJ_50_mat", "_HRRoof1_80_mat", "_WallInt1_70_mat", "_Frames1_50_mat", "_SkylightWall_70_mat", "_Roofs_50_mat", "_Frames_50_mat", "_FramesCW_50_mat", "_FacadeDark_30_mat", "_ContextMat_30_mat", "_WallInt_70_mat", "_WallExt_50_mat", "_SlabFloor_30_mat", "_Ground_30_mat", "_SlabCeiling_80_mat", "_Skylight_Vers1_70_mat"],
    Colors=[RGB(203, 150, 171), RGB(106, 190, 160), RGB(201, 174, 177), RGB(205, 158, 222), RGB(103, 250, 247), RGB(250, 218, 178), RGB(172, 136, 198), RGB(219, 133, 222), RGB(233, 173, 215), RGB(243, 121, 118), RGB(185, 190, 164), RGB(204, 140, 152), RGB(178, 241, 220), RGB(180, 192, 252), RGB(216, 119, 215), RGB(231, 108, 224), RGB(207, 160, 186), RGB(117, 202, 229)])  # -> Geo, ModifierNames, Modifiers, FailedWireFrame
radviewer_2 = RadViewer(
    RadFiles=flatten(convertpaths_2.Windows),
    DisplayName="windows",
    IsTwoSided=True,
    Polychromatic=False,
    ShowEdges=True,
    Transparent=False,
    ColorNames=["_GlassTak_70_mat", "_Roofs_50_mat", "_Frames_50_mat", "_SkylightWall_70_mat", "_SlabCeiling_80_mat", "_SlabWall_50_mat", "_WallInterior_70_mat", "_Ground_10_mat", "_FacadeDark_30_mat", "_GlassInt1_74_mat", "_GlassFacade_74_mat"],
    Colors=[RGB(162, 204, 232), RGB(119, 113, 248), RGB(230, 134, 190), RGB(110, 233, 137), RGB(234, 107, 206), RGB(165, 228, 136), RGB(186, 204, 171), RGB(180, 226, 238), RGB(180, 220, 116), RGB(155, 150, 195), RGB(119, 110, 254)])  # -> Geo, ModifierNames, Modifiers, FailedWireFrame

# ----
# preview pts files
# opt1 - cat directly from linux
panel_39 = Panel("cat <pts>")  # disabled
points = Text(ptsfile)  # disabled
overrides_15 = ApplyOverrides(Input_=panel_39, Pts=graft(points))  # -> Output, Pairs; disabled
toggle_3 = BooleanToggle(False)  # disabled
execute_ssh_async = ExecuteSSHAsync(
    _SSHCommands_=overrides_15.Output,
    Run=toggle_3,
    addPrefix=True,
    addSuffix=True,
    description="""cat /home/mss/simulation/boston/points/0.pts
cat /home/mss/simulation/boston/points/1.pts""",
    fireLogs=False,
    suppressWarnings=False)  # -> Stdout, Stderr_, port, port_2, Ran; disabled
ptsview = PtsViewer(PtsString=execute_ssh_async.Stdout)  # disabled

opaque_materials_merged = Panel(opaque_mat)
opaque_materials = Panel(opaque_rad)
non_bsdf_glass_materials = Panel(glass_modifiers)
non_bsdf_glass = Panel(window_rad)

bool_2 = Boolean(raytrace_daylight_matrix_exterior)

bool_3 = Boolean(calculate_vmx_interior)

# ----
# Setting up Receivers (Apertures/Windows/BSDFs)
# The receiver is the surfaces between
# viewmatrix and daylightmatrix.
# These will later be tagged with BSDF files
# must be 1 branch per room
srf = Surface(geo_7)

# ----
# Coupling windows
# with rooms (TESTY!!)
# Preview me
couplezonesandwindows = CoupleZonesAndWindows(WindowSurfaces=srf, WindowNames=flatten(name_4), SimulationSurfaces=flatten(geo_10), Tol1=0.1, Tol2=-1)  # -> SimulationSurface, WindowSurface, PathsPerWindow
area_2 = Area(Geometry=couplezonesandwindows.SimulationSurface)  # -> Area, Centroid
tag = TextTag(Location=area_2.Centroid, Text=roomnumber, Colour=ColourSwatch(SwatchColor=RGB(255, 255, 255)))

cset_3 = CreateSet(List=couplezonesandwindows.PathsPerWindow)  # -> Set, Map
lng_2 = ListLength(List=cset_3.Set)
larger = LargerThan(FirstNumber=lng_2, SecondNumber="1")  # -> LargerThan, OrEqualTo
panel_40 = Panel("""0
1""")
item = ListItem(List=panel_40, Index=larger.LargerThan, Wrap=True)
panel_41 = Panel(item)

# ----
# WEA file (+ Skymatrix)
panel_42 = Panel("<LinuxHome>/weatherData")
overrides_16 = ApplyOverrides(Input_=panel_42)  # -> Output, Pairs

cluster_4 = Cluster_4(x=overrides_16.Output)

upload_2 = Upload(
    LocalFilePaths=path,
    SubfolderOverride=cluster_4,
    Run=executessh_2.Ran,
    stdouts="~/simulation/weatherData/NOR_Oslo.Fornebu.014880_IWEC.epw")  # -> Status, FilePaths, Run
overrides_17 = ApplyOverrides(Input_="epw2wea <epw> <epw-.>.wea 1>&2;echo <epw-.>.wea", Epw=graft(upload_2.FilePaths))  # -> Output, Pairs
executessh_wip_8 = ExecuteSSHWIP(
    _SSHCommands=overrides_17.Output,
    Run=upload_2.Run,
    addPrefix=True,
    description="epw2wea ~/simulation/weatherData/NOR_Oslo.Fornebu.014880_IWEC.epw ~/simulation/weatherData/NOR_Oslo.Fornebu.014880_IWEC.wea 1>&2;echo ~/simulation/weatherData/NOR_Oslo.Fornebu.014880_IWEC.wea",
    fireLogs=True,
    lastRunTime=11.7277,
    name="weaFile",
    suppressWarnings=True,
    results="/home/mss/simulation/weatherData/NOR_Oslo.Fornebu.014880_IWEC.wea",
    stderr="""place OSLO/FORNEBU_NOR
latitude 59.90
longitude -10.62
time_zone -15.00
site_elevation 17.0
weather_data_file_units 1""",
    commands="epw2wea ~/simulation/weatherData/NOR_Oslo.Fornebu.014880_IWEC.epw ~/simulation/weatherData/NOR_Oslo.Fornebu.014880_IWEC.wea 1>&2;echo ~/simulation/weatherData/NOR_Oslo.Fornebu.014880_IWEC.wea")  # -> Stdout, Stderr, Ran
panel_43 = Panel(executessh_wip_8.Stdout)

# ----
# Annual sky-matrix 145 patches
panel_44 = Panel("gendaymtx -m 1 \"<wea>\" > <wea-.>_m1.smx;echo \"<wea-.>_m1.smx\"")
overrides_18 = ApplyOverrides(Input=panel_44, Wea=graft(panel_43))  # -> Output, Pairs
executessh_wip_9 = ExecuteSSHWIP(
    _SSHCommands_=overrides_18.Output,
    Run=executessh_wip_8.Ran,
    addPrefix=True,
    description="gendaymtx -m 1 \"/home/mss/simulation/weatherData/NOR_Oslo.Fornebu.014880_IWEC.wea\" > /home/mss/simulation/weatherData/NOR_Oslo.Fornebu.014880_IWEC_m1.smx;echo \"/home/mss/simulation/weatherData/NOR_Oslo.Fornebu.014880_IWEC_m1.smx\"",
    fireLogs=False,
    lastRunTime=1945.7294,
    suppressWarnings=False,
    results="/home/mss/simulation/weatherData/NOR_Oslo.Fornebu.014880_IWEC_m1.smx",
    commands="gendaymtx -m 1 \"/home/mss/simulation/weatherData/NOR_Oslo.Fornebu.014880_IWEC.wea\" > /home/mss/simulation/weatherData/NOR_Oslo.Fornebu.014880_IWEC_m1.smx;echo \"/home/mss/simulation/weatherData/NOR_Oslo.Fornebu.014880_IWEC_m1.smx\"")  # -> Stdout, Stderr_, Ran
skymatrix_smx = Panel(executessh_wip_9.Stdout)
skymtx = Text(executessh_wip_9.Stdout)

# ----
# Get diffuseHorizontal from EPW
panel_45 = Panel("rcalc -t, -e '$1=$16' <epw>")
overrides_19 = ApplyOverrides(Input_=panel_45, Epw=graft(upload_2.FilePaths))  # -> Output, Pairs
executessh_wip_10 = ExecuteSSHWIP(
    _SSHCommands_=overrides_19.Output,
    Run=upload_2.Run,
    addPrefix=True,
    description="rcalc -t, -e '$1=$16' ~/simulation/weatherData/NOR_Oslo.Fornebu.014880_IWEC.epw",
    fireLogs=False,
    lastRunTime=7.4603,
    suppressWarnings=False,
    results="""0
5.4
0
5.81
0
0
0
0
0
0
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""",
    commands="rcalc -t, -e '$1=$16' ~/simulation/weatherData/NOR_Oslo.Fornebu.014880_IWEC.epw")  # -> Stdout, Stderr_, Ran
python_9 = GhPythonScript(inp=executessh_wip_10.Stdout)  # -> illum
# ---------- python_9: Python ----------
__author__ = "mm1013"
__version__ = "2022.07.04"

import rhinoscriptsyntax as rs

illum = [float(i) for i in inp.split("\n")][8:] #skipping headers
# ---------- end python_9 ----------

# ----
# EN17037 Schedule
# EN17037 Schedule
cluster_5 = Cluster_3(horizontaldiffrad=python_9)

# ---- group: visualize schedule
_3dchart = Ladybug_3DChart(inputData=flatten(cluster_5), xScale="0.25", zScale="0")  # -> readMe, graphMesh, graphCurves, legend, legendBasePts, title, titleBasePts, dataPts, conditionalHOY; disabled; plug-in component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
ladybug = Ladybug_Ladybug()  # -> Vviiiiiiiiiizzz; disabled; plug-in component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

# ----
panel_46 = Panel(executessh_wip_8.Stderr)
wea_file = Panel(executessh_wip_8.Stdout)

assign_paths_3 = AssignPaths(InputData=flatten(layer_2), PathsToAssign=flatten(couplezonesandwindows.PathsPerWindow))
assign_paths_4 = AssignPaths(InputData=flatten(couplezonesandwindows.PathsPerWindow), PathsToAssign=flatten(couplezonesandwindows.PathsPerWindow))
assign_paths_5 = AssignPaths(InputData=flatten(name_4), PathsToAssign=flatten(couplezonesandwindows.PathsPerWindow))
cset_4 = CreateSet(List=assign_paths_3)  # -> Set, simplify(graft(Map))
dpath = DeconstructPath(Branch=assign_paths_4)
abx = ABX(data=dpath, pathCount=panel_41)  # -> data; inputs data: tree, pathCount: Int32
# ---------- abx: C# usings ----------
using System.Linq;
# ---------- abx: C# ----------
    DataTree<object> newTree = new DataTree<object>();
    _data.SimplifyPaths();
    var y = _data.Paths;
    if (pathCount < 1)
    {
      pathCount = 1;
    }


    for (int i = 0; i < _data.BranchCount; i++)
    {
      GH_Path oldPath = _data.Paths[i];
      GH_Path p = new GH_Path(oldPath.Indices.Take(pathCount).ToArray());


      newTree.AddRange(_data.Branches[i], p);
    }
    data = newTree;
# ---------- end abx ----------
abx_2 = ABX(data=cset_4.Map, pathCount=panel_41)  # -> data; inputs data: tree, pathCount: Int32; same code as abx
long_2 = LongestList(ListA=roomnumber, ListB=couplezonesandwindows.WindowSurface, PaddingMode=2)  # -> ListA, ListB
merge = Merge(Data1=abx, Data2=abx_2)
path_2 = ConstructPath(Indices=merge)
assign_paths_6 = AssignPaths(InputData=flatten(couplezonesandwindows.WindowSurface), PathsToAssign=flatten(path_2))  # -> simplify(RestructuredData)
assign_paths_7 = AssignPaths(InputData=flatten(long_2.ListA), PathsToAssign=flatten(path_2))  # -> simplify(RestructuredData)
assign_paths_8 = AssignPaths(InputData=flatten(assign_paths_5), PathsToAssign=flatten(path_2))  # -> simplify(RestructuredData)
item_2 = ListItem(List=assign_paths_8, Index=0, Wrap=True)
item_3 = ListItem(List=assign_paths_7, Index=0, Wrap=True)
m = GhPythonScript(i=item_3)  # -> i1, simplify(i2); inputs i: Int32
# ---------- m: Python ----------
__author__ = "mm1013"
__version__ = "2022.08.21"

import rhinoscriptsyntax as rs

i1 = i
i2 = "%02d" % i
# ---------- end m ----------
concat_5 = Concatenate(FragmentA=m.i2, FragmentB=item_2)
meshit2_5 = MeshIt2(mesh_brep=assign_paths_6)
python_10 = GhPythonScript(x=concat_5)  # -> a
# ---------- python_10: Python ----------
__author__ = "mm1013"
__version__ = "2022.09.06"

import rhinoscriptsyntax as rs

a = x[:-5]
# ---------- end python_10 ----------
panel_47 = Panel(python_10)

# ----
# save rad files
panel_48 = Panel("mapping_windows_bsdf")
concat_6 = Concatenate(FragmentA=concat_3, FragmentB="/receivers")
mesh2obj_3 = MeshToObj(
    Mesh=meshit2_5,
    Name=graft(python_10),
    MapFileName=panel_48,
    ModifierName=graft(python_10),
    SubfolderOverride=concat_6,
    Run=prep_3ph)  # -> ObjFiles, MapFile, Run
concat_7 = Concatenate(FragmentA=overrides.Output, FragmentB="/receivers")
obj2rad_3 = ObjToRad(
    ObjFiles=graft(mesh2obj_3.ObjFiles),
    MapFile=mesh2obj_3.MapFile,
    SubfolderOverride=concat_7,
    Run=mesh2obj_3.Run,
    stdouts="~/simulation/boston2/radFiles/receivers/00_Glass_Facade.rad")  # -> Status, RadFiles, Run
abx_3 = ABX(data=python_10, pathCount=panel_41)  # -> data; inputs data: tree, pathCount: Int32
# ---------- abx_3: C# ----------
    DataTree<object> newTree = new DataTree<object>();
    _data.SimplifyPaths();
    var y = _data.Paths;
    if (pathCount < 1)
    {
      pathCount = 0;
    }
    GH_Path p;

    for (int i = 0; i < _data.BranchCount; i++)
    {
      GH_Path oldPath = _data.Paths[i];
      if (pathCount == 0)
      p = new GH_Path(0);
      else
      p = new GH_Path(oldPath.Indices.Take(pathCount).ToArray());  


      newTree.AddRange(_data.Branches[i], p);
    }
    data = newTree;
# ---------- end abx_3 ----------
window_rad_4 = Text(obj2rad_3.RadFiles)
unflatten_2 = UnflattenTree(Tree=window_rad_4, Guide=abx_3)

receiver_rad_files = Panel(unflatten_2)

name_6 = Text(python_10)
panel_49 = Panel(name_6)
vertical_glazing_rfluxmtx = Panel("#@rfluxmtx h=kf u=Z")
overrides_20 = ApplyOverrides(Input_="void glow <windowMod> 0 0 4 1 1 1 0", WindowMod=graft(name_6))  # -> Output, Pairs
concat_8 = Concatenate(FragmentA=overrides_20.Output, FragmentB=vertical_glazing_rfluxmtx)

# ----
# adding rflux comments to windowRads
panel_50 = Panel("""echo "<rfluxmtx>" > <windowRad-.>_rflux.rad
cat <windowRad> >> <windowRad-.>_rflux.rad
echo <windowRad-.>_rflux.rad""")
overrides_21 = ApplyOverrides(Input_=panel_50, Rfluxmtx=graft(concat_8), WindowRad=graft(unflatten_2))  # -> Output, Pairs
executessh_4 = ExecuteSSH(
    _SSHCommands_=overrides_21.Output,
    Run=obj2rad_3.Run,
    addPrefix=True,
    description="""echo "void glow 00_Glass 0 0 4 1 1 1 0
#@rfluxmtx h=kf u=Z" > ~/simulation/boston2/radFiles/receivers/00_Glass_rflux.rad
cat ~/simulation/boston2/radFiles/receivers/00_Glass.rad >> ~/simulation/boston2/radFiles/receivers/00_Glass_rflux.rad
echo ~/simulation/boston2/radFiles/receivers/00_Glass_rflux.rad


- - -

echo "void glow 00_Glass_Facade 0 0 4 1 1 1 0
#@rfluxmtx h=kf u=Z" > ~/simulation/boston2/radFiles/receivers/00_Glass_Facade_rflux.rad
cat ~/simulation/boston2/radFiles/receivers/00_Glass_Facade.rad >> ~/simulation/boston2/radFiles/receivers/00_Glass_Facade_rflux.rad
echo ~/simulation/boston2/radFiles/receivers/00_Glass_Facade_rflux.rad""",
    fireLogs=True,
    lastRunTime=13.1964,
    name="Add Comments",
    suppressWarnings=False,
    results=["/home/mss/simulation/boston2/radFiles/receivers/00_Glass_rflux.rad", "/home/mss/simulation/boston2/radFiles/receivers/00_Glass_Facade_rflux.rad"],
    commands=["""echo "void glow 00_Glass_Facade 0 0 4 1 1 1 0
#@rfluxmtx h=kf u=Z" > ~/simulation/boston2/radFiles/receivers/00_Glass_Facade_rflux.rad
cat ~/simulation/boston2/radFiles/receivers/00_Glass_Facade.rad >> ~/simulation/boston2/radFiles/receivers/00_Glass_Facade_rflux.rad
echo ~/simulation/boston2/radFiles/receivers/00_Glass_Facade_rflux.rad""", """echo "void glow 00_Glass 0 0 4 1 1 1 0
#@rfluxmtx h=kf u=Z" > ~/simulation/boston2/radFiles/receivers/00_Glass_rflux.rad
cat ~/simulation/boston2/radFiles/receivers/00_Glass.rad >> ~/simulation/boston2/radFiles/receivers/00_Glass_rflux.rad
echo ~/simulation/boston2/radFiles/receivers/00_Glass_rflux.rad"""])  # -> Stdout, Stderr_, Ran
unflatten_3 = UnflattenTree(Tree=executessh_4.Stdout, Guide=abx_3)
fenestrations_rad_rflux = Text(unflatten_3)

receiver_rad_files_2 = Panel(fenestrations_rad_rflux)

overrides_22 = ApplyOverrides(Input_="head <file> -n 20", File=graft(fenestrations_rad_rflux))  # -> flatten(Output), Pairs
executessh_5 = ExecuteSSH(
    _SSHCommands_=overrides_22.Output,
    Run=executessh_4.Ran,
    addPrefix=True,
    description="""head /home/mss/simulation/boston2/radFiles/receivers/00_Glass_rflux.rad -n 20
head /home/mss/simulation/boston2/radFiles/receivers/00_Glass_Facade_rflux.rad -n 20""",
    fireLogs=False,
    lastRunTime=14.1253,
    suppressWarnings=False,
    results="""void glow 00_Glass 0 0 4 1 1 1 0
#@rfluxmtx h=kf u=Z
# obj2rad -m /home/mss/simulation/boston2/radFiles/receivers/mapping_windows_bsdf.map -f /home/mss/simulation/boston2/radFiles/receivers/00_Glass.obj
# Written with MantaRay plugin/GH_MeshToRad

00_Glass polygon 00_Glass_1.1
0
0
12
            53.361            190.572             117.03
            53.823            190.381             117.03
            53.433            189.439            116.442
            52.971             189.63            116.442

00_Glass polygon 00_Glass_1.2
0
0
12
            52.899            190.763             117.03
            53.361            190.572             117.03
_JOIN_
void glow 00_Glass_Facade 0 0 4 1 1 1 0
#@rfluxmtx h=kf u=Z
# obj2rad -m /home/mss/simulation/boston2/radFiles/receivers/mapping_windows_bsdf.map -f /home/mss/simulation/boston2/radFiles/receivers/00_Glass_Facade.obj
# Written with MantaRay plugin/GH_MeshToRad

00_Glass_Facade polygon 00_Glass_Facade_1.1
0
0
12
             51.52            186.597            112.865
             51.52            186.597            110.862
            51.261            186.705            110.862
            51.261            186.705            112.865

00_Glass_Facade polygon 00_Glass_Facade_1.2
0
0
12
            51.549            186.467            113.752
            51.549            186.467            113.018""",
    commands="""head /home/mss/simulation/boston2/radFiles/receivers/00_Glass_rflux.rad -n 20
_JOIN_
head /home/mss/simulation/boston2/radFiles/receivers/00_Glass_Facade_rflux.rad -n 20""")  # -> Stdout, Stderr_, Ran
panel_51 = Panel(executessh_5.Stdout)

# ----
# Viewmatrix (grid based)
fenestrations_rad_rflux_2 = Text(fenestrations_rad_rflux)
octree_with_glass = Text(octree)
ptsfile_2 = Text(simplify(ptsfile))
roomnumber_2 = Text(roomnumber)
glassname = Text(python_10)
panel_52 = Panel("""mkdir -p <proj>/mtxs/3ph_vmx_grid
rfluxmtx -v -w -I+ <param> -n <cpus> -y <ptcount> - <receiver> -i <octree> < <ptsfile> > <proj>/mtxs/3ph_vmx_grid/<room>_<window>.vmx
echo <proj>/mtxs/3ph_vmx_grid/<room>_<window>.vmx""")
abx_4 = ABX(data=glassname, pathCount=panel_41)  # -> data; inputs data: tree, pathCount: Int32; same code as abx_3
overrides_23 = ApplyOverrides(Input_="wc -l < <ptsFile>", PtsFile=graft(ptsfile_2))  # -> Output, Pairs
m_2 = GhPythonScript(i=roomnumber_2)  # -> i1, simplify(i2); inputs i: Int32; same code as m
panel_53 = Panel(vmx_rad_parameters)
executessh_wip_11 = ExecuteSSHWIP(
    _SSHCommands_=overrides_23.Output,
    Run=points2pts.Run,
    addPrefix=True,
    description="wc -l < /home/mss/simulation/boston2/points/0.pts",
    fireLogs=False,
    lastRunTime=12.6094,
    suppressWarnings=False,
    results="154",
    commands="wc -l < /home/mss/simulation/boston2/points/0.pts")  # -> Stdout, Stderr_, Ran
pt_count = Panel(executessh_wip_11.Stdout)
long_3 = LongestList(
    ListA=abx_4,
    ListB=fenestrations_rad_rflux_2,
    ListC=ptsfile_2,
    ListD=m_2.i2,
    ListE=executessh_wip_11.Stdout,
    PaddingMode=2)  # -> ListA, ListB, ListC, ListD, ListE
overrides_24 = ApplyOverrides(
    Input_=panel_52,
    Window=graft(long_3.ListA),
    Receiver=graft(long_3.ListB),
    Octree=graft(octree_with_glass),
    Ptsfile=graft(long_3.ListC),
    Room=graft(long_3.ListD),
    Ptcount=graft(long_3.ListE),
    Param=graft(panel_53))  # -> flatten(Output), Pairs
executessh_wip_12 = ExecuteSSHWIP(
    _SSHCommands_=overrides_24.Output,
    Run=bool_3,
    addPrefix=True,
    description="""mkdir -p ~/simulation/boston2/mtxs/3ph_vmx_grid
rfluxmtx -v -w -I+ -ab 2 -ad 1024 -lw 1e-3 -n 11 -y 154 - /home/mss/simulation/boston2/radFiles/receivers/00_Glass_rflux.rad -i /home/mss/simulation/boston2/octrees/full_scene.oct < /home/mss/simulation/boston2/points/0.pts > ~/simulation/boston2/mtxs/3ph_vmx_grid/00_00_Glass.vmx
echo ~/simulation/boston2/mtxs/3ph_vmx_grid/00_00_Glass.vmx
mkdir -p ~/simulation/boston2/mtxs/3ph_vmx_grid
rfluxmtx -v -w -I+ -ab 2 -ad 1024 -lw 1e-3 -n 11 -y 154 - /home/mss/simulation/boston2/radFiles/receivers/00_Glass_Facade_rflux.rad -i /home/mss/simulation/boston2/octrees/full_scene.oct < /home/mss/simulation/boston2/points/0.pts > ~/simulation/boston2/mtxs/3ph_vmx_grid/00_00_Glass_Facade.vmx
echo ~/simulation/boston2/mtxs/3ph_vmx_grid/00_00_Glass_Facade.vmx""",
    fireLogs=True,
    lastRunTime=9019.4178,
    name="ViewMatrix grid",
    suppressWarnings=False,
    results="""/home/mss/simulation/boston2/mtxs/3ph_vmx_grid/00_00_Glass.vmx
_JOIN_
/home/mss/simulation/boston2/mtxs/3ph_vmx_grid/00_00_Glass_Facade.vmx""",
    commands="""mkdir -p ~/simulation/boston2/mtxs/3ph_vmx_grid
rfluxmtx -v -w -I+ -ab 2 -ad 1024 -lw 1e-3 -n 11 -y 154 - /home/mss/simulation/boston2/radFiles/receivers/00_Glass_rflux.rad -i /home/mss/simulation/boston2/octrees/full_scene.oct < /home/mss/simulation/boston2/points/0.pts > ~/simulation/boston2/mtxs/3ph_vmx_grid/00_00_Glass.vmx
echo ~/simulation/boston2/mtxs/3ph_vmx_grid/00_00_Glass.vmx
_JOIN_
mkdir -p ~/simulation/boston2/mtxs/3ph_vmx_grid
rfluxmtx -v -w -I+ -ab 2 -ad 1024 -lw 1e-3 -n 11 -y 154 - /home/mss/simulation/boston2/radFiles/receivers/00_Glass_Facade_rflux.rad -i /home/mss/simulation/boston2/octrees/full_scene.oct < /home/mss/simulation/boston2/points/0.pts > ~/simulation/boston2/mtxs/3ph_vmx_grid/00_00_Glass_Facade.vmx
echo ~/simulation/boston2/mtxs/3ph_vmx_grid/00_00_Glass_Facade.vmx""")  # -> Stdout, Stderr_, Ran
unflatten_4 = UnflattenTree(Tree=executessh_wip_12.Stdout, Guide=abx_4)
panel_54 = Panel(overrides_24.Output)
vmx_grid = Text(unflatten_4)

vmx = Panel(vmx_grid)

# ----
# Daylight matrix (exterior)
glassname_2 = Text(python_10)
octree_with_glass_2 = Text(octree)
fenestrations_rad_rflux_3 = Text(fenestrations_rad_rflux)
skyglow_2 = Text(skyglow)
panel_55 = Panel("""mkdir -p <proj>/mtxs/3ph_dmx;
rfluxmtx -w -v -ffa <param> -c 1000 -n <cpus> <receiver> <skyglow> -i <octree> > <proj>/mtxs/3ph_dmx/<receiverName>.dmx;echo "<proj>/mtxs/3ph_dmx/<receiverName>.dmx"
""")
abx_5 = ABX(data=glassname_2, pathCount=panel_41)  # -> data; inputs data: tree, pathCount: Int32; same code as abx_3
panel_56 = Panel(dmx_rad_parameters)
overrides_25 = ApplyOverrides(
    Input_=panel_55,
    Param=graft(panel_56),
    Receiver=graft(fenestrations_rad_rflux_3),
    ReceiverName=graft(abx_5),
    Octree=graft(octree_with_glass_2),
    Skyglow=graft(skyglow_2))  # -> flatten(Output), Pairs
executessh_6 = ExecuteSSH(
    _SSHCommands=overrides_25.Output,
    Run=bool_2,
    addPrefix=True,
    description="""mkdir -p ~/simulation/boston2/mtxs/3ph_dmx;
rfluxmtx -w -v -ffa -ab 3 -ad 1024 -lw 0.001 -c 1000 -n 11 /home/mss/simulation/boston2/radFiles/receivers/00_Glass_rflux.rad ~/simulation/boston2/radFiles/skyglow_3ph.rad -i /home/mss/simulation/boston2/octrees/full_scene.oct > ~/simulation/boston2/mtxs/3ph_dmx/00_Glass.dmx;echo "~/simulation/boston2/mtxs/3ph_dmx/00_Glass.dmx"
mkdir -p ~/simulation/boston2/mtxs/3ph_dmx;
rfluxmtx -w -v -ffa -ab 3 -ad 1024 -lw 0.001 -c 1000 -n 11 /home/mss/simulation/boston2/radFiles/receivers/00_Glass_Facade_rflux.rad ~/simulation/boston2/radFiles/skyglow_3ph.rad -i /home/mss/simulation/boston2/octrees/full_scene.oct > ~/simulation/boston2/mtxs/3ph_dmx/00_Glass_Facade.dmx;echo "~/simulation/boston2/mtxs/3ph_dmx/00_Glass_Facade.dmx"
""",
    fireLogs=True,
    lastRunTime=137380.2098,
    name="DaylightMatrix",
    suppressWarnings=True,
    results="""~/simulation/boston2/mtxs/3ph_dmx/00_Glass.dmx
_JOIN_
~/simulation/boston2/mtxs/3ph_dmx/00_Glass_Facade.dmx""",
    stderr="""rfluxmtx: opening pipe to: rcontrib -fo+ -w -ab 3 -ad 1024 -lw 0.001 -n 11 -fda -c 1000 -f reinhartb.cal -p MF=1,rNx=0,rNy=0,rNz=-1,Ux=0,Uy=1,Uz=0,RHS=+1 -bn Nrbins -b rbin -m sky_glow -bn 1 -b 'if(-Dx*0-Dy*0-Dz*1,0,-1)' -m ground_glow -y 145 '!oconv -f -i /home/mss/simulation/boston2/octrees/full_scene.oct /home/mss/simulation/boston2/radFiles/skyglow_3ph.rad'
rfluxmtx: sampling 145 directions (2 elements)
rfluxmtx: opening pipe to: rcontrib -fo+ -w -ab 3 -ad 1024 -lw 0.001 -n 11 -fda -c 1000 -f reinhartb.cal -p MF=1,rNx=0,rNy=0,rNz=-1,Ux=0,Uy=1,Uz=0,RHS=+1 -bn Nrbins -b rbin -m sky_glow -bn 1 -b 'if(-Dx*0-Dy*0-Dz*1,0,-1)' -m ground_glow -y 145 '!oconv -f -i /home/mss/simulation/boston2/octrees/full_scene.oct /home/mss/simulation/boston2/radFiles/skyglow_3ph.rad'
rfluxmtx: sampling 145 directions (7 elements)""",
    commands="""mkdir -p ~/simulation/boston2/mtxs/3ph_dmx;
rfluxmtx -w -v -ffa -ab 3 -ad 1024 -lw 0.001 -c 1000 -n 11 /home/mss/simulation/boston2/radFiles/receivers/00_Glass_rflux.rad ~/simulation/boston2/radFiles/skyglow_3ph.rad -i /home/mss/simulation/boston2/octrees/full_scene.oct > ~/simulation/boston2/mtxs/3ph_dmx/00_Glass.dmx;echo "~/simulation/boston2/mtxs/3ph_dmx/00_Glass.dmx"
_JOIN_
mkdir -p ~/simulation/boston2/mtxs/3ph_dmx;
rfluxmtx -w -v -ffa -ab 3 -ad 1024 -lw 0.001 -c 1000 -n 11 /home/mss/simulation/boston2/radFiles/receivers/00_Glass_Facade_rflux.rad ~/simulation/boston2/radFiles/skyglow_3ph.rad -i /home/mss/simulation/boston2/octrees/full_scene.oct > ~/simulation/boston2/mtxs/3ph_dmx/00_Glass_Facade.dmx;echo "~/simulation/boston2/mtxs/3ph_dmx/00_Glass_Facade.dmx"
""")  # -> Stdout, Stderr, Ran
unflatten_5 = UnflattenTree(Tree=executessh_6.Stdout, Guide=abx_5)
panel_57 = Panel(executessh_6.Stdout)
dmx = Text(unflatten_5)

# ----
# Calculate the BSDF file
rad_parameters = Panel("-ab 2 -ad 1024 -lw 1e-3")
run = LBFalseStartToggle(True)

# ----
# Construct BSDF file
# (and save in library)
python_11 = GhPythonScript(layer_name=bsdf_name_2)  # -> out, transmittance, name; same code as python_4
glassmat_2 = GlassMat(Name=python_11.name, Transmittance_0_1=expr("x/100", python_11.transmittance))  # -> RadMaterials, RadMaterialList
bool_4 = Boolean(run)
blindsname_4 = Text(blindsname_3)

# ----
# modifiers
name_7 = Text(python_11.name)
blinds_material = Panel("void plastic blindmat 0 0 5 .8 .8 .8 0 .01")
panel_58 = Panel("""mkdir -p <LinuxHome>/BSDF_Files/<projname>_radFiles
echo "<modifiers>" > <LinuxHome>/BSDF_Files/<projname>_radFiles/Mods<name>.rad
echo <LinuxHome>/BSDF_Files/<projname>_radFiles/Mods<name>.rad""")
glass_modifier = Text(glassmat_2.RadMaterials)
concat_9 = Concatenate(FragmentA=glass_modifier, FragmentC=blinds_material)
overrides_26 = ApplyOverrides(Input_=panel_58, Modifiers=graft(concat_9), Name=graft(name_7))  # -> Output, Pairs
executessh_7 = ExecuteSSH(
    _SSHCommands_=overrides_26.Output,
    Run=bool_4,
    addPrefix=True,
    description="""mkdir -p ~/simulation/BSDF_Files/boston2_radFiles
echo "void glass _GlassLT_70
0
0
3 0.763 0.763 0.763
void plastic blindmat 0 0 5 .8 .8 .8 0 .01" > ~/simulation/BSDF_Files/boston2_radFiles/Mods_GlassLT_70.rad
echo ~/simulation/BSDF_Files/boston2_radFiles/Mods_GlassLT_70.rad""",
    fireLogs=False,
    lastRunTime=6.9977,
    suppressWarnings=False,
    results="/home/mss/simulation/BSDF_Files/boston2_radFiles/Mods_GlassLT_70.rad",
    commands="""mkdir -p ~/simulation/BSDF_Files/boston2_radFiles
echo "void glass _GlassLT_70
0
0
3 0.763 0.763 0.763
void plastic blindmat 0 0 5 .8 .8 .8 0 .01" > ~/simulation/BSDF_Files/boston2_radFiles/Mods_GlassLT_70.rad
echo ~/simulation/BSDF_Files/boston2_radFiles/Mods_GlassLT_70.rad""")  # -> Stdout, Stderr_, Ran

# ----
# setting dimensions
panel_59 = Panel("""getbbox <rad>
getbbox -h <rad>""")
overrides_27 = ApplyOverrides(Input_=panel_59, Rad=graft(executessh.Stdout))  # -> Output, Pairs
executessh_8 = ExecuteSSH(
    _SSHCommands_=overrides_27.Output,
    Run=executessh.Ran,
    addPrefix=True,
    description="""getbbox /home/mss/simulation/BSDF_Files/boston2_radFiles/blinds_001.rad
getbbox -h /home/mss/simulation/BSDF_Files/boston2_radFiles/blinds_001.rad""",
    fireLogs=False,
    lastRunTime=14.8774,
    suppressWarnings=False,
    results="""     xmin      xmax      ymin      ymax      zmin      zmax
        0         1 0.0357143   1.99165     -0.15 -0.0748246
_JOIN_
        0         1 0.0357143   1.99165     -0.15 -0.0748246""",
    commands="""getbbox /home/mss/simulation/BSDF_Files/boston2_radFiles/blinds_001.rad
_JOIN_
getbbox -h /home/mss/simulation/BSDF_Files/boston2_radFiles/blinds_001.rad""")  # -> Stdout, Stderr_, Ran

# ----
# Make sure zmax is below 0!
# Also pay attention to X/Y dims.
# Here ymax = 2 and xmax = 1
panel_60 = Panel(executessh_8.Stdout)

cluster_6 = Cluster(l=executessh_8.Stdout)  # -> xstart_2, xend_2, ystart_2, yend_2, data
overrides_28 = ApplyOverrides(
    Input_="-dim <xstart> <xend> <ystart> <yend> <zmin> 0",
    Xstart=graft(cluster_6.xstart_2),
    Xend=graft(cluster_6.xend_2),
    Ystart=graft(cluster_6.ystart_2),
    Yend=graft(cluster_6.yend_2),
    Zmin=graft(cluster_6.data))  # -> Output, Pairs

# ----
# glass pane geometry
panel_61 = Panel("""<mat> polygon window
0
0
12 0 0 0
0 <y> 0
<x> <y> 0
<x> 0 0""")
python_12 = GhPythonScript(l=executessh_8.Stdout)  # -> out, xmax, ymax; inputs l: list
# ---------- python_12: Python ----------
__author__ = "mm1013"
__version__ = "2022.08.20"

import rhinoscriptsyntax as rs
xmax = 1
ymax = 1
if len(l) == 2:
    li = [s for s in l[1].split(" ") if len(s) > 0]
    #print(li)
    xmin, xmax, ymin, ymax, zmin, zmax = [float(v) for v in li]


    if zmax > 0:
        print("Err, Zmax should be < 0!")
    else:
        print("Zmax is OK (< 0)")
# ---------- end python_12 ----------
panel_62 = Panel("""mkdir -p <LinuxHome>/BSDF_Files/<projname>_radFiles
echo "<window>" > <LinuxHome>/BSDF_Files/<projname>_radFiles/Geo<name>.rad
echo <LinuxHome>/BSDF_Files/<projname>_radFiles/Geo<name>.rad""")
panel_63 = Panel(python_12.out)
overrides_29 = ApplyOverrides(Input_=panel_61, Mat=graft(python_11.name), X=graft(python_12.xmax), Y=graft(python_12.ymax))  # -> Output, Pairs
name_8 = Text(python_11.name)
overrides_30 = ApplyOverrides(Input_=panel_62, Window=graft(overrides_29.Output), Name=graft(name_8))  # -> Output, Pairs
executessh_9 = ExecuteSSH(
    _SSHCommands_=overrides_30.Output,
    Run=bool_4,
    addPrefix=True,
    description="""mkdir -p ~/simulation/BSDF_Files/boston2_radFiles
echo "_GlassLT_70 polygon window
0
0
12 0 0 0
0 1.99165 0
1 1.99165 0
1 0 0" > ~/simulation/BSDF_Files/boston2_radFiles/Geo_GlassLT_70.rad
echo ~/simulation/BSDF_Files/boston2_radFiles/Geo_GlassLT_70.rad""",
    fireLogs=False,
    lastRunTime=8.0001,
    suppressWarnings=False,
    results="/home/mss/simulation/BSDF_Files/boston2_radFiles/Geo_GlassLT_70.rad",
    commands="""mkdir -p ~/simulation/BSDF_Files/boston2_radFiles
echo "_GlassLT_70 polygon window
0
0
12 0 0 0
0 1.99165 0
1 1.99165 0
1 0 0" > ~/simulation/BSDF_Files/boston2_radFiles/Geo_GlassLT_70.rad
echo ~/simulation/BSDF_Files/boston2_radFiles/Geo_GlassLT_70.rad""")  # -> Stdout, Stderr_, Ran

python_13 = GhPythonScript(x=overrides_28.Output)  # -> a
# ---------- python_13: Python ----------
__author__ = "mm1013"
__version__ = "2022.09.09"

import rhinoscriptsyntax as rs

a = x.strip("\n").strip("\r")
# ---------- end python_13 ----------

# ----
# GenBSDF
panel_64 = Panel("""mkdir -p <LinuxHome>/BSDF_Files
genBSDF -n <cpus> -r '<params>' <dim> <radFiles> > <LinuxHome>/BSDF_Files/<projname>_<target>.xml
echo <LinuxHome>/BSDF_Files/<projname>_<target>.xml""")
glassgeo = Text(executessh_9.Stdout)
blindsgeo = Text(blindsradfile)
modifiers = Text(executessh_7.Stdout)
merge_2 = Merge(Data1=flatten(modifiers), Data2=flatten(blindsgeo), Data3=flatten(glassgeo))
name_9 = Text(python_11.name)
join_3 = TextJoin(Text=merge_2, Join=" ")

concat_10 = Concatenate(FragmentC=blindsname_4, FragmentB=name_9)
overrides_31 = ApplyOverrides(Input_="<LinuxHome>/BSDF_Files/<projname>_<target>.xml", Target=graft(concat_10))  # -> Output, Pairs

save_path = Panel(overrides_31.Output)
name_10 = Panel(concat_10)

overrides_32 = ApplyOverrides(Input_=panel_64, RadFiles=graft(join_3), Dim=graft(python_13), Target=graft(concat_10), Params=graft(rad_parameters))  # -> Output, Pairs
executessh_10 = ExecuteSSH(
    _SSHCommands=overrides_32.Output,
    Run=[executessh_7.Ran, executessh_9.Ran],
    addPrefix=True,
    description="""mkdir -p ~/simulation/BSDF_Files
genBSDF -n 11 -r '-ab 2 -ad 1024 -lw 1e-3' -dim 0.23 0.77 0.48558 1.541785 -0.15 0 /home/mss/simulation/BSDF_Files/boston2_radFiles/Mods_GlassLT_70.rad /home/mss/simulation/BSDF_Files/boston2_radFiles/blinds_001.rad /home/mss/simulation/BSDF_Files/boston2_radFiles/Geo_GlassLT_70.rad > ~/simulation/BSDF_Files/boston2_blinds_001_GlassLT_70.xml
echo ~/simulation/BSDF_Files/boston2_blinds_001_GlassLT_70.xml""",
    fireLogs=False,
    lastRunTime=80872.7574,
    suppressWarnings=True,
    results="/home/mss/simulation/BSDF_Files/boston2_blinds_001_GlassLT_70.xml",
    stderr="Recover using: /usr/local/radiance/bin/genBSDF -recover /tmp/genBSDF.VNZWeE",
    commands="""mkdir -p ~/simulation/BSDF_Files
genBSDF -n 11 -r '-ab 2 -ad 1024 -lw 1e-3' -dim 0.23 0.77 0.48558 1.541785 -0.15 0 /home/mss/simulation/BSDF_Files/boston2_radFiles/Mods_GlassLT_70.rad /home/mss/simulation/BSDF_Files/boston2_radFiles/blinds_001.rad /home/mss/simulation/BSDF_Files/boston2_radFiles/Geo_GlassLT_70.rad > ~/simulation/BSDF_Files/boston2_blinds_001_GlassLT_70.xml
echo ~/simulation/BSDF_Files/boston2_blinds_001_GlassLT_70.xml""")  # -> Stdout, Stderr, Ran

convertpaths_3 = ConvertPaths(I=merge_2)  # -> Linux, Windows
radviewer_3 = RadViewer(
    RadFiles=flatten(convertpaths_3.Windows),
    DisplayName="BSDF Viewer",
    IsTwoSided=False,
    Polychromatic=True,
    ShowEdges=True,
    Transparent=True,
    ColorNames=["_GlassTak_70_mat", "blindmat", "_GlassLT_70"],
    Colors=[RGB(199, 212, 152), RGB(102, 195, 125), RGB(190, 228, 206)])  # -> Geo, ModifierNames, Modifiers, FailedWireFrame

# ----
# rmtxop (matrixmultiplication for grid based)
# mkdir -p <proj>/results/3PhGrid
# rmtxop <vmx> <bsdf> <dmx> <smx> | rmtxop -fa -c 47.4 119.9 11.6 - > <proj>/results/3PhGrid/<aperture><bsdfName>.ill
# echo "<proj>/results/3PhGrid/<aperture><bsdfName>.ill"
skymtx_2 = Text(skymtx)
glassname_3 = Text(python_10)
roomnumber_3 = Text(roomnumber)
vmx_grid_2 = Text(vmx_grid)
panel_66 = Panel("""mkdir -p <proj>/results/3PhGrid
rmtxop <vmx> "<bsdf>" <dmx> <smx> | rmtxop -fa -c 47.4 119.9 11.6 - | rcollate -t > "<proj>/results/3PhGrid/<room>_<aperture>_<bsdfName>.ill"
echo "<proj>/results/3PhGrid/<room>_<aperture>_<bsdfName>.ill"
""")
dmx_3 = Text(dmx)
m_3 = GhPythonScript(i=roomnumber_3)  # -> i1, simplify(i2); inputs i: Int32; same code as m
falsestart_3 = LBFalseStartToggle(True)

abx_6 = ABX(data=glassname_3, pathCount=panel_41)  # -> data; inputs data: tree, pathCount: Int32; same code as abx_3

aperturename = Text(abx_6)
long_4 = LongestList(ListA=m_3.i2, ListB=aperturename, PaddingMode=2)  # -> ListA, ListB
overrides_33 = ApplyOverrides(
    Input_=panel_66,
    Vmx=graft(vmx_grid_2),
    Aperture=graft(aperturename),
    Dmx=graft(dmx_3),
    Bsdf=graft("<bsdf>"),
    Smx=graft(skymtx_2),
    BsdfName=graft("<bsdfName>"),
    Room=graft(long_4.ListA))  # -> simplify(graft(Output)), Pairs
overrides_34 = ApplyOverrides(Input_=flatten(overrides_33.Output), BsdfName=graft(bsdf_5.name_2), BsdfName_2=graft(bsdf_5.path_2))  # -> graft(Output), Pairs

panel_67 = Panel(overrides_34.Output)
executessh_wip_13 = ExecuteSSHWIP(
    _SSHCommands_=overrides_34.Output,
    Run=falsestart_3,
    addPrefix=True,
    description="""mkdir -p ~/simulation/boston2/results/3PhGrid
rmtxop /home/mss/simulation/boston2/mtxs/3ph_vmx_grid/00_00_Glass.vmx "/home/mss/simulation/BSDF_Files/8mm\ MS-F\ 6014\ Rot\ 90.xml" ~/simulation/boston2/mtxs/3ph_dmx/00_Glass.dmx /home/mss/simulation/weatherData/NOR_Oslo.Fornebu.014880_IWEC_m1.smx | rmtxop -fa -c 47.4 119.9 11.6 - | rcollate -t > "~/simulation/boston2/results/3PhGrid/00_00_Glass_8mm_MS-F_6014_Rot_90.ill"
echo "~/simulation/boston2/results/3PhGrid/00_00_Glass_8mm_MS-F_6014_Rot_90.ill"


- - -

mkdir -p ~/simulation/boston2/results/3PhGrid
rmtxop /home/mss/simulation/boston2/mtxs/3ph_vmx_grid/00_00_Glass_Facade.vmx "/home/mss/simulation/BSDF_Files/8mm\ MS-F\ 6014\ Rot\ 90.xml" ~/simulation/boston2/mtxs/3ph_dmx/00_Glass_Facade.dmx /home/mss/simulation/weatherData/NOR_Oslo.Fornebu.014880_IWEC_m1.smx | rmtxop -fa -c 47.4 119.9 11.6 - | rcollate -t > "~/simulation/boston2/results/3PhGrid/00_00_Glass_Facade_8mm_MS-F_6014_Rot_90.ill"
echo "~/simulation/boston2/results/3PhGrid/00_00_Glass_Facade_8mm_MS-F_6014_Rot_90.ill"


- - -

mkdir -p ~/simulation/boston2/results/3PhGrid
rmtxop /home/mss/simulation/boston2/mtxs/3ph_vmx_grid/00_00_Glass.vmx "/home/mss/simulation/BSDF_Files/boston2_8mm_MS-F_6014_Rot_90.xml" ~/simulation/boston2/mtxs/3ph_dmx/00_Glass.dmx /home/mss/simulation/weatherData/NOR_Oslo.Fornebu.014880_IWEC_m1.smx | rmtxop -fa -c 47.4 119.9 11.6 - | rcollate -t > "~/simulation/boston2/results/3PhGrid/00_00_Glass_boston2_8mm_MS-F_6014_Rot_90.ill"
echo "~/simulation/boston2/results/3PhGrid/00_00_Glass_boston2_8mm_MS-F_6014_Rot_90.ill"


- - -

mkdir -p ~/simulation/boston2/results/3PhGrid
rmtxop /home/mss/simulation/boston2/mtxs/3ph_vmx_grid/00_00_Glass_Facade.vmx "/home/mss/simulation/BSDF_Files/boston2_8mm_MS-F_6014_Rot_90.xml" ~/simulation/boston2/mtxs/3ph_dmx/00_Glass_Facade.dmx /home/mss/simulation/weatherData/NOR_Oslo.Fornebu.014880_IWEC_m1.smx | rmtxop -fa -c 47.4 119.9 11.6 - | rcollate -t > "~/simulation/boston2/results/3PhGrid/00_00_Glass_Facade_boston2_8mm_MS-F_6014_Rot_90.ill"
echo "~/simulation/boston2/results/3PhGrid/00_00_Glass_Facade_boston2_8mm_MS-F_6014_Rot_90.ill"


- - -

mkdir -p ~/simulation/boston2/results/3PhGrid
rmtxop /home/mss/simulation/boston2/mtxs/3ph_vmx_grid/00_00_Glass.vmx "/home/mss/simulation/BSDF_Files/boston2_blinds_001_GlassLT_70.xml" ~/simulation/boston2/mtxs/3ph_dmx/00_Glass.dmx /home/mss/simulation/weatherData/NOR_Oslo.Fornebu.014880_IWEC_m1.smx | rmtxop -fa -c 47.4 119.9 11.6 - | rcollate -t > "~/simulation/boston2/results/3PhGrid/00_00_Glass_boston2_blinds_001_GlassLT_70.ill"
echo "~/simulation/boston2/results/3PhGrid/00_00_Glass_boston2_blinds_001_GlassLT_70.ill"


- - -

mkdir -p ~/simulation/boston2/results/3PhGrid
rmtxop /home/mss/simulation/boston2/mtxs/3ph_vmx_grid/00_00_Glass_Facade.vmx "/home/mss/simulation/BSDF_Files/boston2_blinds_001_GlassLT_70.xml" ~/simulation/boston2/mtxs/3ph_dmx/00_Glass_Facade.dmx /home/mss/simulation/weatherData/NOR_Oslo.Fornebu.014880_IWEC_m1.smx | rmtxop -fa -c 47.4 119.9 11.6 - | rcollate -t > "~/simulation/boston2/results/3PhGrid/00_00_Glass_Facade_boston2_blinds_001_GlassLT_70.ill"
echo "~/simulation/boston2/results/3PhGrid/00_00_Glass_Facade_boston2_blinds_001_GlassLT_70.ill"
""",
    fireLogs=True,
    lastRunTime=7774.7784,
    name="rmtxop combining vmx+dmx",
    suppressWarnings=False,
    results=["~/simulation/boston2/results/3PhGrid/00_00_Glass_8mm_MS-F_6014_Rot_90.ill", "~/simulation/boston2/results/3PhGrid/00_00_Glass_Facade_8mm_MS-F_6014_Rot_90.ill", "~/simulation/boston2/results/3PhGrid/00_00_Glass_boston2_8mm_MS-F_6014_Rot_90.ill", "~/simulation/boston2/results/3PhGrid/00_00_Glass_Facade_boston2_8mm_MS-F_6014_Rot_90.ill", "~/simulation/boston2/results/3PhGrid/00_00_Glass_boston2_blinds_001_GlassLT_70.ill", "~/simulation/boston2/results/3PhGrid/00_00_Glass_Facade_boston2_blinds_001_GlassLT_70.ill"],
    stderr=["""bash: line 1: ~/simulation/boston2/results/3PhGrid/00_00_Glass_8mm_MS-F_6014_Rot_90.ill: No such file or directory
system - cannot find BSDF file '/home/mss/simulation/BSDF_Files/8mm\ MS-F\ 6014\ Rot\ 90.xml': No such file or directory
<stdin>: cannot load matrix
rmtxop: operation failed on '-'""", """bash: line 1: ~/simulation/boston2/results/3PhGrid/00_00_Glass_Facade_8mm_MS-F_6014_Rot_90.ill: No such file or directory
system - cannot find BSDF file '/home/mss/simulation/BSDF_Files/8mm\ MS-F\ 6014\ Rot\ 90.xml': No such file or directory
<stdin>: cannot load matrix
rmtxop: operation failed on '-'""", "bash: line 1: ~/simulation/boston2/results/3PhGrid/00_00_Glass_boston2_8mm_MS-F_6014_Rot_90.ill: No such file or directory", "bash: line 1: ~/simulation/boston2/results/3PhGrid/00_00_Glass_Facade_boston2_8mm_MS-F_6014_Rot_90.ill: No such file or directory", "bash: line 1: ~/simulation/boston2/results/3PhGrid/00_00_Glass_boston2_blinds_001_GlassLT_70.ill: No such file or directory", "bash: line 1: ~/simulation/boston2/results/3PhGrid/00_00_Glass_Facade_boston2_blinds_001_GlassLT_70.ill: No such file or directory"],
    commands=["""mkdir -p ~/simulation/boston2/results/3PhGrid
rmtxop /home/mss/simulation/boston2/mtxs/3ph_vmx_grid/00_00_Glass.vmx "/home/mss/simulation/BSDF_Files/8mm\ MS-F\ 6014\ Rot\ 90.xml" ~/simulation/boston2/mtxs/3ph_dmx/00_Glass.dmx /home/mss/simulation/weatherData/NOR_Oslo.Fornebu.014880_IWEC_m1.smx | rmtxop -fa -c 47.4 119.9 11.6 - | rcollate -t > "~/simulation/boston2/results/3PhGrid/00_00_Glass_8mm_MS-F_6014_Rot_90.ill"
echo "~/simulation/boston2/results/3PhGrid/00_00_Glass_8mm_MS-F_6014_Rot_90.ill"
""", """mkdir -p ~/simulation/boston2/results/3PhGrid
rmtxop /home/mss/simulation/boston2/mtxs/3ph_vmx_grid/00_00_Glass.vmx "/home/mss/simulation/BSDF_Files/boston2_8mm_MS-F_6014_Rot_90.xml" ~/simulation/boston2/mtxs/3ph_dmx/00_Glass.dmx /home/mss/simulation/weatherData/NOR_Oslo.Fornebu.014880_IWEC_m1.smx | rmtxop -fa -c 47.4 119.9 11.6 - | rcollate -t > "~/simulation/boston2/results/3PhGrid/00_00_Glass_boston2_8mm_MS-F_6014_Rot_90.ill"
echo "~/simulation/boston2/results/3PhGrid/00_00_Glass_boston2_8mm_MS-F_6014_Rot_90.ill"
""", """mkdir -p ~/simulation/boston2/results/3PhGrid
rmtxop /home/mss/simulation/boston2/mtxs/3ph_vmx_grid/00_00_Glass_Facade.vmx "/home/mss/simulation/BSDF_Files/boston2_8mm_MS-F_6014_Rot_90.xml" ~/simulation/boston2/mtxs/3ph_dmx/00_Glass_Facade.dmx /home/mss/simulation/weatherData/NOR_Oslo.Fornebu.014880_IWEC_m1.smx | rmtxop -fa -c 47.4 119.9 11.6 - | rcollate -t > "~/simulation/boston2/results/3PhGrid/00_00_Glass_Facade_boston2_8mm_MS-F_6014_Rot_90.ill"
echo "~/simulation/boston2/results/3PhGrid/00_00_Glass_Facade_boston2_8mm_MS-F_6014_Rot_90.ill"
""", """mkdir -p ~/simulation/boston2/results/3PhGrid
rmtxop /home/mss/simulation/boston2/mtxs/3ph_vmx_grid/00_00_Glass.vmx "/home/mss/simulation/BSDF_Files/boston2_blinds_001_GlassLT_70.xml" ~/simulation/boston2/mtxs/3ph_dmx/00_Glass.dmx /home/mss/simulation/weatherData/NOR_Oslo.Fornebu.014880_IWEC_m1.smx | rmtxop -fa -c 47.4 119.9 11.6 - | rcollate -t > "~/simulation/boston2/results/3PhGrid/00_00_Glass_boston2_blinds_001_GlassLT_70.ill"
echo "~/simulation/boston2/results/3PhGrid/00_00_Glass_boston2_blinds_001_GlassLT_70.ill"
""", """mkdir -p ~/simulation/boston2/results/3PhGrid
rmtxop /home/mss/simulation/boston2/mtxs/3ph_vmx_grid/00_00_Glass_Facade.vmx "/home/mss/simulation/BSDF_Files/boston2_blinds_001_GlassLT_70.xml" ~/simulation/boston2/mtxs/3ph_dmx/00_Glass_Facade.dmx /home/mss/simulation/weatherData/NOR_Oslo.Fornebu.014880_IWEC_m1.smx | rmtxop -fa -c 47.4 119.9 11.6 - | rcollate -t > "~/simulation/boston2/results/3PhGrid/00_00_Glass_Facade_boston2_blinds_001_GlassLT_70.ill"
echo "~/simulation/boston2/results/3PhGrid/00_00_Glass_Facade_boston2_blinds_001_GlassLT_70.ill"
"""])  # -> flatten(Stdout), Stderr_, Ran

panel_68 = Panel(executessh_wip_13.Stdout)
ill_file = Text(executessh_wip_13.Stdout)

list = ItemSelector(
    executessh_wip_13.Stdout,
    {"~/simulation/boston2/results/3PhGrid/00_00_Glass_8mm_MS-F_6014_Rot_90.ill", "~/simulation/boston2/results/3PhGrid/00_00_Glass_Facade_8mm_MS-F_6014_Rot_90.ill", "~/simulation/boston2/results/3PhGrid/00_00_Glass_boston2_8mm_MS-F_6014_Rot_90.ill", "~/simulation/boston2/results/3PhGrid/00_00_Glass_Facade_boston2_8mm_MS-F_6014_Rot_90.ill", "~/simulation/boston2/results/3PhGrid/00_00_Glass_boston2_blinds_001_GlassLT_70.ill", "~/simulation/boston2/results/3PhGrid/00_00_Glass_Facade_boston2_blinds_001_GlassLT_70.ill"}, selected=[])
python_14 = GhPythonScript(x=executessh_wip_13.Stdout, y=list)  # -> out, a; inputs y: list
# ---------- python_14: Python ----------
__author__ = "mm1013"
__version__ = "2022.09.06"

import rhinoscriptsyntax as rs

a = x in y
# ---------- end python_14 ----------
unflatten_6 = UnflattenTree(Tree=executessh_wip_13.Stdout, Guide=abx_3)
unflatten_7 = UnflattenTree(Tree=python_14.a, Guide=abx_3)
cull_14 = CullPattern(List=unflatten_6, CullPattern=unflatten_7)
cluster_7 = Cluster_2(L=unflatten_7)
python_15 = GhPythonScript(x=cull_14, y=cluster_7)  # -> a; inputs x: list, y: Int32
# ---------- python_15: Python ----------
__author__ = "mm1013"
__version__ = "2022.09.06"

import rhinoscriptsyntax as rs

if len(x) == 0:
    a = []
elif len(x) == 1:
    a = "echo " + x[0]
else:
    rmt_files = " + ".join(x)
    
    #generating final file name
    splitted = x[0].split("/")
    p = "/".join(splitted[:-1]) + "/" + splitted[-1][:6]
    finalfile = p + "%02d" % y + "_combined.ill"
    
    
    a = 'if [ -f {0} ]; then\n    echo {0}\nelse\n    rmtxop {1} > {0};echo {0}\nfi'\
    .format(finalfile, rmt_files)
# ---------- end python_15 ----------
default_2 = DefaultMSS(data=flatten(falsestart_2), default_value_flattened=flatten(list))
panel_69 = Panel(python_15)
executessh_wip_14 = ExecuteSSHWIP(_SSHCommands=python_15, Run=default_2, addPrefix=True, fireLogs=False, lastRunTime=29, suppressWarnings=True)  # -> Stdout, Stderr, Ran
convertpaths_4 = ConvertPaths(I=executessh_wip_14.Stdout)  # -> Linux, Windows

# ----
# preview grid results
_17037_schedule = Integer(cluster_5)
mesh_explode = MeshExplode(m=move_2.Geometry)  # -> out, simplify(A); same code as mesh_explode

annualresults = AnnualResults(
    IllFile=flatten(convertpaths_4.Windows),
    Schedule=dup,
    Min="100",
    Max=0,
    Run=executessh_wip_14.Ran,
    numbers=[0.8884931507, 0.8643835616, 0.8043835616, 0.6306849315, 0.4684931507, 0.1619178082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])  # -> Headers, simplify(Results), Ran
facen_2 = FaceNormals(Mesh=mesh_explode.A)  # -> Centers, Normals
pl_origin_3 = PlaneOrigin(Base=pln_4, Origin=facen_2.Centers)

expression = Expression(x=annualresults.Results, Expression="Format(\"{0:0}\", x*100)")

long_5 = LongestList(ListA=mesh_explode.A, ListB=expression, PaddingMode=2)  # -> ListA, ListB

gradient = Gradient(
    LowerLimit="100",
    UpperLimit="0",
    Parameter=long_5.ListB,
    stops=[0: RGB(234, 38, 0), 0.25: RGB(234, 126, 0), 0.5: RGB(254, 244, 84), 0.75: RGB(173, 203, 249), 1: RGB(75, 107, 169)])
mcol = MeshColours(Mesh=graft(long_5.ListA), Colours=graft(gradient))
mjoin = MeshJoin(Meshes=flatten(mcol))
medges = MeshEdges(Mesh=mjoin)  # -> NakedEdges, InteriorEdges, NonManifoldEdges
tag_2 = TextTag3D(
    Location=flatten(pl_origin_3),
    Text=flatten(long_5.ListB),
    Size="0.13",
    Colour=ColourSwatch(SwatchColor=RGB(255, 255, 255)),
    Justification=5)
preview = CustomPreview(Geometry=[medges.NakedEdges, medges.InteriorEdges], Material=ColourSwatch(SwatchColor=RGB(76, 97, 125)))

# ==== cluster Normals
amplitude = ClusterInput()
amplitude_2 = Data(amplitude)
geo = ClusterInput()
merge = Merge(Data1=flatten(amplitude_2), Data2=flatten("1m"))
geo_2 = Geometry(geo)
item = ListItem(List=merge, Index=0, Wrap=True)
facen = FaceNormals(Mesh=geo_2)  # -> Centers, Normals
U = Units(ValueString=item)
avr = Average(Input=facen.Centers)
avr_2 = Average(Input=facen.Normals)
unflatten = UnflattenTree(Tree=avr, Guide=geo_2)
unflatten_2 = UnflattenTree(Tree=avr_2, Guide=geo_2)
amp = Amplitude(Vector=unflatten_2, Amplitude=U)
pl = PlaneNormal(Origin=unflatten, ZAxis=unflatten_2)
norm = Vector(amp)
center = Point(unflatten)
P = ClusterOutput(pl)
norm_2 = ClusterOutput(norm)
center_2 = ClusterOutput(center)

# ==== cluster DefaultMSS
default_value_flattened = ClusterInput()
data = ClusterInput()
data_2 = Data(data)
merge = Merge(Data1=flatten(data_2), Data2="0")  # -> flatten(Result)
default_value_flattened_2 = Data(flatten(default_value_flattened))
lng = ListLength(List=merge)
equals = Equality(FirstNumber=lng, SecondNumber="1")  # -> Equality, Inequality
cull = CullPattern(List=data_2, CullPattern=invert(equals.Equality))
panel = Panel(equals.Equality)
cull_2 = CullPattern(List=default_value_flattened_2, CullPattern=equals.Equality)
data_3 = Data([cull, cull_2])
data_4 = ClusterOutput(data_3)

# ==== cluster MeshIt2: Meshes everything in the input. Graft the input if you want to make several meshes, otherwise returns a joined mesh.
mesh_brep = ClusterInput()
mesh_brep_2 = Geometry(simplify(mesh_brep))
tmatch = MatchText(Text=mesh_brep_2, RegEx="(mesh)", Case=False)
tmatch_2 = MatchText(Text=mesh_brep_2, RegEx="(brep)|(polysurface)|(surface)|(extrusion)", Case=False)
group = Group(Objects=mesh_brep_2)
cull = CullPattern(List=mesh_brep_2, CullPattern=tmatch_2)
mesh = MeshBrep(
    Brep=cull,
    Settings={GridMaxCount=0, GridMinCount=16, JaggedSeams=False, MaxEdgeLength=0, MinEdgeLength=0.0001, MinTolerance=0, Refine=True, RefineAngle=0, RelativeTolerance=0.65, SimplePlanes=True, Tolerance=0})  # -> simplify(Mesh)
cull_2 = CullPattern(List=mesh_brep_2, CullPattern=tmatch)  # -> simplify(List)

# ----
# Fix invalid mesh
panel = Panel("Invalid Mesh")  # disabled
mesh_2 = Mesh(mesh)  # disabled
tmatch_3 = MatchText(Text=mesh_2, RegEx=panel, Case=False)  # disabled
unweave = Unweave(List=mesh_2, UnweavePattern=tmatch_3)  # -> Data0, Data1; disabled
explode = MeshExplode(Mesh=unweave.Data1, Interpolate=False)  # -> simplify(Faces); disabled
abc_a = ABC(data=explode)  # disabled
panel_2 = Panel("0")  # disabled
num = Number(panel_2)  # disabled
area = MeshArea(Mesh=abc_a)  # -> Area, Centroid; disabled
equals = Equality(FirstNumber=area.Area, SecondNumber=num)  # -> Equality, Inequality; disabled
cull_3 = CullPattern(List=abc_a, CullPattern=equals.Inequality)  # disabled
mjoin = MeshJoin(Meshes=[cull_3, unweave.Data0])  # disabled

# ----
# Fix invalid mesh
panel_3 = Panel("Invalid Mesh")  # disabled
mesh_3 = Mesh(cull_2)  # disabled
tmatch_4 = MatchText(Text=mesh_3, RegEx=panel_3, Case=False)  # disabled
unweave_2 = Unweave(List=mesh_3, UnweavePattern=tmatch_4)  # -> Data0, Data1; disabled
explode_2 = MeshExplode(Mesh=unweave_2.Data1, Interpolate=False)  # -> simplify(Faces); disabled
abc_a_2 = ABC(data=explode_2)  # disabled
panel_4 = Panel("0")  # disabled
num_2 = Number(panel_4)  # disabled
area_2 = MeshArea(Mesh=abc_a_2)  # -> Area, Centroid; disabled
equals_2 = Equality(FirstNumber=area_2.Area, SecondNumber=num_2)  # -> Equality, Inequality; disabled
cull_4 = CullPattern(List=abc_a_2, CullPattern=equals_2.Inequality)  # disabled
mjoin_2 = MeshJoin(Meshes=[cull_4, unweave_2.Data0])  # disabled

mjoin_3 = MeshJoin(Meshes=[mesh, cull_2])
c_script = CSharpScript(mesh=mjoin_3)  # -> A; inputs mesh: Mesh
# ---------- c_script: C# ----------
    mesh.Faces.CullDegenerateFaces();
    A = mesh;
# ---------- end c_script ----------
abc_a_3 = ABC(data=mjoin)  # disabled
abc_a_4 = ABC(data=mjoin_2)  # disabled
clean = CleanTree(RemoveNulls=True, RemoveInvalid=True, RemoveEmpty=False, Tree=[abc_a_3, abc_a_4])  # disabled
mjoin_4 = MeshJoin(Meshes=clean)  # disabled
unflatten = UnflattenTree(Tree=c_script, Guide=group)
mesh_explode = MeshExplode(m=mjoin_4)  # -> out, simplify(A); disabled
# ---------- mesh_explode: VB ----------
    Component.Params.Input(0).Name = "Mesh"
    Component.Params.Input(0).Description = "Open or closed mesh"

    Component.Params.Output(1).Name = "Mesh"
    Component.Params.Output(1).Description = "If successful, a valid mesh"

    If m IsNot Nothing Then
      Dim pts As Rhino.Geometry.Collections.MeshVertexList
      Dim faces As Rhino.Geometry.Collections.MeshFaceList
      Dim clrs As Rhino.Geometry.Collections.MeshVertexColorList
      Dim i As Integer
      Dim mshs As New list(Of mesh)

      faces = m.Faces
      pts = m.Vertices
      If m.VertexColors.count() = 0 Then m.VertexColors.CreateMonotoneMesh(color.FromArgb(100, 100, 100))
      clrs = m.VertexColors

      For i = 0 To faces.count() - 1 Step 1
        Dim fc As New meshFace
        Dim face As New MeshFace
        Dim ptList As New list(Of point3d)
        Dim clrList As New list(Of color)
        Dim msh As New mesh

        face = faces(i)

        ptList.add(New point3d(pts(face.A)))
        ptList.add(New point3d(pts(face.B)))
        ptList.add(New point3d(pts(face.C)))
        If face.IsQuad Then ptList.add(New point3d(pts(face.D)))

        clrList.add(clrs(face.A))
        clrList.add(clrs(face.B))
        clrList.add(clrs(face.C))
        If face.IsQuad Then clrList.add(clrs(face.D))

        If face.IsQuad Then fc = New meshFace(0, 1, 2, 3) Else fc = New meshface(0, 1, 2)

        msh.Vertices.AddVertices(ptList.toarray())
        msh.Faces.AddFace(fc)
        msh.VertexColors.SetColors(clrList.toarray())
        mshs.add(msh)
      Next

      A = mshs
    End If
# ---------- end mesh_explode ----------
c_script_2 = CSharpScript(mesh=mjoin_4)  # -> A; inputs mesh: Mesh; disabled; same code as c_script
c_script_3 = CSharpScript(mesh=mesh_explode.A)  # -> out, A; inputs mesh: list of Mesh; disabled
# ---------- c_script_3: C# ----------
    List<bool> isValid = new List<bool>();
    for (int i = 0; i < mesh.Count; i++)
    {
      isValid.Add(mesh[i].IsValid);
    }
    
    A = isValid;
# ---------- end c_script_3 ----------
mesh_joined = Mesh(unflatten)
cullf = CullFaces(Mesh=mjoin_4, Pattern=invert(c_script_3.A))  # disabled
mesh_joined_2 = ClusterOutput(mesh_joined)

# ==== cluster LargestBREP
window_breps = ClusterInput()
window_breps_2 = Brep(window_breps)
debrep = DeconstructBrep(Brep=window_breps_2)  # -> Faces, Edges, Vertices
area = Area(Geometry=debrep.Faces)  # -> Area, Centroid
sort = SortList(Keys=area.Area, ValuesA=debrep.Faces)  # -> Keys, ValuesA
item = ListItem(List=sort.ValuesA, Index=-1, Wrap=True)
group = Group(Objects=flatten(item))
grouped = ClusterOutput(group)

# ==== cluster Cluster
l = ClusterInput()
python = GhPythonScript(l=l)  # -> xmin, xmax, ymin, ymax, zmin; inputs l: list
# ---------- python: Python ----------
__author__ = "mm1013"
__version__ = "2022.08.20"

import rhinoscriptsyntax as rs
li = [s for s in l[1].split(" ") if len(s) > 0]
#print(li)
xmin, xmax, ymin, ymax, zmin, zmax = [float(v) for v in li]


if zmax > 0:
    print("Err, Zmax should be < 0!")
else:
    print("Zmax is OK (< 0)")
# ---------- end python ----------
default = DefaultMSS(data=flatten(python.zmin), default_value_flattened=flatten("-0.2"))
panel = Panel("""0.23
0.77""")
dom = ConstructDomain(DomainStart=python.xmin, DomainEnd=python.xmax)
dom_2 = ConstructDomain(DomainStart=python.ymin, DomainEnd=python.ymax)
default_2 = DefaultMSS(data=flatten(dom), default_value_flattened=flatten("0 to 1"))
default_3 = DefaultMSS(data=flatten(dom_2), default_value_flattened=flatten("0 to 1"))
remap = RemapNumbers(Value=panel, Source=Domain(0, 1), Target=default_2)  # -> Mapped, Clipped
remap_2 = RemapNumbers(Value=panel, Source=Domain(0, 1), Target=default_3)  # -> Mapped, Clipped
item = ListItem(List=remap.Mapped, Index=0, Wrap=True)  # -> Item, Item1
item_2 = ListItem(List=remap_2.Mapped, Index=0, Wrap=True)  # -> Item, Item1
data = ClusterOutput(default)
xend = Number(item.Item1)
ystart = Number(item_2.Item)
yend = Number(item_2.Item1)
xstart = Number(item.Item)
xend_2 = ClusterOutput(xend)
ystart_2 = ClusterOutput(ystart)
yend_2 = ClusterOutput(yend)
xstart_2 = ClusterOutput(xstart)

# ==== cluster Cluster_2
L = ClusterInput()
lng = ListLength(List=L)
series = Series(Start=0, Step=1, Count=lng)
expression = Expression(x=series, Expression="2^x")
cull = CullPattern(List=expression, CullPattern=L)
ma = MassAddition(Input=cull)  # -> Result, PartialResults
R = ClusterOutput(ma.Result)

# ==== cluster Cluster_3
horizontaldiffrad = ClusterInput()
horizontaldiffrad_2 = Number(horizontaldiffrad)
lng = ListLength(List=horizontaldiffrad_2)
lng_2 = ListLength(List=horizontaldiffrad_2)
series = Series(Start=0, Step=0, Count=lng)
division = Division(A=lng, B=2)
series_2 = Series(Start=0, Step=1, Count=lng_2)
subtraction = Subtraction(A=division, B=1)
sort = SortList(Keys=horizontaldiffrad_2, ValuesA=series_2)  # -> reverse(Keys), reverse(ValuesA)
dom = ConstructDomain(DomainStart="0", DomainEnd=subtraction)
subset = SubList(List=sort.ValuesA, Domain=dom, Wrap=True)  # -> List, Index
replace = ReplaceItems(List=series, Item="1", Indices=subset.List, Wrap=False)
schedule_01 = ClusterOutput(replace)

# ==== cluster BSDF
bsdf_file_path_linux = ClusterInput()
bsdf_name = ClusterInput()
bsdf_file_path_linux_2 = Text(bsdf_file_path_linux)
bsdf_name_2 = Text(bsdf_name)
item = ListItem(List=bsdf_name_2, Index=0, Wrap=True)
item_2 = ListItem(List=bsdf_file_path_linux_2, Index=0, Wrap=True)
merge = Merge(Data1=item, Data2=item_2)
join = TextJoin(Text=merge, Join=";")  # -> flatten(Result)
bsdf_pairs = Text(join)
bsdf_pairs_2 = ClusterOutput(bsdf_pairs)

# ==== cluster BSDF_2
bsdf_pairs = ClusterInput()
bsdf_pairs_2 = Text(flatten(bsdf_pairs))
split = TextSplit(Text=bsdf_pairs_2, Separators=";")  # -> simplify(Result)
flip = FlipMatrix(Data=split)  # -> simplify(Data)
bang = ExplodeTree(Data=flip)  # -> Branch0, Branch1
python = GhPythonScript(x=bang.Branch1)  # -> out, a
# ---------- python: Python ----------
__author__ = "mm1013"
__version__ = "2022.09.09"

import rhinoscriptsyntax as rs

a = x.replace(" ","\ ")
# ---------- end python ----------
path = Text(python.a)
name = Text(bang.Branch0)
path_2 = ClusterOutput(path)
name_2 = ClusterOutput(name)

# ==== cluster Cluster_4
x = ClusterInput()
python = GhPythonScript(x=x)  # -> a
# ---------- python: Python ----------
__author__ = "mm1013"
__version__ = "2022.07.02"

import rhinoscriptsyntax as rs

##Removing the leading "~"
a = x[1:]
# ---------- end python ----------
a = ClusterOutput(python)

# ==== cluster Cluster_5
x = ClusterInput()
python = GhPythonScript(x=x)  # -> bsdf_name, bsdf_path
# ---------- python: Python ----------
__author__ = "mm1013"
__version__ = "2022.09.09"

import rhinoscriptsyntax as rs

bsdf_path = x.replace("_JOIN_","").replace("\n","").strip()
bsdf_name = bsdf_path.split(".")[0].split("/")[-1].replace(" ","_")
# ---------- end python ----------
bsdf_name = ClusterOutput(python.bsdf_name)
bsdf_path = ClusterOutput(python.bsdf_path)

# ==== cluster ABC
data = ClusterInput()
data_2 = Data(data)
path_mapper = PathMapper(
    data_2,
    source=["{A;B;C;D;E;F;G}", "{A;B;C;D;E;F}", "{A;B;C;D;E}", "{A;B;C;D}", "{A;B;C}", "{A;B}", "{A}"],
    target=["{A}", "{A}", "{A}", "{A}", "{A}", "{A}", "{A}"])
data_3 = Data(path_mapper)
data_4 = ClusterOutput(data_3)
